# Grasshopper definition Step1a-GH_Wall_GetData-1.gh (Grasshopper 1.0.7)
# plug-ins: Heteroptera, LunchBox, Human

crv = Curve([<curve referenced from the Rhino model> x2199])
item = ListItem(List=flatten(crv), Index=Slider(0, range=0..10), Wrap=True)
lng = ListLength(List=crv)

# ---- group: Find Wall Material
objatts = ObjectAttributes(ObjectOrAttributes=crv)  # -> Name, LayerName, LayerFullPath, Color, MaterialName, LinetypeName, GroupIndices, PlotWeight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
tmatch = MatchText(Text=objatts.LayerName, Pattern="*GAZB*", Case=False)
mindex = MemberIndex(Set=tmatch, Member=Toggle(True))  # -> Index, Count
replace = ReplaceItems(List=objatts.LayerName, Item="Gazbeton", Indices=mindex.Index, Wrap=False)
tmatch_2 = MatchText(Text=replace, Pattern="*ALCI_kutu*", Case=False)
mindex_2 = MemberIndex(Set=tmatch_2, Member=Toggle(True))  # -> Index, Count
replace_2 = ReplaceItems(List=replace, Item="ALCI-kutu", Indices=mindex_2.Index, Wrap=False)
tmatch_3 = MatchText(Text=replace_2, Pattern="*KPLM_kursun*", Case=False)
mindex_3 = MemberIndex(Set=tmatch_3, Member=Toggle(True))  # -> Index, Count
replace_3 = ReplaceItems(List=replace_2, Item="KAPL-kursun", Indices=mindex_3.Index, Wrap=False)
tmatch_4 = MatchText(Text=replace_3, Pattern="*PANL*", Case=False)
mindex_4 = MemberIndex(Set=tmatch_4, Member=Toggle(True))  # -> Index, Count
replace_4 = ReplaceItems(List=replace_3, Item="Panel", Indices=mindex_4.Index, Wrap=False)
tmatch_5 = MatchText(Text=replace_4, Pattern="*ALCI_uc*", Case=False)
mindex_5 = MemberIndex(Set=tmatch_5, Member=Toggle(True))  # -> Index, Count
replace_5 = ReplaceItems(List=replace_4, Item="ALCI-uc", Indices=mindex_5.Index, Wrap=False)  # -> flatten(List)

# ----
series = Series(Start=0, Step=1, Count=lng)

# ---- group: Draw Perp Line for each line
item_2 = ListItem(List=crv, Index=series, Wrap=True)  # -> graft(Item)
curvepoint = PointOnCurve(item_2, parameter=0.5)
X = UnitX(Factor=1)
xy = XYPlane(Origin=Point(0, 0, 0))
angle = Angle(VectorA=item_2, VectorB=X, Plane=xy)  # -> Angle, Reflex
X_2 = UnitX(Factor=1)
Z = UnitZ(Factor=1)
multiplication = Multiplication(A=angle.Angle, B=2)
pi = Pi(Factor=[0.5, 1.5])
vrot = Rotate(Vector=X_2, Axis=Z, Angle=multiplication)
addition = Addition(A=angle.Angle, B=pi)
rotate = Rotate(Geometry=vrot, Angle=addition, Plane=xy)  # -> Geometry, Transform
line = LineSDL(Start=curvepoint, Direction=rotate.Geometry, Length=250)
join = JoinCurves(Curves=line, Preserve=False)  # -> simplify(Curves)

# ---- group: Find only closest ones
cir = Circle(Plane=curvepoint, Radius=10000)  # -> flatten(Circle)
incurve = PointInCurve(Point=curvepoint, Curve=cir)  # -> Relationship, Point
equals = Equality(FirstNumber=incurve.Relationship, SecondNumber=0)  # -> Equality, Inequality
dispatch = Dispatch(List=crv, DispatchPattern=equals.Inequality)  # -> simplify(ListA), ListB

# ----
panel = Panel(angle.Angle)
panel_2 = Panel(dispatch.ListA)
zone1 = Curve(<curve referenced from the Rhino model>)
zone5 = Curve(<curve referenced from the Rhino model>)
zone4 = Curve(<curve referenced from the Rhino model>)
zone2 = Curve(<curve referenced from the Rhino model>)
zone3 = Curve(<curve referenced from the Rhino model>)
toggle = BooleanToggle(True)
path = FilePath("E:\000_COMAS\55-KAZAKISTAN-RNS-HSTNE\Wall-Automate\ExcelDocuments\R01_Wall_Data.xlsx")
txt = Text(["StartX", "StartY", "EndX", "EndY", "Width", "Material", "Zone"])

# ---- group: Fİnd closest point except self, if only self add 1 as distance
ccx = CurveCurve(CurveA=join, CurveB=dispatch.ListA)  # -> Points, ParamsA, ParamsB
clean = CleanTree(RemoveNulls=True, RemoveInvalid=True, RemoveEmpty=True, Tree=ccx.Points)
pshift = ShiftPaths(Data=clean, Offset=-1)
dist = Distance(PointA=curvepoint, PointB=pshift)

# ----
panel_3 = Panel(pshift)
int = Integer(dist)

# ---- group: Fİnd closest point except self, if only self add 1 as distance (continued)
equals_2 = Equality(FirstNumber=int, SecondNumber=0)  # -> Equality, Inequality
dispatch_2 = Dispatch(List=dist, DispatchPattern=equals_2.Inequality)  # -> ListA, ListB
null = NullItem(Item=dispatch_2.ListA)  # -> NullFlags, InvalidFlags, Description
mindex_6 = MemberIndex(Set=null.NullFlags, Member=Toggle(True))  # -> Index, Count
ins = InsertItems(List=dispatch_2.ListA, Item=1, Indices=mindex_6.Index, Wrap=False)
extremums = MinMax(Number=ins)  # -> Minimum, Maximum

# ---- group: Vector to valid int. point and move along vector with dist/2
mindex_7 = MemberIndex(Set=dist, Member=extremums.Minimum)  # -> Index, Count
item_3 = ListItem(List=pshift, Index=mindex_7.Index, Wrap=True)
vec2pt = Vector2Pt(PointA=curvepoint, PointB=item_3, Unitize=False)  # -> Vector, Length
division = Division(A=vec2pt.Vector, B=2)
move = Move(Geometry=item_2, Motion=division)  # -> simplify(Geometry), Transform

# ---- group: Deleting the biggest line in overlaps
midpt = CurveMiddle(Curve=flatten(move.Geometry))
crv_cp = CurveClosestPoint(Point=midpt, Curve=move.Geometry)  # -> Point, Parameter, Distance
int_2 = Integer(crv_cp.Distance)
equals_3 = Equality(FirstNumber=int_2, SecondNumber=0)  # -> Equality, Inequality
dispatch_3 = Dispatch(List=flatten(move.Geometry), DispatchPattern=equals_3.Equality)  # -> ListA, ListB
len = Length(Curve=dispatch_3.ListA)
sort = SortList(Keys=len, ValuesA=dispatch_3.ListA)  # -> Keys, ValuesA
item_4 = ListItem(List=sort.ValuesA, Index=0, Wrap=True)

# ----
panel_4 = Panel(int_2)
panel_5 = Panel(equals_3.Equality)
panel_6 = Panel(len)
panel_7 = Panel(sort.Keys)

# ---- group: Only exact same walls overlapping
pt = ConstructPoint(XCoordinate=0, YCoordinate=0, ZCoordinate=0)
pt_2 = ConstructPoint(XCoordinate=0, YCoordinate=10, ZCoordinate=0)
item_5 = ListItem(List=simplify(item_4), Index=0, Wrap=True)
ln = Line(StartPoint=pt, EndPoint=pt_2)
nullrep = ReplaceNulls(Items=item_5, Replacements=ln)  # -> flatten(Items), Count
sort_crv = SortDuplicateCurves(Curves=nullrep.Items)  # -> flatten(UniqueCurves), Indices

# ----
panel_8 = Panel(item_4)
int_3 = Integer(flatten(extremums.Minimum))
item_6 = ListItem(List=sort_crv.Indices, Index=0, Wrap=True)  # -> flatten(Item)
item_7 = ListItem(List=int_3, Index=item_6, Wrap=True)
item_8 = ListItem(List=replace_5, Index=item_6, Wrap=True)
equals_4 = Equality(FirstNumber=item_7, SecondNumber=1)  # -> Equality, Inequality
dispatch_4 = Dispatch(List=item_7, DispatchPattern=equals_4.Inequality)  # -> ListA, ListB
dispatch_5 = Dispatch(List=item_8, DispatchPattern=equals_4.Inequality)  # -> ListA, ListB
dispatch_6 = Dispatch(List=sort_crv.UniqueCurves, DispatchPattern=equals_4.Inequality)  # -> ListA, ListB
end = EndPoints(Curve=dispatch_6.ListA)  # -> Start, End
pdecon = Deconstruct(Point=end.Start)  # -> XComponent, YComponent, ZComponent
pdecon_2 = Deconstruct(Point=end.End)  # -> XComponent, YComponent, ZComponent
incurve_2 = PointInCurve(Point=end.End, Curve=zone5)  # -> Relationship, Point
incurve_3 = PointInCurve(Point=end.Start, Curve=zone5)  # -> Relationship, Point
incurve_4 = PointInCurve(Point=end.End, Curve=zone4)  # -> Relationship, Point
incurve_5 = PointInCurve(Point=end.End, Curve=zone3)  # -> Relationship, Point
incurve_6 = PointInCurve(Point=end.Start, Curve=zone4)  # -> Relationship, Point
incurve_7 = PointInCurve(Point=end.Start, Curve=zone1)  # -> Relationship, Point
incurve_8 = PointInCurve(Point=end.Start, Curve=zone2)  # -> Relationship, Point
incurve_9 = PointInCurve(Point=end.End, Curve=zone1)  # -> Relationship, Point
incurve_10 = PointInCurve(Point=end.End, Curve=zone2)  # -> Relationship, Point
incurve_11 = PointInCurve(Point=end.Start, Curve=zone3)  # -> Relationship, Point
equals_5 = Equality(FirstNumber=incurve_2.Relationship, SecondNumber=1)  # -> Equality, Inequality
equals_6 = Equality(FirstNumber=incurve_2.Relationship, SecondNumber=2)  # -> Equality, Inequality
equals_7 = Equality(FirstNumber=incurve_3.Relationship, SecondNumber=1)  # -> Equality, Inequality
equals_8 = Equality(FirstNumber=incurve_3.Relationship, SecondNumber=2)  # -> Equality, Inequality
equals_9 = Equality(FirstNumber=incurve_6.Relationship, SecondNumber=2)  # -> Equality, Inequality
equals_10 = Equality(FirstNumber=incurve_7.Relationship, SecondNumber=1)  # -> Equality, Inequality
equals_11 = Equality(FirstNumber=incurve_7.Relationship, SecondNumber=2)  # -> Equality, Inequality
equals_12 = Equality(FirstNumber=incurve_9.Relationship, SecondNumber=1)  # -> Equality, Inequality
equals_13 = Equality(FirstNumber=incurve_4.Relationship, SecondNumber=1)  # -> Equality, Inequality
equals_14 = Equality(FirstNumber=incurve_9.Relationship, SecondNumber=2)  # -> Equality, Inequality
equals_15 = Equality(FirstNumber=incurve_4.Relationship, SecondNumber=2)  # -> Equality, Inequality
equals_16 = Equality(FirstNumber=incurve_5.Relationship, SecondNumber=1)  # -> Equality, Inequality
equals_17 = Equality(FirstNumber=incurve_5.Relationship, SecondNumber=2)  # -> Equality, Inequality
equals_18 = Equality(FirstNumber=incurve_6.Relationship, SecondNumber=1)  # -> Equality, Inequality
equals_19 = Equality(FirstNumber=incurve_6.Relationship, SecondNumber=2)  # -> Equality, Inequality
equals_20 = Equality(FirstNumber=incurve_8.Relationship, SecondNumber=1)  # -> Equality, Inequality
equals_21 = Equality(FirstNumber=incurve_8.Relationship, SecondNumber=2)  # -> Equality, Inequality
equals_22 = Equality(FirstNumber=incurve_10.Relationship, SecondNumber=1)  # -> Equality, Inequality
equals_23 = Equality(FirstNumber=incurve_11.Relationship, SecondNumber=1)  # -> Equality, Inequality
equals_24 = Equality(FirstNumber=incurve_10.Relationship, SecondNumber=2)  # -> Equality, Inequality
equals_25 = Equality(FirstNumber=incurve_11.Relationship, SecondNumber=2)  # -> Equality, Inequality
or = GateOr(A=equals_5.Equality, B=equals_6.Equality)
or_2 = GateOr(A=equals_7.Equality, B=equals_8.Equality)
or_3 = GateOr(A=equals_10.Equality, B=equals_11.Equality)
or_4 = GateOr(A=equals_12.Equality, B=equals_14.Equality)
or_5 = GateOr(A=equals_13.Equality, B=equals_15.Equality)
or_6 = GateOr(A=equals_16.Equality, B=equals_17.Equality)
or_7 = GateOr(A=equals_18.Equality, B=equals_19.Equality)
or_8 = GateOr(A=equals_20.Equality, B=equals_21.Equality)
or_9 = GateOr(A=equals_22.Equality, B=equals_24.Equality)
or_10 = GateOr(A=equals_23.Equality, B=equals_25.Equality)
or_11 = GateOr(A=or_2, B=or)
or_12 = GateOr(A=or_7, B=or_5)
or_13 = GateOr(A=or_10, B=or_6)
or_14 = GateOr(A=or_8, B=or_9)
or_15 = GateOr(A=or_3, B=or_4)
item_9 = ListItem(List=flatten(dispatch_6.ListA), Index=1591, Wrap=True)
startx = Panel(pdecon.XComponent)
mindex_8 = MemberIndex(Set=or_15, Member=Toggle(True))  # -> Index, Count
mindex_9 = MemberIndex(Set=or_13, Member=Toggle(True))  # -> Index, Count
mindex_10 = MemberIndex(Set=or_12, Member=Toggle(True))  # -> Index, Count
mindex_11 = MemberIndex(Set=or_11, Member=Toggle(True))  # -> Index, Count
mindex_12 = MemberIndex(Set=or_14, Member=Toggle(True))  # -> Index, Count
starty = Panel(pdecon.YComponent)
replace_6 = ReplaceItems(List=dispatch_5.ListA, Item="ZONE-1", Indices=mindex_8.Index, Wrap=False)
replace_7 = ReplaceItems(List=replace_6, Item="ZONE-2", Indices=mindex_12.Index, Wrap=False)
replace_8 = ReplaceItems(List=replace_7, Item="ZONE-3", Indices=mindex_9.Index, Wrap=False)
replace_9 = ReplaceItems(List=replace_8, Item="ZONE-4", Indices=mindex_10.Index, Wrap=False)
replace_10 = ReplaceItems(List=replace_9, Item="ZONE-5", Indices=mindex_11.Index, Wrap=False)  # -> flatten(List)
endx = Panel(pdecon_2.XComponent)
endy = Panel(pdecon_2.YComponent)
width = Panel(dispatch_4.ListA)
material = Panel(dispatch_5.ListA)
zone = Panel(replace_10)
entwine = Entwine(
    Branch00=startx,
    Branch01=starty,
    Branch02=endx,
    Branch03=endy,
    Branch04=width,
    Branch05=material,
    Branch06=zone,
    FlattenInputs=True)
excelwrite = ExcelWrite(
    WriteExcelData=Toggle(True),
    WorkbookPath=path,
    WorksheetName="L01-ZONE4",
    ColumnHeadings=txt,
    Data=entwine,
    ClearSheet=True)
