# Grasshopper definition Step1b-GH_Wall-findtype.gh (Grasshopper 1.0.7)
# plug-ins: EleFront, LunchBox

# AC-BGPL İÇİN FAMİLY AYARI YAP
panel = Panel("BGP-X-GP")
int = Integer(75)
int_2 = Integer(125)
int_3 = Integer(75)
int_4 = Integer(125)
int_5 = Integer(75)
int_6 = Integer(75)
int_7 = Integer(125)
int_8 = Integer(75)
int_9 = Integer(75)
int_10 = Integer(75)
int_11 = Integer(75)
int_12 = Integer(125)
int_13 = Integer(150)
int_14 = Integer(150)
int_15 = Integer(200)
int_16 = Integer(400)
int_17 = Integer(150)
int_18 = Integer(250)
int_19 = Integer(250)
int_20 = Integer(125)
int_21 = Integer(75)
int_22 = Integer(125)
int_23 = Integer(150)
int_24 = Integer(200)
int_25 = Integer(250)
int_26 = Integer(300)
int_27 = Integer(85)
int_28 = Integer(200)
additional = Curve(<curve referenced from the Rhino model>)

# ---- group: Lines as blocks
extgeo = ExtendedGeometry([<curve referenced from the Rhino model> x811])

# ---- group: text entries
extgeo_2 = ExtendedGeometry([<elefronttext referenced from the Rhino model> x248])

# ----
crv = Curve(flatten([extgeo, additional]))
detext = DeconstructText(TextObject=extgeo_2)  # -> Text, Plane, Height, Justification
python = GhPythonScript(x=graft(detext.Text), y="AC-BGP2")  # -> flatten(out), flatten(a)
# ---------- python: Python ----------
__author__ = "HP"
__version__ = "2024.02.27"


a = y == x
# ---------- end python ----------
python_2 = GhPythonScript(x=graft(detext.Text), y="AC-BGPW2")  # -> flatten(out), flatten(a); same code as python
python_3 = GhPythonScript(x=graft(detext.Text), y="GPW")  # -> flatten(out), flatten(a); same code as python
python_4 = GhPythonScript(x=graft(detext.Text), y="X-GPW1")  # -> flatten(out), flatten(a); same code as python
python_5 = GhPythonScript(x=graft(detext.Text), y="AC-GP2")  # -> flatten(out), flatten(a); same code as python
python_6 = GhPythonScript(x=graft(detext.Text), y="GP-AC-GPW")  # -> flatten(out), flatten(a); same code as python
python_7 = GhPythonScript(x=graft(detext.Text), y="AC-BPGW")  # -> flatten(out), flatten(a); same code as python
python_8 = GhPythonScript(x=graft(detext.Text), y="BGP-AC-GPW")  # -> flatten(out), flatten(a); same code as python
python_9 = GhPythonScript(x=graft(detext.Text), y=panel)  # -> flatten(out), flatten(a); same code as python
python_10 = GhPythonScript(x=graft(detext.Text), y="BGPW-AC-GPW")  # -> flatten(out), flatten(a); same code as python
python_11 = GhPythonScript(x=graft(detext.Text), y="AC-GPW1")  # -> flatten(out), flatten(a); same code as python
python_12 = GhPythonScript(x=graft(detext.Text), y="GP125")  # -> flatten(out), flatten(a); same code as python
mindex = MemberIndex(Set=python.a, Member=Toggle(True))  # -> Index, Count
mindex_2 = MemberIndex(Set=python_3.a, Member=Toggle(True))  # -> Index, Count
mindex_3 = MemberIndex(Set=python_2.a, Member=Toggle(True))  # -> Index, Count
mindex_4 = MemberIndex(Set=python_4.a, Member=Toggle(True))  # -> Index, Count
mindex_5 = MemberIndex(Set=python_5.a, Member=Toggle(True))  # -> Index, Count
mindex_6 = MemberIndex(Set=python_6.a, Member=Toggle(True))  # -> Index, Count
mindex_7 = MemberIndex(Set=python_7.a, Member=Toggle(True))  # -> Index, Count
mindex_8 = MemberIndex(Set=python_8.a, Member=Toggle(True))  # -> Index, Count
mindex_9 = MemberIndex(Set=python_11.a, Member=Toggle(True))  # -> Index, Count
mindex_10 = MemberIndex(Set=python_9.a, Member=Toggle(True))  # -> Index, Count
mindex_11 = MemberIndex(Set=python_10.a, Member=Toggle(True))  # -> Index, Count
mindex_12 = MemberIndex(Set=python_12.a, Member=Toggle(True))  # -> Index, Count
replace = ReplaceItems(List=detext.Text, Item=int_6, Indices=mindex_6.Index, Wrap=False)
replace_2 = ReplaceItems(List=replace, Item=int_11, Indices=mindex_10.Index, Wrap=False)
replace_3 = ReplaceItems(List=replace_2, Item=int_10, Indices=mindex_11.Index, Wrap=False)
replace_4 = ReplaceItems(List=replace_3, Item=int_9, Indices=mindex_7.Index, Wrap=False)
replace_5 = ReplaceItems(List=replace_4, Item=int_3, Indices=mindex_3.Index, Wrap=False)
replace_6 = ReplaceItems(List=replace_5, Item=int_8, Indices=mindex_8.Index, Wrap=False)
replace_7 = ReplaceItems(List=replace_6, Item=int_5, Indices=mindex_5.Index, Wrap=False)
replace_8 = ReplaceItems(List=replace_7, Item=int, Indices=mindex.Index, Wrap=False)
replace_9 = ReplaceItems(List=replace_8, Item=int_4, Indices=mindex_4.Index, Wrap=False)
replace_10 = ReplaceItems(List=replace_9, Item=int_2, Indices=mindex_2.Index, Wrap=False)
replace_11 = ReplaceItems(List=replace_10, Item=int_7, Indices=mindex_9.Index, Wrap=False)
replace_12 = ReplaceItems(List=replace_11, Item=int_12, Indices=mindex_12.Index, Wrap=False)

# ---- group: istisnalar
python_13 = GhPythonScript(x=graft(detext.Text), y="AC150W2")  # -> flatten(out), flatten(a); same code as python
python_14 = GhPythonScript(x=graft(detext.Text), y="AC-GBW")  # -> flatten(out), flatten(a); same code as python
python_15 = GhPythonScript(x=graft(detext.Text), y="AC-GB")  # -> flatten(out), flatten(a); same code as python
python_16 = GhPythonScript(x=graft(detext.Text), y="X-150")  # -> flatten(out), flatten(a); same code as python
python_17 = GhPythonScript(x=graft(detext.Text), y="AC400W2")  # -> flatten(out), flatten(a); same code as python
python_18 = GhPythonScript(x=graft(detext.Text), y="GP400W1")  # -> flatten(out), flatten(a); same code as python
python_19 = GhPythonScript(x=graft(detext.Text), y="X-GPW")  # -> flatten(out), flatten(a); same code as python
python_20 = GhPythonScript(x=graft(detext.Text), y="GB150")  # -> flatten(out), flatten(a); same code as python
python_21 = GhPythonScript(x=graft(detext.Text), y="X-GB")  # -> flatten(out), flatten(a); same code as python
python_22 = GhPythonScript(x=graft(detext.Text), y="AC250W2")  # -> flatten(out), flatten(a); same code as python
python_23 = GhPythonScript(x=graft(detext.Text), y="GP300W2")  # -> flatten(out), flatten(a); same code as python
python_24 = GhPythonScript(x=graft(detext.Text), y="AC-BGP")  # -> flatten(out), flatten(a); same code as python
python_25 = GhPythonScript(x=graft(detext.Text), y="X-BGP")  # -> flatten(out), flatten(a); same code as python
python_26 = GhPythonScript(x=graft(detext.Text), y="AC-GPW")  # -> flatten(out), flatten(a); same code as python
python_27 = GhPythonScript(x=graft(detext.Text), y="GP300W1")  # -> flatten(out), flatten(a); same code as python
python_28 = GhPythonScript(x=graft(detext.Text), y="GP250")  # -> flatten(out), flatten(a); same code as python
python_29 = GhPythonScript(x=graft(detext.Text), y="X-BGPL")  # -> flatten(out), flatten(a); same code as python
python_30 = GhPythonScript(x=graft(detext.Text), y="AC150W1")  # -> flatten(out), flatten(a); same code as python
python_31 = GhPythonScript(x=graft(detext.Text), y="GP300")  # -> flatten(out), flatten(a); same code as python
python_32 = GhPythonScript(x=graft(detext.Text), y="AC-150")  # -> flatten(out), flatten(a); same code as python
python_33 = GhPythonScript(x=graft(detext.Text), y="GP-150")  # -> flatten(out), flatten(a); same code as python
python_34 = GhPythonScript(x=graft(detext.Text), y="GP400")  # -> flatten(out), flatten(a); same code as python
python_35 = GhPythonScript(x=graft(detext.Text), y="GP150W")  # -> flatten(out), flatten(a); same code as python
mindex_13 = MemberIndex(Set=python_13.a, Member=Toggle(True))  # -> Index, Count
mindex_14 = MemberIndex(Set=python_14.a, Member=Toggle(True))  # -> Index, Count
mindex_15 = MemberIndex(Set=python_15.a, Member=Toggle(True))  # -> Index, Count
mindex_16 = MemberIndex(Set=python_16.a, Member=Toggle(True))  # -> Index, Count
mindex_17 = MemberIndex(Set=python_17.a, Member=Toggle(True))  # -> Index, Count
mindex_18 = MemberIndex(Set=python_18.a, Member=Toggle(True))  # -> Index, Count
mindex_19 = MemberIndex(Set=python_19.a, Member=Toggle(True))  # -> Index, Count
mindex_20 = MemberIndex(Set=python_20.a, Member=Toggle(True))  # -> Index, Count
mindex_21 = MemberIndex(Set=python_21.a, Member=Toggle(True))  # -> Index, Count
mindex_22 = MemberIndex(Set=python_22.a, Member=Toggle(True))  # -> Index, Count
mindex_23 = MemberIndex(Set=python_23.a, Member=Toggle(True))  # -> Index, Count
mindex_24 = MemberIndex(Set=python_24.a, Member=Toggle(True))  # -> Index, Count
mindex_25 = MemberIndex(Set=python_25.a, Member=Toggle(True))  # -> Index, Count
mindex_26 = MemberIndex(Set=python_26.a, Member=Toggle(True))  # -> Index, Count
mindex_27 = MemberIndex(Set=python_27.a, Member=Toggle(True))  # -> Index, Count
mindex_28 = MemberIndex(Set=python_28.a, Member=Toggle(True))  # -> Index, Count
mindex_29 = MemberIndex(Set=python_29.a, Member=Toggle(True))  # -> Index, Count
mindex_30 = MemberIndex(Set=python_30.a, Member=Toggle(True))  # -> Index, Count
mindex_31 = MemberIndex(Set=python_31.a, Member=Toggle(True))  # -> Index, Count
mindex_32 = MemberIndex(Set=python_32.a, Member=Toggle(True))  # -> Index, Count
mindex_33 = MemberIndex(Set=python_33.a, Member=Toggle(True))  # -> Index, Count
mindex_34 = MemberIndex(Set=python_34.a, Member=Toggle(True))  # -> Index, Count
mindex_35 = MemberIndex(Set=python_35.a, Member=Toggle(True))  # -> Index, Count
int_29 = Integer(150)
int_30 = Integer(125)
int_31 = Integer(75)
int_32 = Integer(150)
int_33 = Integer(400)
int_34 = Integer(400)
int_35 = Integer(125)
int_36 = Integer(150)
int_37 = Integer(250)
int_38 = Integer(75)
int_39 = Integer(300)
int_40 = Integer(75)
int_41 = Integer(75)
int_42 = Integer(125)
int_43 = Integer(300)
int_44 = Integer(250)
int_45 = Integer(85)
int_46 = Integer(150)
int_47 = Integer(300)
int_48 = Integer(150)
int_49 = Integer(150)
int_50 = Integer(400)
int_51 = Integer(150)
replace_13 = ReplaceItems(List=replace_12, Item=int_44, Indices=mindex_28.Index, Wrap=False)
replace_14 = ReplaceItems(List=replace_13, Item=int_41, Indices=mindex_25.Index, Wrap=False)
replace_15 = ReplaceItems(List=replace_14, Item=int_39, Indices=mindex_23.Index, Wrap=False)
replace_16 = ReplaceItems(List=replace_15, Item=int_40, Indices=mindex_24.Index, Wrap=False)
replace_17 = ReplaceItems(List=replace_16, Item=int_42, Indices=mindex_26.Index, Wrap=False)
replace_18 = ReplaceItems(List=replace_17, Item=int_45, Indices=mindex_29.Index, Wrap=False)
replace_19 = ReplaceItems(List=replace_18, Item=int_48, Indices=mindex_32.Index, Wrap=False)
replace_20 = ReplaceItems(List=replace_19, Item=int_51, Indices=mindex_35.Index, Wrap=False)
replace_21 = ReplaceItems(List=replace_20, Item=int_50, Indices=mindex_34.Index, Wrap=False)
replace_22 = ReplaceItems(List=replace_21, Item=int_49, Indices=mindex_33.Index, Wrap=False)
replace_23 = ReplaceItems(List=replace_22, Item=int_47, Indices=mindex_31.Index, Wrap=False)
replace_24 = ReplaceItems(List=replace_23, Item=int_43, Indices=mindex_27.Index, Wrap=False)
replace_25 = ReplaceItems(List=replace_24, Item=int_46, Indices=mindex_30.Index, Wrap=False)
replace_26 = ReplaceItems(List=replace_25, Item=int_29, Indices=mindex_13.Index, Wrap=False)
replace_27 = ReplaceItems(List=replace_26, Item=int_37, Indices=mindex_22.Index, Wrap=False)
replace_28 = ReplaceItems(List=replace_27, Item=int_33, Indices=mindex_17.Index, Wrap=False)
replace_29 = ReplaceItems(List=replace_28, Item=int_31, Indices=mindex_15.Index, Wrap=False)
replace_30 = ReplaceItems(List=replace_29, Item=int_30, Indices=mindex_14.Index, Wrap=False)
replace_31 = ReplaceItems(List=replace_30, Item=int_36, Indices=mindex_20.Index, Wrap=False)
replace_32 = ReplaceItems(List=replace_31, Item=int_34, Indices=mindex_18.Index, Wrap=False)
replace_33 = ReplaceItems(List=replace_32, Item=int_32, Indices=mindex_16.Index, Wrap=False)
replace_34 = ReplaceItems(List=replace_33, Item=int_38, Indices=mindex_21.Index, Wrap=False)
replace_35 = ReplaceItems(List=replace_34, Item=int_35, Indices=mindex_19.Index, Wrap=False)

# ----
python_36 = GhPythonScript(x=graft(detext.Text), y="GP150W2")  # -> flatten(out), flatten(a); same code as python
python_37 = GhPythonScript(x=graft(detext.Text), y="GP200W1")  # -> flatten(out), flatten(a); same code as python
python_38 = GhPythonScript(x=graft(detext.Text), y="GP150")  # -> flatten(out), flatten(a); same code as python
python_39 = GhPythonScript(x=graft(detext.Text), y="GP400W2")  # -> flatten(out), flatten(a); same code as python
python_40 = GhPythonScript(x=graft(detext.Text), y="GP250W1")  # -> flatten(out), flatten(a); same code as python
python_41 = GhPythonScript(x=graft(detext.Text), y="GP250W2")  # -> flatten(out), flatten(a); same code as python
python_42 = GhPythonScript(x=graft(detext.Text), y="GP150W1")  # -> flatten(out), flatten(a); same code as python
python_43 = GhPythonScript(x=graft(detext.Text), y="AC-GP")  # -> flatten(out), flatten(a); same code as python
python_44 = GhPythonScript(x=graft(detext.Text), y="X-GP")  # -> flatten(out), flatten(a); same code as python
python_45 = GhPythonScript(x=graft(detext.Text), y="AC-GPW2")  # -> flatten(out), flatten(a); same code as python
python_46 = GhPythonScript(x=graft(detext.Text), y="AC150")  # -> flatten(out), flatten(a); same code as python
python_47 = GhPythonScript(x=graft(detext.Text), y="AC200")  # -> flatten(out), flatten(a); same code as python
python_48 = GhPythonScript(x=graft(detext.Text), y="AC250")  # -> flatten(out), flatten(a); same code as python
python_49 = GhPythonScript(x=graft(detext.Text), y="AC300")  # -> flatten(out), flatten(a); same code as python
python_50 = GhPythonScript(x=graft(detext.Text), y="AC-BGPL")  # -> flatten(out), flatten(a); same code as python
python_51 = GhPythonScript(x=graft(detext.Text), y="GP200")  # -> flatten(out), flatten(a); same code as python
mindex_36 = MemberIndex(Set=python_36.a, Member=Toggle(True))  # -> Index, Count
mindex_37 = MemberIndex(Set=python_37.a, Member=Toggle(True))  # -> Index, Count
mindex_38 = MemberIndex(Set=python_38.a, Member=Toggle(True))  # -> Index, Count
mindex_39 = MemberIndex(Set=python_39.a, Member=Toggle(True))  # -> Index, Count
mindex_40 = MemberIndex(Set=python_40.a, Member=Toggle(True))  # -> Index, Count
mindex_41 = MemberIndex(Set=python_41.a, Member=Toggle(True))  # -> Index, Count
mindex_42 = MemberIndex(Set=python_42.a, Member=Toggle(True))  # -> Index, Count
mindex_43 = MemberIndex(Set=python_43.a, Member=Toggle(True))  # -> Index, Count
mindex_44 = MemberIndex(Set=python_44.a, Member=Toggle(True))  # -> Index, Count
mindex_45 = MemberIndex(Set=python_45.a, Member=Toggle(True))  # -> Index, Count
mindex_46 = MemberIndex(Set=python_46.a, Member=Toggle(True))  # -> Index, Count
mindex_47 = MemberIndex(Set=python_47.a, Member=Toggle(True))  # -> Index, Count
mindex_48 = MemberIndex(Set=python_48.a, Member=Toggle(True))  # -> Index, Count
mindex_49 = MemberIndex(Set=python_49.a, Member=Toggle(True))  # -> Index, Count
mindex_50 = MemberIndex(Set=python_50.a, Member=Toggle(True))  # -> Index, Count
mindex_51 = MemberIndex(Set=python_51.a, Member=Toggle(True))  # -> Index, Count
replace_36 = ReplaceItems(List=replace_35, Item=int_14, Indices=mindex_38.Index, Wrap=False)
replace_37 = ReplaceItems(List=replace_36, Item=int_17, Indices=mindex_42.Index, Wrap=False)
replace_38 = ReplaceItems(List=replace_37, Item=int_13, Indices=mindex_36.Index, Wrap=False)
replace_39 = ReplaceItems(List=replace_38, Item=int_15, Indices=mindex_37.Index, Wrap=False)
replace_40 = ReplaceItems(List=replace_39, Item=int_18, Indices=mindex_40.Index, Wrap=False)
replace_41 = ReplaceItems(List=replace_40, Item=int_19, Indices=mindex_41.Index, Wrap=False)
replace_42 = ReplaceItems(List=replace_41, Item=int_16, Indices=mindex_39.Index, Wrap=False)
replace_43 = ReplaceItems(List=replace_42, Item=int_22, Indices=mindex_45.Index, Wrap=False)
replace_44 = ReplaceItems(List=replace_43, Item=int_20, Indices=mindex_43.Index, Wrap=False)
replace_45 = ReplaceItems(List=replace_44, Item=int_21, Indices=mindex_44.Index, Wrap=False)
replace_46 = ReplaceItems(List=replace_45, Item=int_23, Indices=mindex_46.Index, Wrap=False)
replace_47 = ReplaceItems(List=replace_46, Item=int_24, Indices=mindex_47.Index, Wrap=False)
replace_48 = ReplaceItems(List=replace_47, Item=int_25, Indices=mindex_48.Index, Wrap=False)
replace_49 = ReplaceItems(List=replace_48, Item=int_26, Indices=mindex_49.Index, Wrap=False)
replace_50 = ReplaceItems(List=replace_49, Item=int_28, Indices=mindex_51.Index, Wrap=False)
replace_51 = ReplaceItems(List=replace_50, Item=int_27, Indices=mindex_50.Index, Wrap=False)
explode = Explode(Curve=crv, Recursive=True)  # -> Segments, Vertices
deplane = DeconstructPlane(Plane=detext.Plane)  # -> Origin, XAxis, YAxis, ZAxis
line = Line(flatten(explode.Segments))
pt = Point(graft(deplane.Origin))
clean = CleanTree(RemoveNulls=True, RemoveInvalid=True, RemoveEmpty=True, Tree=line)
line_2 = Line(flatten(clean))
crv_cp = CurveClosestPoint(Point=pt, Curve=line_2)  # -> simplify(Point), Parameter, Distance
sort = SortList(Keys=crv_cp.Distance)  # -> Keys, ValuesA
item = ListItem(List=sort.Keys, Index=0, Wrap=True)
mindex_52 = MemberIndex(Set=crv_cp.Distance, Member=item)  # -> Index, Count
item_2 = ListItem(List=line_2, Index=mindex_52.Index, Wrap=True)
item_3 = ListItem(List=item_2, Index=0, Wrap=True)  # -> flatten(Item)
crv_cp_2 = CurveClosestPoint(Point=deplane.Origin, Curve=item_3)  # -> Point, Parameter, Distance
vec2pt = Vector2Pt(PointA=deplane.Origin, PointB=crv_cp_2.Point, Unitize=True)  # -> Vector, Length
panel_2 = Panel(item_3)
panel_3 = Panel(detext.Text)
int_52 = Integer(Slider(3, range=0..6))

# ---- group: GP İSE / gp ise en yakın noktaya olan doğruyu uzat
python_52 = GhPythonScript(x=graft(detext.Text), y="GPW1")  # -> flatten(out), flatten(a); same code as python
python_53 = GhPythonScript(x=graft(detext.Text), y="GPW2")  # -> flatten(out), flatten(a); same code as python
python_54 = GhPythonScript(x=graft(detext.Text), y="BGP")  # -> flatten(out), flatten(a); same code as python
python_55 = GhPythonScript(x=graft(detext.Text), y="AC-BGPW")  # -> flatten(out), flatten(a); same code as python
python_56 = GhPythonScript(x=graft(detext.Text), y="GP")  # -> flatten(out), flatten(a); same code as python
or = GateOr(A=python_56.a, B=python_52.a, C=python_53.a, D=python_54.a, E=python_55.a)
mindex_53 = MemberIndex(Set=or, Member=Toggle(True))  # -> Index, Count
branch = TreeBranch(Tree=simplify(crv_cp.Distance), Path=mindex_53.Index, MaintainPaths=True)
sort_2 = SortList(Keys=branch)  # -> Keys, ValuesA
item_4 = ListItem(List=flatten(pt), Index=mindex_53.Index, Wrap=True)  # -> simplify(graft(Item))
branch_2 = TreeBranch(Tree=simplify(crv_cp.Point), Path=mindex_53.Index, MaintainPaths=True)
panel_4 = Panel(item_4)
item_5 = ListItem(List=sort_2.Keys, Index=0, Wrap=True)
mindex_54 = MemberIndex(Set=branch, Member=item_5)  # -> Index, Count

# ----
panel_5 = Panel(mindex_53.Index)
item_6 = ListItem(List=mindex_54.Index, Index=0, Wrap=True)

# ---- group: GP İSE / gp ise en yakın noktaya olan doğruyu uzat (continued)
item_7 = ListItem(List=branch_2, Index=item_6, Wrap=True)  # -> flatten(Item)
graft = GraftTree(Tree=item_7, IncludeEmptyLists=True, IncludeNullItems=True)  # -> simplify(Tree)
ln = Line(StartPoint=item_4, EndPoint=graft)
ext = ExtendCurve(Curve=ln, Type=0, Start=0, End=4500)  # -> simplify(Curve)

# ---- group: GP İSE / en yakın 5 doğruyu al
sort_3 = SortList(Keys=simplify(branch))  # -> Keys, ValuesA
series = Series(Start=0, Step=1, Count=30)
item_8 = ListItem(List=sort_3.Keys, Index=series, Wrap=True)  # -> simplify(Item)
mindex_55 = MemberIndex(Set=branch, Member=item_8)  # -> simplify(Index), Count
pshift = ShiftPaths(Data=mindex_55.Index, Offset=-1)
item_9 = ListItem(List=line_2, Index=pshift, Wrap=True)

# ----
panel_6 = Panel(python_56.a)

int_53 = Integer(32)
branch_3 = TreeBranch(Tree=item_9, Path=int_53, MaintainPaths=True)  # -> flatten(Branch)
branch_4 = TreeBranch(Tree=ext, Path=int_53, MaintainPaths=True)  # -> flatten(Branch)
ccx = CurveCurve(CurveA=branch_4, CurveB=branch_3)  # -> flatten(Points), ParamsA, ParamsB

# ---- group: GP İSE
panel_7 = Panel(branch)
panel_8 = Panel(item_5)

# ----
panel_9 = Panel(python_52.a)

# ---- group: GP İSE / kesişen ilk 2 nokta arası uzaklık; GP'nin kalınlığı
ccx_2 = CurveCurve(CurveA=ext, CurveB=item_9)  # -> Points, ParamsA, ParamsB
pshift_2 = ShiftPaths(Data=ccx_2.Points, Offset=-1)
item_10 = ListItem(List=pshift_2, Index=0, Wrap=True)
item_11 = ListItem(List=pshift_2, Index=1, Wrap=True)
dist = Distance(PointA=item_10, PointB=item_11)
int_54 = Integer(flatten(dist))
replace_52 = ReplaceItems(List=replace_51, Item=flatten(int_54), Indices=mindex_53.Index, Wrap=False)  # -> flatten(List)

# ----
llx = LineLine(Line1=ext, Line2=item_9)  # -> ParamA, ParamB, PointA, PointB
pt_2 = Point(llx.PointB)
pshift_3 = ShiftPaths(Data=pt_2, Offset=-1)
item_12 = ListItem(List=pt_2, Index=0, Wrap=True)
item_13 = ListItem(List=pt_2, Index=1, Wrap=True)
dist_2 = Distance(PointA=item_12, PointB=item_13)
int_55 = Integer(flatten(dist_2))
replace_53 = ReplaceItems(List=replace_51, Item=flatten(int_55), Indices=mindex_53.Index, Wrap=False)  # -> flatten(List)

panel_10 = Panel(replace_52)
division = Division(A=panel_10, B=2)
amp = Amplitude(Vector=vec2pt.Vector, Amplitude=division)
move = Move(Geometry=item_3, Motion=amp)  # -> Geometry, Transform
end = EndPoints(Curve=move.Geometry)  # -> Start, End
midpt = CurveMiddle(Curve=move.Geometry)
pdecon = Deconstruct(Point=end.Start)  # -> XComponent, YComponent, ZComponent
pdecon_2 = Deconstruct(Point=end.End)  # -> XComponent, YComponent, ZComponent

# ---- group: SIFIR OLANLAR MANUEL GİRİŞ
equals = Equality(FirstNumber=panel_10, SecondNumber=0)  # -> Equality, Inequality
mindex_56 = MemberIndex(Set=equals.Equality, Member=Toggle(True))  # -> Index, Count
panel_11 = Panel(mindex_56.Index)

# ---- group: cONTROL
number_slider = Slider(889, range=0..5000)
panel_12 = Panel(panel_11)
item_14 = ListItem(List=deplane.Origin, Index=number_slider, Wrap=True)
item_15 = ListItem(List=item_3, Index=number_slider, Wrap=True)
item_16 = ListItem(List=move.Geometry, Index=number_slider, Wrap=True)
item_17 = ListItem(List=crv_cp_2.Point, Index=number_slider, Wrap=True)

# ---- group: Find Zone
crv_zone4 = Curve(<curve referenced from the Rhino model>)
crv_zone1 = Curve(<curve referenced from the Rhino model>)
crv_zone2 = Curve(<curve referenced from the Rhino model>)
crv_zone3 = Curve(<curve referenced from the Rhino model>)
crv_zone5 = Curve(<curve referenced from the Rhino model>)
pt_3 = Point(midpt)
weave = Weave(
    Pattern=[0, 1, 2, 3, 4],
    Stream0=crv_zone1,
    Stream1=crv_zone2,
    Stream2=crv_zone3,
    Stream3=crv_zone4,
    Stream4=crv_zone5,
    NullGaps=False)
weave_2 = Weave(
    Pattern=[0, 1, 2, 3, 4],
    Stream0="ZON-1",
    Stream1="ZON-2",
    Stream2="ZON-3",
    Stream3="ZON-4",
    Stream4="ZON-5",
    NullGaps=False)
incurves = PointInCurves(Point=pt_3, Curves=weave)  # -> Relationship, Index, Point
item_18 = ListItem(List=weave_2, Index=incurves.Index, Wrap=True)
panel_13 = Panel(item_18)

# ----
panel_14 = Panel(pdecon.XComponent)
mindex_57 = MemberIndex(Set=incurves.Index, Member=int_52)  # -> Index, Count
panel_15 = Panel(pdecon.YComponent)
item_19 = ListItem(List=pt_3, Index=mindex_57.Index, Wrap=True)
panel_16 = Panel(pdecon_2.XComponent)

# ---- group: Not Defined
get_integer = GetInteger(panel_10, AtLeast=1, AtMost=2147483647, Maximum=2147483647, Minimum=-2147483648)
null = NullItem(Item=get_integer)  # -> NullFlags, InvalidFlags, Description
mindex_58 = MemberIndex(Set=null.NullFlags, Member=Toggle(True))  # -> Index, Count
item_20 = ListItem(List=panel_10, Index=mindex_58.Index, Wrap=True)
dcon = DeleteConsecutive(Set=item_20, Wrap=False)  # -> Set, Count
panel_17 = Panel(dcon.Set)

# ----
tsort = SortText(Keys=dcon.Set, Culture=127)  # -> Keys, Values
cset = CreateSet(List=tsort.Keys)  # -> Set, Map
panel_18 = Panel(cset.Set)
panel_19 = Panel(pdecon_2.YComponent)
lng = ListLength(List=panel_19)
repeat = RepeatData(Data="L07", Length=lng)
panel_20 = Panel(repeat)
int_56 = Integer(replace_52)
panel_21 = Panel(int_56)

weave_3 = Weave(
    Pattern=[0, 1, 2, 3, 4, 5, 6, 7],
    Stream0=graft(panel_20),
    Stream1=graft(panel_13),
    Stream2=graft(detext.Text),
    Stream3=graft(int_56),
    Stream4=graft(panel_14),
    Stream5=graft(panel_15),
    Stream6=graft(panel_16),
    Stream7=graft(panel_19),
    NullGaps=False)  # -> simplify(Weave)
flip = FlipMatrix(Data=weave_3)
path = FilePath("E:\000_COMAS\55-KAZAKISTAN-RNS-HSTNE\01Wall-Automate\_Start20240220\Excel-CSV Files\0700-WALLS-v1.xlsx")
txt = Text(["LEVEL", "ZONE", "TYPE", "OPTIONAL", "START X", "START Y", "END X", "END Y"])
panel_22 = Panel(weave_3)
excelwrite = ExcelWrite(WriteExcelData=Toggle(False), WorkbookPath=path, WorksheetName="WALLS", ColumnHeadings=txt, Data=flip, ClearSheet=True)

lng_2 = ListLength(List=weave_3)  # -> flatten(Length)
equals_2 = Equality(FirstNumber=lng_2, SecondNumber=8)  # -> Equality, Inequality
mindex_59 = MemberIndex(Set=equals_2.Equality, Member=Toggle(False))  # -> Index, Count
panel_23 = Panel(mindex_59.Index)
panel_24 = Panel(path)
