# Grasshopper definition Step1c-GH_Wall-organizetypes.gh (Grasshopper 1.0.7)
# plug-ins: LunchBox

# ---- group: TYPES From Excel
toggle = BooleanToggle(True)
path = FilePath("E:\000_COMAS\55-KAZAKISTAN-RNS-HSTNE\01Wall-Automate\_Start20240220\Excel-CSV Files\All_Walls-V4.xlsx")
excelread = ExcelReader(ReadExcelData=toggle, WorkbookPath=path, WorksheetName="ZON-1")  # -> Exceptions, ExcelData
excelread_2 = ExcelReader(ReadExcelData=toggle, WorkbookPath=path, WorksheetName="ZON-2")  # -> Exceptions, ExcelData
excelread_3 = ExcelReader(ReadExcelData=toggle, WorkbookPath=path, WorksheetName="ZON-3")  # -> Exceptions, ExcelData
excelread_4 = ExcelReader(ReadExcelData=toggle, WorkbookPath=path, WorksheetName="ZON-4")  # -> Exceptions, ExcelData
excelread_5 = ExcelReader(ReadExcelData=toggle, WorkbookPath=path, WorksheetName="ZON-5")  # -> Exceptions, ExcelData
branch = TreeBranch(Tree=excelread.ExcelData, Path="{2}", MaintainPaths=True)
branch_2 = TreeBranch(Tree=excelread_2.ExcelData, Path="{2}", MaintainPaths=True)
branch_3 = TreeBranch(Tree=excelread_3.ExcelData, Path="{2}", MaintainPaths=True)
branch_4 = TreeBranch(Tree=excelread_4.ExcelData, Path="{2}", MaintainPaths=True)
branch_5 = TreeBranch(Tree=excelread_5.ExcelData, Path="{2}", MaintainPaths=True)
split = SplitList(List=branch, Index=1)  # -> ListA, ListB
split_2 = SplitList(List=branch_2, Index=1)  # -> ListA, ListB
split_3 = SplitList(List=branch_3, Index=1)  # -> ListA, ListB
split_4 = SplitList(List=branch_4, Index=1)  # -> ListA, ListB
split_5 = SplitList(List=branch_5, Index=1)  # -> ListA, ListB
tsort = SortText(Keys=split.ListB, Culture=127)  # -> Keys, Values
tsort_2 = SortText(Keys=split_2.ListB, Culture=127)  # -> Keys, Values
tsort_3 = SortText(Keys=split_3.ListB, Culture=127)  # -> Keys, Values
tsort_4 = SortText(Keys=split_4.ListB, Culture=127)  # -> Keys, Values
tsort_5 = SortText(Keys=split_5.ListB, Culture=127)  # -> Keys, Values
dcon = DeleteConsecutive(Set=tsort.Keys, Wrap=False)  # -> flatten(Set), Count
dcon_2 = DeleteConsecutive(Set=tsort_2.Keys, Wrap=False)  # -> flatten(Set), Count
dcon_3 = DeleteConsecutive(Set=tsort_3.Keys, Wrap=False)  # -> flatten(Set), Count
dcon_4 = DeleteConsecutive(Set=tsort_4.Keys, Wrap=False)  # -> flatten(Set), Count
dcon_5 = DeleteConsecutive(Set=tsort_5.Keys, Wrap=False)  # -> flatten(Set), Count
lng = ListLength(List=dcon.Set)
lng_2 = ListLength(List=dcon_2.Set)
lng_3 = ListLength(List=dcon_3.Set)
lng_4 = ListLength(List=dcon_4.Set)
lng_5 = ListLength(List=dcon_5.Set)
panel = Panel(lng)
panel_2 = Panel(lng_2)
panel_3 = Panel(dcon.Set)
panel_4 = Panel(dcon_2.Set)
panel_5 = Panel(lng_3)
panel_6 = Panel(dcon_3.Set)
panel_7 = Panel(lng_4)
panel_8 = Panel(dcon_4.Set)
panel_9 = Panel(lng_5)
panel_10 = Panel(dcon_5.Set)
txt = Text([panel_3, panel_4, panel_6, panel_8, panel_10])
tsort_6 = SortText(Keys=txt, Culture=127)  # -> Keys, Values
dcon_6 = DeleteConsecutive(Set=tsort_6.Keys, Wrap=False)  # -> flatten(Set), Count
lng_6 = ListLength(List=dcon_6.Set)
panel_11 = Panel(lng_6)
panel_12 = Panel(dcon_6.Set)

# ----
panel_13 = Panel(path)

# ---- group: added / FIXED WIDTH WALL TYPES
txt_2 = Text(["GP125", "GP250", "GP300", "GP300W1", "GP300W2", "GP350", "GP450"])
tsort_7 = SortText(Keys=txt_2, Culture=127)  # -> Keys, Values
panel_14 = Panel(tsort_7.Keys)

# ---- group: added / VARIABLE WIDTH WALL TYPES
txt_3 = Text()
tsort_8 = SortText(Keys=txt_3, Culture=127)  # -> Keys, Values
panel_15 = Panel(tsort_8.Keys)

# ---- group: FROM DWG / FIXED WIDTH WALL TYPES
txt_4 = Text(["GP150", "GP150W1", "GP150W2", "GP200W1", "GP250W1", "GP250W2", "GP400W2", "AC-BGPL", "AC-GPW2", "AC-GP", "X-BGP", "AC-BGP2", "AC-GPW", "AC-BGP", "X-GP", "X-GPW", "X-BGPL", "AC150", "AC200", "AC250", "AC300", "AC-GP2", "BGP-AC-GPW", "GP200", "GP-AC-GPW"])
tsort_9 = SortText(Keys=txt_4, Culture=127)  # -> Keys, Values
panel_16 = Panel(tsort_9.Keys)

# ---- group: FROM DWG / VARIABLE WIDTH WALL TYPES
txt_5 = Text(["GP", "GPW1", "GPW2", "BGP", "AC-BGPW"])
tsort_10 = SortText(Keys=txt_5, Culture=127)  # -> Keys, Values
panel_17 = Panel(tsort_10.Keys)

# ---- group: CHANGED WALL TYPES
changed_to = Text(["ACX-GPW", "ACX-BGPL", "PL-60", "ACX-GP", "ACX-BGP", "ACX-BGP", "ACX-GPW", "ACX-BGP", "ACX-BGP", "ACX-GPW", "ACX-BGPL", "PL-60", "ACX-GP", "ACX-BGP", "ACX-GPW", "ACX-BGP-XX", "ACX-GPW", "ACX-GP"])
original = Text(["AC-GPW2", "AC-BGPL", "AC-BGPL", "AC-GP", "X-BGP", "AC-BGP2", "AC-GPW", "AC-BGP", "X-GP", "X-GPW", "X-BGPL", "X-BGPL", "AC-GP2", "BGP-AC-GPW", "BGP-AC-GPW", "AC-BGPW", "GP-AC-GPW", "GP-AC-GPW"])
panel_18 = Panel(original)
panel_19 = Panel(changed_to)

# ----
txt_6 = Text(flatten([panel_16, panel_17, original, changed_to, panel_14]))
panel_20 = Panel(txt_6)
tsort_11 = SortText(Keys=panel_20, Culture=127)  # -> Keys, Values
dcon_7 = DeleteConsecutive(Set=tsort_11.Keys, Wrap=False)  # -> flatten(Set), Count

# ---- group: NOT IN LISTS
difference = SetDifference(SetA=panel_12, SetB=panel_20)
panel_21 = Panel(dcon_7.Set)
lng_7 = ListLength(List=difference)
panel_22 = Panel(difference)
panel_23 = Panel(lng_7)

# ---- group: TYPES From Excel
toggle_2 = BooleanToggle(True)
path_2 = FilePath("E:\000_COMAS\55-KAZAKISTAN-RNS-HSTNE\01Wall-Automate\_Start20240220\Excel-CSV Files\All_Walls-V3.xlsx")
panel_24 = Panel(path_2)
panel_25 = Panel("ZON-1")
panel_26 = Panel("ZON-2")
panel_27 = Panel("ZON-3")
panel_28 = Panel("ZON-4")
panel_29 = Panel("ZON-5")
toggle_3 = BooleanToggle(False)
path_3 = FilePath("E:\000_COMAS\55-KAZAKISTAN-RNS-HSTNE\01Wall-Automate\_Start20240220\Excel-CSV Files\All_Walls_Additions.xlsx")
txt_7 = Text(["LEVEL", "ZONE", "TYPE", "OPTIONAL", "START-X", "START-Y", "END-X", "END-Y", "HEIGHT", "OFFSET"])
excelread_6 = ExcelReader(ReadExcelData=toggle_2, WorkbookPath=path_2, WorksheetName=panel_25)  # -> Exceptions, ExcelData
excelread_7 = ExcelReader(ReadExcelData=toggle_2, WorkbookPath=path_2, WorksheetName=panel_26)  # -> Exceptions, ExcelData
excelread_8 = ExcelReader(ReadExcelData=toggle_2, WorkbookPath=path_2, WorksheetName=panel_27)  # -> Exceptions, ExcelData
excelread_9 = ExcelReader(ReadExcelData=toggle_2, WorkbookPath=path_2, WorksheetName=panel_28)  # -> Exceptions, ExcelData
excelread_10 = ExcelReader(ReadExcelData=toggle_2, WorkbookPath=path_2, WorksheetName=panel_29)  # -> Exceptions, ExcelData
branch_6 = TreeBranch(Tree=excelread_6.ExcelData, Path="{2}", MaintainPaths=True)
branch_7 = TreeBranch(Tree=excelread_7.ExcelData, Path="{2}", MaintainPaths=True)
branch_8 = TreeBranch(Tree=excelread_8.ExcelData, Path="{2}", MaintainPaths=True)
branch_9 = TreeBranch(Tree=excelread_9.ExcelData, Path="{2}", MaintainPaths=True)
branch_10 = TreeBranch(Tree=excelread_10.ExcelData, Path="{2}", MaintainPaths=True)

# ----
mindex = MemberIndex(Set=branch_7, Member="AC-BGPL")  # -> Index, Count
mindex_2 = MemberIndex(Set=branch_7, Member="X-BGPL")  # -> Index, Count
panel_30 = Panel(mindex_2.Index)
panel_31 = Panel(mindex.Index)
int = Integer(flatten([panel_31, panel_30]))
panel_32 = Panel(int)
branch_11 = TreeBranch(Tree=excelread_7.ExcelData, Path="{9}", MaintainPaths=True)
branch_12 = TreeBranch(Tree=excelread_7.ExcelData, Path="{6}", MaintainPaths=True)
branch_13 = TreeBranch(Tree=excelread_7.ExcelData, Path="{8}", MaintainPaths=True)
branch_14 = TreeBranch(Tree=excelread_7.ExcelData, Path="{5}", MaintainPaths=True)
branch_15 = TreeBranch(Tree=excelread_7.ExcelData, Path="{7}", MaintainPaths=True)
branch_16 = TreeBranch(Tree=excelread_7.ExcelData, Path="{4}", MaintainPaths=True)
branch_17 = TreeBranch(Tree=excelread_7.ExcelData, Path="{3}", MaintainPaths=True)
branch_18 = TreeBranch(Tree=excelread_7.ExcelData, Path="{1}", MaintainPaths=True)
branch_19 = TreeBranch(Tree=excelread_7.ExcelData, Path="{0}", MaintainPaths=True)
panel_33 = Panel(branch_12)
panel_34 = Panel(branch_11)
panel_35 = Panel(branch_14)
panel_36 = Panel(branch_13)
panel_37 = Panel(branch_16)
panel_38 = Panel(branch_15)
panel_39 = Panel(branch_17)
panel_40 = Panel(branch_18)
panel_41 = Panel(branch_19)
txt_8 = Text("PL-60")
item = ListItem(List=panel_39, Index=panel_32, Wrap=True)
item_2 = ListItem(List=panel_37, Index=panel_32, Wrap=True)
item_3 = ListItem(List=panel_34, Index=panel_32, Wrap=True)
item_4 = ListItem(List=panel_41, Index=panel_32, Wrap=True)
item_5 = ListItem(List=panel_40, Index=panel_32, Wrap=True)
lng_8 = ListLength(List=item_5)
repeat = RepeatData(Data=txt_8, Length=lng_8)
item_6 = ListItem(List=panel_33, Index=panel_32, Wrap=True)
item_7 = ListItem(List=panel_35, Index=panel_32, Wrap=True)
item_8 = ListItem(List=panel_38, Index=panel_32, Wrap=True)
item_9 = ListItem(List=panel_36, Index=panel_32, Wrap=True)
panel_42 = Panel(item)
panel_43 = Panel(item_4)
panel_44 = Panel(repeat)
panel_45 = Panel(item_2)
panel_46 = Panel(item_5)
panel_47 = Panel(item_3)
panel_48 = Panel(item_6)
panel_49 = Panel(item_7)
panel_50 = Panel(item_8)
panel_51 = Panel(item_9)
pt = ConstructPoint(XCoordinate=panel_48, YCoordinate=panel_50, ZCoordinate=0)
pt_2 = ConstructPoint(XCoordinate=panel_45, YCoordinate=panel_49, ZCoordinate=0)
ln = Line(StartPoint=pt_2, EndPoint=pt)
offset = OffsetCurve(Curve=ln, Distance=150, Plane=PlaneXY(0, 0, 0), Corners=1)  # -> flatten(Curve)
end = EndPoints(Curve=offset)  # -> Start, End
pdecon = Deconstruct(Point=end.Start)  # -> XComponent, YComponent, ZComponent
pdecon_2 = Deconstruct(Point=end.End)  # -> XComponent, YComponent, ZComponent
weave = Weave(
    Pattern=[0, 1, 2, 3, 4, 5, 6, 7, 8, 9],
    Stream0=graft(panel_43),
    Stream1=graft(panel_46),
    Stream2=graft(panel_44),
    Stream3=graft(panel_42),
    Stream4=graft(pdecon.XComponent),
    Stream5=graft(pdecon.YComponent),
    Stream6=graft(pdecon_2.XComponent),
    Stream7=graft(pdecon_2.YComponent),
    Stream8=graft(panel_51),
    Stream9=graft(panel_47),
    NullGaps=False)  # -> simplify(Weave)
flip = FlipMatrix(Data=weave)
excelwrite = ExcelWrite(WriteExcelData=toggle_3, WorkbookPath=path_3, WorksheetName=panel_26, ColumnHeadings=txt_7, Data=flip, ClearSheet=True)

mindex_3 = MemberIndex(Set=branch_6, Member="AC-BGPL")  # -> Index, Count
mindex_4 = MemberIndex(Set=branch_6, Member="X-BGPL")  # -> Index, Count
panel_52 = Panel(mindex_4.Index)
panel_53 = Panel(mindex_3.Index)
int_2 = Integer(flatten([panel_53, panel_52]))
panel_54 = Panel(int_2)
branch_20 = TreeBranch(Tree=excelread_6.ExcelData, Path="{9}", MaintainPaths=True)
branch_21 = TreeBranch(Tree=excelread_6.ExcelData, Path="{6}", MaintainPaths=True)
branch_22 = TreeBranch(Tree=excelread_6.ExcelData, Path="{8}", MaintainPaths=True)
branch_23 = TreeBranch(Tree=excelread_6.ExcelData, Path="{5}", MaintainPaths=True)
branch_24 = TreeBranch(Tree=excelread_6.ExcelData, Path="{7}", MaintainPaths=True)
branch_25 = TreeBranch(Tree=excelread_6.ExcelData, Path="{4}", MaintainPaths=True)
branch_26 = TreeBranch(Tree=excelread_6.ExcelData, Path="{3}", MaintainPaths=True)
branch_27 = TreeBranch(Tree=excelread_6.ExcelData, Path="{1}", MaintainPaths=True)
branch_28 = TreeBranch(Tree=excelread_6.ExcelData, Path="{0}", MaintainPaths=True)
panel_55 = Panel(branch_21)
panel_56 = Panel(branch_20)
panel_57 = Panel(branch_23)
panel_58 = Panel(branch_22)
panel_59 = Panel(branch_25)
panel_60 = Panel(branch_24)
panel_61 = Panel(branch_26)
panel_62 = Panel(branch_27)
panel_63 = Panel(branch_28)
txt_9 = Text("PL-60")
item_10 = ListItem(List=panel_61, Index=panel_54, Wrap=True)
item_11 = ListItem(List=panel_59, Index=panel_54, Wrap=True)
item_12 = ListItem(List=panel_56, Index=panel_54, Wrap=True)
item_13 = ListItem(List=panel_63, Index=panel_54, Wrap=True)
item_14 = ListItem(List=panel_62, Index=panel_54, Wrap=True)
lng_9 = ListLength(List=item_14)
repeat_2 = RepeatData(Data=txt_9, Length=lng_9)
item_15 = ListItem(List=panel_55, Index=panel_54, Wrap=True)
item_16 = ListItem(List=panel_57, Index=panel_54, Wrap=True)
item_17 = ListItem(List=panel_60, Index=panel_54, Wrap=True)
item_18 = ListItem(List=panel_58, Index=panel_54, Wrap=True)
panel_64 = Panel(item_10)
panel_65 = Panel(item_13)
panel_66 = Panel(item_11)
panel_67 = Panel(repeat_2)
panel_68 = Panel(item_14)
panel_69 = Panel(item_12)
panel_70 = Panel(item_15)
panel_71 = Panel(item_16)
panel_72 = Panel(item_17)
panel_73 = Panel(item_18)
pt_3 = ConstructPoint(XCoordinate=panel_70, YCoordinate=panel_72, ZCoordinate=0)
pt_4 = ConstructPoint(XCoordinate=panel_66, YCoordinate=panel_71, ZCoordinate=0)
ln_2 = Line(StartPoint=pt_4, EndPoint=pt_3)
offset_2 = OffsetCurve(Curve=ln_2, Distance=150, Plane=PlaneXY(0, 0, 0), Corners=1)  # -> flatten(Curve)
end_2 = EndPoints(Curve=offset_2)  # -> Start, End
pdecon_3 = Deconstruct(Point=end_2.Start)  # -> XComponent, YComponent, ZComponent
pdecon_4 = Deconstruct(Point=end_2.End)  # -> XComponent, YComponent, ZComponent
weave_2 = Weave(
    Pattern=[0, 1, 2, 3, 4, 5, 6, 7, 8, 9],
    Stream0=graft(panel_65),
    Stream1=graft(panel_68),
    Stream2=graft(panel_67),
    Stream3=graft(panel_64),
    Stream4=graft(pdecon_3.XComponent),
    Stream5=graft(pdecon_3.YComponent),
    Stream6=graft(pdecon_4.XComponent),
    Stream7=graft(pdecon_4.YComponent),
    Stream8=graft(panel_73),
    Stream9=graft(panel_69),
    NullGaps=False)  # -> simplify(Weave)
flip_2 = FlipMatrix(Data=weave_2)
excelwrite_2 = ExcelWrite(WriteExcelData=toggle_3, WorkbookPath=path_3, WorksheetName=panel_25, ColumnHeadings=txt_7, Data=flip_2, ClearSheet=True)

mindex_5 = MemberIndex(Set=branch_8, Member="AC-BGPL")  # -> Index, Count
mindex_6 = MemberIndex(Set=branch_8, Member="X-BGPL")  # -> Index, Count
panel_74 = Panel(mindex_6.Index)
panel_75 = Panel(mindex_5.Index)
int_3 = Integer(flatten([panel_75, panel_74]))
panel_76 = Panel(int_3)
branch_29 = TreeBranch(Tree=excelread_8.ExcelData, Path="{9}", MaintainPaths=True)
branch_30 = TreeBranch(Tree=excelread_8.ExcelData, Path="{6}", MaintainPaths=True)
branch_31 = TreeBranch(Tree=excelread_8.ExcelData, Path="{8}", MaintainPaths=True)
branch_32 = TreeBranch(Tree=excelread_8.ExcelData, Path="{5}", MaintainPaths=True)
branch_33 = TreeBranch(Tree=excelread_8.ExcelData, Path="{7}", MaintainPaths=True)
branch_34 = TreeBranch(Tree=excelread_8.ExcelData, Path="{4}", MaintainPaths=True)
branch_35 = TreeBranch(Tree=excelread_8.ExcelData, Path="{3}", MaintainPaths=True)
branch_36 = TreeBranch(Tree=excelread_8.ExcelData, Path="{1}", MaintainPaths=True)
branch_37 = TreeBranch(Tree=excelread_8.ExcelData, Path="{0}", MaintainPaths=True)
panel_77 = Panel(branch_30)
panel_78 = Panel(branch_29)
panel_79 = Panel(branch_32)
panel_80 = Panel(branch_31)
panel_81 = Panel(branch_34)
panel_82 = Panel(branch_33)
panel_83 = Panel(branch_35)
panel_84 = Panel(branch_36)
panel_85 = Panel(branch_37)
txt_10 = Text("PL-60")
item_19 = ListItem(List=panel_83, Index=panel_76, Wrap=True)
item_20 = ListItem(List=panel_81, Index=panel_76, Wrap=True)
item_21 = ListItem(List=panel_78, Index=panel_76, Wrap=True)
item_22 = ListItem(List=panel_85, Index=panel_76, Wrap=True)
item_23 = ListItem(List=panel_84, Index=panel_76, Wrap=True)
lng_10 = ListLength(List=item_23)
repeat_3 = RepeatData(Data=txt_10, Length=lng_10)
item_24 = ListItem(List=panel_77, Index=panel_76, Wrap=True)
item_25 = ListItem(List=panel_79, Index=panel_76, Wrap=True)
item_26 = ListItem(List=panel_82, Index=panel_76, Wrap=True)
item_27 = ListItem(List=panel_80, Index=panel_76, Wrap=True)
panel_86 = Panel(item_19)
panel_87 = Panel(item_22)
panel_88 = Panel(item_20)
panel_89 = Panel(repeat_3)
panel_90 = Panel(item_23)
panel_91 = Panel(item_21)
panel_92 = Panel(item_24)
panel_93 = Panel(item_25)
panel_94 = Panel(item_26)
panel_95 = Panel(item_27)
pt_5 = ConstructPoint(XCoordinate=panel_92, YCoordinate=panel_94, ZCoordinate=0)
pt_6 = ConstructPoint(XCoordinate=panel_88, YCoordinate=panel_93, ZCoordinate=0)
ln_3 = Line(StartPoint=pt_6, EndPoint=pt_5)
offset_3 = OffsetCurve(Curve=ln_3, Distance=150, Plane=PlaneXY(0, 0, 0), Corners=1)  # -> flatten(Curve)
end_3 = EndPoints(Curve=offset_3)  # -> Start, End
pdecon_5 = Deconstruct(Point=end_3.Start)  # -> XComponent, YComponent, ZComponent
pdecon_6 = Deconstruct(Point=end_3.End)  # -> XComponent, YComponent, ZComponent
weave_3 = Weave(
    Pattern=[0, 1, 2, 3, 4, 5, 6, 7, 8, 9],
    Stream0=graft(panel_87),
    Stream1=graft(panel_90),
    Stream2=graft(panel_89),
    Stream3=graft(panel_86),
    Stream4=graft(pdecon_5.XComponent),
    Stream5=graft(pdecon_5.YComponent),
    Stream6=graft(pdecon_6.XComponent),
    Stream7=graft(pdecon_6.YComponent),
    Stream8=graft(panel_95),
    Stream9=graft(panel_91),
    NullGaps=False)  # -> simplify(Weave)
flip_3 = FlipMatrix(Data=weave_3)
excelwrite_3 = ExcelWrite(WriteExcelData=toggle_3, WorkbookPath=path_3, WorksheetName=panel_27, ColumnHeadings=txt_7, Data=flip_3, ClearSheet=True)

mindex_7 = MemberIndex(Set=branch_9, Member="AC-BGPL")  # -> Index, Count
mindex_8 = MemberIndex(Set=branch_9, Member="X-BGPL")  # -> Index, Count
panel_96 = Panel(mindex_8.Index)
panel_97 = Panel(mindex_7.Index)
int_4 = Integer(flatten([panel_97, panel_96]))
panel_98 = Panel(int_4)
branch_38 = TreeBranch(Tree=excelread_9.ExcelData, Path="{9}", MaintainPaths=True)
branch_39 = TreeBranch(Tree=excelread_9.ExcelData, Path="{6}", MaintainPaths=True)
branch_40 = TreeBranch(Tree=excelread_9.ExcelData, Path="{8}", MaintainPaths=True)
branch_41 = TreeBranch(Tree=excelread_9.ExcelData, Path="{5}", MaintainPaths=True)
branch_42 = TreeBranch(Tree=excelread_9.ExcelData, Path="{7}", MaintainPaths=True)
branch_43 = TreeBranch(Tree=excelread_9.ExcelData, Path="{4}", MaintainPaths=True)
branch_44 = TreeBranch(Tree=excelread_9.ExcelData, Path="{3}", MaintainPaths=True)
branch_45 = TreeBranch(Tree=excelread_9.ExcelData, Path="{1}", MaintainPaths=True)
branch_46 = TreeBranch(Tree=excelread_9.ExcelData, Path="{0}", MaintainPaths=True)
panel_99 = Panel(branch_39)
panel_100 = Panel(branch_38)
panel_101 = Panel(branch_41)
panel_102 = Panel(branch_40)
panel_103 = Panel(branch_43)
panel_104 = Panel(branch_42)
panel_105 = Panel(branch_44)
panel_106 = Panel(branch_45)
panel_107 = Panel(branch_46)
txt_11 = Text("PL-60")
item_28 = ListItem(List=panel_105, Index=panel_98, Wrap=True)
item_29 = ListItem(List=panel_103, Index=panel_98, Wrap=True)
item_30 = ListItem(List=panel_100, Index=panel_98, Wrap=True)
item_31 = ListItem(List=panel_107, Index=panel_98, Wrap=True)
item_32 = ListItem(List=panel_106, Index=panel_98, Wrap=True)
lng_11 = ListLength(List=item_32)
repeat_4 = RepeatData(Data=txt_11, Length=lng_11)
item_33 = ListItem(List=panel_99, Index=panel_98, Wrap=True)
item_34 = ListItem(List=panel_101, Index=panel_98, Wrap=True)
item_35 = ListItem(List=panel_104, Index=panel_98, Wrap=True)
item_36 = ListItem(List=panel_102, Index=panel_98, Wrap=True)
panel_108 = Panel(item_28)
panel_109 = Panel(item_31)
panel_110 = Panel(item_29)
panel_111 = Panel(repeat_4)
panel_112 = Panel(item_32)
panel_113 = Panel(item_30)
panel_114 = Panel(item_33)
panel_115 = Panel(item_34)
panel_116 = Panel(item_35)
panel_117 = Panel(item_36)
pt_7 = ConstructPoint(XCoordinate=panel_114, YCoordinate=panel_116, ZCoordinate=0)
pt_8 = ConstructPoint(XCoordinate=panel_110, YCoordinate=panel_115, ZCoordinate=0)
ln_4 = Line(StartPoint=pt_8, EndPoint=pt_7)
offset_4 = OffsetCurve(Curve=ln_4, Distance=150, Plane=PlaneXY(0, 0, 0), Corners=1)  # -> flatten(Curve)
end_4 = EndPoints(Curve=offset_4)  # -> Start, End
pdecon_7 = Deconstruct(Point=end_4.Start)  # -> XComponent, YComponent, ZComponent
pdecon_8 = Deconstruct(Point=end_4.End)  # -> XComponent, YComponent, ZComponent
weave_4 = Weave(
    Pattern=[0, 1, 2, 3, 4, 5, 6, 7, 8, 9],
    Stream0=graft(panel_109),
    Stream1=graft(panel_112),
    Stream2=graft(panel_111),
    Stream3=graft(panel_108),
    Stream4=graft(pdecon_7.XComponent),
    Stream5=graft(pdecon_7.YComponent),
    Stream6=graft(pdecon_8.XComponent),
    Stream7=graft(pdecon_8.YComponent),
    Stream8=graft(panel_117),
    Stream9=graft(panel_113),
    NullGaps=False)  # -> simplify(Weave)
flip_4 = FlipMatrix(Data=weave_4)
excelwrite_4 = ExcelWrite(WriteExcelData=toggle_3, WorkbookPath=path_3, WorksheetName=panel_28, ColumnHeadings=txt_7, Data=flip_4, ClearSheet=True)

mindex_9 = MemberIndex(Set=branch_10, Member="AC-BGPL")  # -> Index, Count
mindex_10 = MemberIndex(Set=branch_10, Member="X-BGPL")  # -> Index, Count
panel_118 = Panel(mindex_10.Index)
panel_119 = Panel(mindex_9.Index)
int_5 = Integer(flatten([panel_119, panel_118]))
panel_120 = Panel(int_5)
branch_47 = TreeBranch(Tree=excelread_10.ExcelData, Path="{9}", MaintainPaths=True)
branch_48 = TreeBranch(Tree=excelread_10.ExcelData, Path="{6}", MaintainPaths=True)
branch_49 = TreeBranch(Tree=excelread_10.ExcelData, Path="{8}", MaintainPaths=True)
branch_50 = TreeBranch(Tree=excelread_10.ExcelData, Path="{5}", MaintainPaths=True)
branch_51 = TreeBranch(Tree=excelread_10.ExcelData, Path="{7}", MaintainPaths=True)
branch_52 = TreeBranch(Tree=excelread_10.ExcelData, Path="{4}", MaintainPaths=True)
branch_53 = TreeBranch(Tree=excelread_10.ExcelData, Path="{3}", MaintainPaths=True)
branch_54 = TreeBranch(Tree=excelread_10.ExcelData, Path="{1}", MaintainPaths=True)
branch_55 = TreeBranch(Tree=excelread_10.ExcelData, Path="{0}", MaintainPaths=True)
panel_121 = Panel(branch_48)
panel_122 = Panel(branch_47)
panel_123 = Panel(branch_50)
panel_124 = Panel(branch_49)
panel_125 = Panel(branch_52)
panel_126 = Panel(branch_51)
panel_127 = Panel(branch_53)
panel_128 = Panel(branch_54)
panel_129 = Panel(branch_55)
txt_12 = Text("PL-60")
item_37 = ListItem(List=panel_127, Index=panel_120, Wrap=True)
item_38 = ListItem(List=panel_125, Index=panel_120, Wrap=True)
item_39 = ListItem(List=panel_122, Index=panel_120, Wrap=True)
item_40 = ListItem(List=panel_129, Index=panel_120, Wrap=True)
item_41 = ListItem(List=panel_128, Index=panel_120, Wrap=True)
lng_12 = ListLength(List=item_41)
repeat_5 = RepeatData(Data=txt_12, Length=lng_12)
item_42 = ListItem(List=panel_121, Index=panel_120, Wrap=True)
item_43 = ListItem(List=panel_123, Index=panel_120, Wrap=True)
item_44 = ListItem(List=panel_126, Index=panel_120, Wrap=True)
item_45 = ListItem(List=panel_124, Index=panel_120, Wrap=True)
panel_130 = Panel(item_37)
panel_131 = Panel(item_40)
panel_132 = Panel(repeat_5)
panel_133 = Panel(item_38)
panel_134 = Panel(item_41)
panel_135 = Panel(item_39)
panel_136 = Panel(item_42)
panel_137 = Panel(item_43)
panel_138 = Panel(item_44)
panel_139 = Panel(item_45)
pt_9 = ConstructPoint(XCoordinate=panel_136, YCoordinate=panel_138, ZCoordinate=0)
pt_10 = ConstructPoint(XCoordinate=panel_133, YCoordinate=panel_137, ZCoordinate=0)
ln_5 = Line(StartPoint=pt_10, EndPoint=pt_9)
offset_5 = OffsetCurve(Curve=ln_5, Distance=150, Plane=PlaneXY(0, 0, 0), Corners=1)  # -> flatten(Curve)
end_5 = EndPoints(Curve=offset_5)  # -> Start, End
pdecon_9 = Deconstruct(Point=end_5.Start)  # -> XComponent, YComponent, ZComponent
pdecon_10 = Deconstruct(Point=end_5.End)  # -> XComponent, YComponent, ZComponent
weave_5 = Weave(
    Pattern=[0, 1, 2, 3, 4, 5, 6, 7, 8, 9],
    Stream0=graft(panel_131),
    Stream1=graft(panel_134),
    Stream2=graft(panel_132),
    Stream3=graft(panel_130),
    Stream4=graft(pdecon_9.XComponent),
    Stream5=graft(pdecon_9.YComponent),
    Stream6=graft(pdecon_10.XComponent),
    Stream7=graft(pdecon_10.YComponent),
    Stream8=graft(panel_139),
    Stream9=graft(panel_135),
    NullGaps=False)  # -> simplify(Weave)
flip_5 = FlipMatrix(Data=weave_5)
excelwrite_5 = ExcelWrite(WriteExcelData=toggle_3, WorkbookPath=path_3, WorksheetName=panel_29, ColumnHeadings=txt_7, Data=flip_5, ClearSheet=True)

# ---- group: TYPES From Excel
toggle_4 = BooleanToggle(True)
path_4 = FilePath("E:\000_COMAS\55-KAZAKISTAN-RNS-HSTNE\01Wall-Automate\_Start20240220\Excel-CSV Files\All_Walls-V4.xlsx")
panel_140 = Panel(path_4)
excelread_11 = ExcelReader(ReadExcelData=toggle_4, WorkbookPath=path_4, WorksheetName="ZON-1")  # -> Exceptions, ExcelData
excelread_12 = ExcelReader(ReadExcelData=toggle_4, WorkbookPath=path_4, WorksheetName="ZON-2")  # -> Exceptions, ExcelData
excelread_13 = ExcelReader(ReadExcelData=toggle_4, WorkbookPath=path_4, WorksheetName="ZON-3")  # -> Exceptions, ExcelData
excelread_14 = ExcelReader(ReadExcelData=toggle_4, WorkbookPath=path_4, WorksheetName="ZON-4")  # -> Exceptions, ExcelData
excelread_15 = ExcelReader(ReadExcelData=toggle_4, WorkbookPath=path_4, WorksheetName="ZON-5")  # -> Exceptions, ExcelData
branch_56 = TreeBranch(Tree=excelread_11.ExcelData, Path="{2}", MaintainPaths=True)
branch_57 = TreeBranch(Tree=excelread_12.ExcelData, Path="{2}", MaintainPaths=True)
branch_58 = TreeBranch(Tree=excelread_13.ExcelData, Path="{2}", MaintainPaths=True)
branch_59 = TreeBranch(Tree=excelread_14.ExcelData, Path="{2}", MaintainPaths=True)
branch_60 = TreeBranch(Tree=excelread_15.ExcelData, Path="{2}", MaintainPaths=True)

# ----
mindex_11 = MemberIndex(Set=branch_60, Member="GP")  # -> flatten(Index), Count
mindex_12 = MemberIndex(Set=branch_60, Member="BGP")  # -> flatten(Index), Count
mindex_13 = MemberIndex(Set=branch_60, Member="ACX-BGP-")  # -> flatten(Index), Count
concat = Concatenate(FragmentA="GP", FragmentB="-")
mindex_14 = MemberIndex(Set=branch_60, Member="GPW1")  # -> flatten(Index), Count
mindex_15 = MemberIndex(Set=branch_60, Member="GPW2")  # -> flatten(Index), Count
concat_2 = Concatenate(FragmentA="BGP", FragmentB="-")
concat_3 = Concatenate(FragmentA="GPW1", FragmentB="-")
concat_4 = Concatenate(FragmentA="GPW2", FragmentB="-")
branch_61 = TreeBranch(Tree=excelread_15.ExcelData, Path="{3}", MaintainPaths=True)
branch_62 = TreeBranch(Tree=excelread_15.ExcelData, Path="{3}", MaintainPaths=True)
branch_63 = TreeBranch(Tree=excelread_15.ExcelData, Path="{3}", MaintainPaths=True)
branch_64 = TreeBranch(Tree=excelread_15.ExcelData, Path="{3}", MaintainPaths=True)
branch_65 = TreeBranch(Tree=excelread_15.ExcelData, Path="{3}", MaintainPaths=True)
item_46 = ListItem(List=branch_61, Index=mindex_11.Index, Wrap=True)
item_47 = ListItem(List=branch_62, Index=mindex_12.Index, Wrap=True)
item_48 = ListItem(List=branch_63, Index=mindex_13.Index, Wrap=True)
item_49 = ListItem(List=branch_64, Index=mindex_14.Index, Wrap=True)
item_50 = ListItem(List=branch_65, Index=mindex_15.Index, Wrap=True)
concat_5 = Concatenate(FragmentA=concat, FragmentB=item_46)
concat_6 = Concatenate(FragmentA=concat_2, FragmentB=item_47)
concat_7 = Concatenate(FragmentA="ACX-BGP-", FragmentB=item_48)
concat_8 = Concatenate(FragmentA=concat_3, FragmentB=item_49)
concat_9 = Concatenate(FragmentA=concat_4, FragmentB=item_50)
panel_141 = Panel(concat_6)
panel_142 = Panel(concat_7)
panel_143 = Panel(concat_5)
panel_144 = Panel(concat_8)
panel_145 = Panel(concat_9)

mindex_16 = MemberIndex(Set=branch_59, Member="GP")  # -> flatten(Index), Count
mindex_17 = MemberIndex(Set=branch_59, Member="BGP")  # -> flatten(Index), Count
mindex_18 = MemberIndex(Set=branch_59, Member="ACX-BGP-")  # -> flatten(Index), Count
concat_10 = Concatenate(FragmentA="GP", FragmentB="-")
mindex_19 = MemberIndex(Set=branch_59, Member="GPW1")  # -> flatten(Index), Count
mindex_20 = MemberIndex(Set=branch_59, Member="GPW2")  # -> flatten(Index), Count
concat_11 = Concatenate(FragmentA="BGP", FragmentB="-")
concat_12 = Concatenate(FragmentA="GPW1", FragmentB="-")
concat_13 = Concatenate(FragmentA="GPW2", FragmentB="-")
branch_66 = TreeBranch(Tree=excelread_14.ExcelData, Path="{3}", MaintainPaths=True)
branch_67 = TreeBranch(Tree=excelread_14.ExcelData, Path="{3}", MaintainPaths=True)
branch_68 = TreeBranch(Tree=excelread_14.ExcelData, Path="{3}", MaintainPaths=True)
branch_69 = TreeBranch(Tree=excelread_14.ExcelData, Path="{3}", MaintainPaths=True)
branch_70 = TreeBranch(Tree=excelread_14.ExcelData, Path="{3}", MaintainPaths=True)
item_51 = ListItem(List=branch_66, Index=mindex_16.Index, Wrap=True)
item_52 = ListItem(List=branch_67, Index=mindex_17.Index, Wrap=True)
item_53 = ListItem(List=branch_68, Index=mindex_18.Index, Wrap=True)
item_54 = ListItem(List=branch_69, Index=mindex_19.Index, Wrap=True)
item_55 = ListItem(List=branch_70, Index=mindex_20.Index, Wrap=True)
concat_14 = Concatenate(FragmentA=concat_10, FragmentB=item_51)
concat_15 = Concatenate(FragmentA=concat_11, FragmentB=item_52)
concat_16 = Concatenate(FragmentA="ACX-BGP-", FragmentB=item_53)
concat_17 = Concatenate(FragmentA=concat_12, FragmentB=item_54)
concat_18 = Concatenate(FragmentA=concat_13, FragmentB=item_55)
panel_146 = Panel(concat_15)
panel_147 = Panel(concat_16)
panel_148 = Panel(concat_14)
panel_149 = Panel(concat_17)
panel_150 = Panel(concat_18)

mindex_21 = MemberIndex(Set=branch_58, Member="GP")  # -> flatten(Index), Count
mindex_22 = MemberIndex(Set=branch_58, Member="BGP")  # -> flatten(Index), Count
mindex_23 = MemberIndex(Set=branch_58, Member="ACX-BGP-")  # -> flatten(Index), Count
concat_19 = Concatenate(FragmentA="GP", FragmentB="-")
mindex_24 = MemberIndex(Set=branch_58, Member="GPW1")  # -> flatten(Index), Count
mindex_25 = MemberIndex(Set=branch_58, Member="GPW2")  # -> flatten(Index), Count
concat_20 = Concatenate(FragmentA="BGP", FragmentB="-")
concat_21 = Concatenate(FragmentA="GPW1", FragmentB="-")
concat_22 = Concatenate(FragmentA="GPW2", FragmentB="-")
branch_71 = TreeBranch(Tree=excelread_13.ExcelData, Path="{3}", MaintainPaths=True)
branch_72 = TreeBranch(Tree=excelread_13.ExcelData, Path="{3}", MaintainPaths=True)
branch_73 = TreeBranch(Tree=excelread_13.ExcelData, Path="{3}", MaintainPaths=True)
branch_74 = TreeBranch(Tree=excelread_13.ExcelData, Path="{3}", MaintainPaths=True)
branch_75 = TreeBranch(Tree=excelread_13.ExcelData, Path="{3}", MaintainPaths=True)
item_56 = ListItem(List=branch_71, Index=mindex_21.Index, Wrap=True)
item_57 = ListItem(List=branch_72, Index=mindex_22.Index, Wrap=True)
item_58 = ListItem(List=branch_73, Index=mindex_23.Index, Wrap=True)
item_59 = ListItem(List=branch_74, Index=mindex_24.Index, Wrap=True)
item_60 = ListItem(List=branch_75, Index=mindex_25.Index, Wrap=True)
concat_23 = Concatenate(FragmentA=concat_19, FragmentB=item_56)
concat_24 = Concatenate(FragmentA=concat_20, FragmentB=item_57)
concat_25 = Concatenate(FragmentA="ACX-BGP-", FragmentB=item_58)
concat_26 = Concatenate(FragmentA=concat_21, FragmentB=item_59)
concat_27 = Concatenate(FragmentA=concat_22, FragmentB=item_60)
panel_151 = Panel(concat_24)
panel_152 = Panel(concat_25)
panel_153 = Panel(concat_23)
panel_154 = Panel(concat_26)
panel_155 = Panel(concat_27)

mindex_26 = MemberIndex(Set=branch_57, Member="GP")  # -> flatten(Index), Count
mindex_27 = MemberIndex(Set=branch_57, Member="BGP")  # -> flatten(Index), Count
mindex_28 = MemberIndex(Set=branch_57, Member="ACX-BGP-")  # -> flatten(Index), Count
concat_28 = Concatenate(FragmentA="GP", FragmentB="-")
mindex_29 = MemberIndex(Set=branch_57, Member="GPW1")  # -> flatten(Index), Count
mindex_30 = MemberIndex(Set=branch_57, Member="GPW2")  # -> flatten(Index), Count
concat_29 = Concatenate(FragmentA="BGP", FragmentB="-")
concat_30 = Concatenate(FragmentA="GPW1", FragmentB="-")
concat_31 = Concatenate(FragmentA="GPW2", FragmentB="-")
branch_76 = TreeBranch(Tree=excelread_12.ExcelData, Path="{3}", MaintainPaths=True)
branch_77 = TreeBranch(Tree=excelread_12.ExcelData, Path="{3}", MaintainPaths=True)
branch_78 = TreeBranch(Tree=excelread_12.ExcelData, Path="{3}", MaintainPaths=True)
branch_79 = TreeBranch(Tree=excelread_12.ExcelData, Path="{3}", MaintainPaths=True)
branch_80 = TreeBranch(Tree=excelread_12.ExcelData, Path="{3}", MaintainPaths=True)
item_61 = ListItem(List=branch_76, Index=mindex_26.Index, Wrap=True)
item_62 = ListItem(List=branch_77, Index=mindex_27.Index, Wrap=True)
item_63 = ListItem(List=branch_78, Index=mindex_28.Index, Wrap=True)
item_64 = ListItem(List=branch_79, Index=mindex_29.Index, Wrap=True)
item_65 = ListItem(List=branch_80, Index=mindex_30.Index, Wrap=True)
concat_32 = Concatenate(FragmentA=concat_28, FragmentB=item_61)
concat_33 = Concatenate(FragmentA=concat_29, FragmentB=item_62)
concat_34 = Concatenate(FragmentA="ACX-BGP-", FragmentB=item_63)
concat_35 = Concatenate(FragmentA=concat_30, FragmentB=item_64)
concat_36 = Concatenate(FragmentA=concat_31, FragmentB=item_65)
panel_156 = Panel(concat_33)
panel_157 = Panel(concat_34)
panel_158 = Panel(concat_32)
panel_159 = Panel(concat_35)
panel_160 = Panel(concat_36)

mindex_31 = MemberIndex(Set=branch_56, Member="GP")  # -> flatten(Index), Count
mindex_32 = MemberIndex(Set=branch_56, Member="BGP")  # -> flatten(Index), Count
mindex_33 = MemberIndex(Set=branch_56, Member="ACX-BGP-")  # -> flatten(Index), Count
concat_37 = Concatenate(FragmentA="GP", FragmentB="-")
mindex_34 = MemberIndex(Set=branch_56, Member="GPW1")  # -> flatten(Index), Count
mindex_35 = MemberIndex(Set=branch_56, Member="GPW2")  # -> flatten(Index), Count
concat_38 = Concatenate(FragmentA="BGP", FragmentB="-")
concat_39 = Concatenate(FragmentA="GPW1", FragmentB="-")
concat_40 = Concatenate(FragmentA="GPW2", FragmentB="-")
branch_81 = TreeBranch(Tree=excelread_11.ExcelData, Path="{3}", MaintainPaths=True)
branch_82 = TreeBranch(Tree=excelread_11.ExcelData, Path="{3}", MaintainPaths=True)
branch_83 = TreeBranch(Tree=excelread_11.ExcelData, Path="{3}", MaintainPaths=True)
branch_84 = TreeBranch(Tree=excelread_11.ExcelData, Path="{3}", MaintainPaths=True)
branch_85 = TreeBranch(Tree=excelread_11.ExcelData, Path="{3}", MaintainPaths=True)
item_66 = ListItem(List=branch_81, Index=mindex_31.Index, Wrap=True)
item_67 = ListItem(List=branch_82, Index=mindex_32.Index, Wrap=True)
item_68 = ListItem(List=branch_83, Index=mindex_33.Index, Wrap=True)
item_69 = ListItem(List=branch_84, Index=mindex_34.Index, Wrap=True)
item_70 = ListItem(List=branch_85, Index=mindex_35.Index, Wrap=True)
concat_41 = Concatenate(FragmentA=concat_37, FragmentB=item_66)
concat_42 = Concatenate(FragmentA=concat_38, FragmentB=item_67)
concat_43 = Concatenate(FragmentA="ACX-BGP-", FragmentB=item_68)
concat_44 = Concatenate(FragmentA=concat_39, FragmentB=item_69)
concat_45 = Concatenate(FragmentA=concat_40, FragmentB=item_70)
panel_161 = Panel(concat_42)
panel_162 = Panel(concat_43)
panel_163 = Panel(concat_41)
panel_164 = Panel(concat_44)
panel_165 = Panel(concat_45)

txt_13 = Text(flatten([panel_161, panel_156, panel_151, panel_146, panel_141]))
tsort_12 = SortText(Keys=txt_13, Culture=127)  # -> Keys, Values
dcon_8 = DeleteConsecutive(Set=tsort_12.Keys, Wrap=False)  # -> Set, Count
panel_166 = Panel(dcon_8.Set)

txt_14 = Text(flatten([panel_162, panel_157, panel_152, panel_147, panel_142]))
tsort_13 = SortText(Keys=txt_14, Culture=127)  # -> Keys, Values
dcon_9 = DeleteConsecutive(Set=tsort_13.Keys, Wrap=False)  # -> Set, Count
panel_167 = Panel(dcon_9.Set)

txt_15 = Text(flatten([panel_159, panel_154, panel_149, panel_144, panel_164]))
tsort_14 = SortText(Keys=txt_15, Culture=127)  # -> Keys, Values
dcon_10 = DeleteConsecutive(Set=tsort_14.Keys, Wrap=False)  # -> Set, Count
panel_168 = Panel(dcon_10.Set)

txt_16 = Text(flatten([panel_163, panel_158, panel_153, panel_148, panel_143]))
tsort_15 = SortText(Keys=txt_16, Culture=127)  # -> Keys, Values
dcon_11 = DeleteConsecutive(Set=tsort_15.Keys, Wrap=False)  # -> Set, Count
panel_169 = Panel(dcon_11.Set)

txt_17 = Text(flatten([panel_160, panel_155, panel_150, panel_145, panel_165]))
tsort_16 = SortText(Keys=txt_17, Culture=127)  # -> Keys, Values
dcon_12 = DeleteConsecutive(Set=tsort_16.Keys, Wrap=False)  # -> Set, Count
panel_170 = Panel(dcon_12.Set)
