# Grasshopper definition Step2-GH_Wall-getheights.gh (Grasshopper 1.0.7)
# plug-ins: LunchBox, Heteroptera, PANDA

levelname = Panel("""0: LB
1: L01
2: L02
3: L03...""")

# ---- group: Read Excel File
path = FilePath("E:\000_COMAS\55-KAZAKISTAN-RNS-HSTNE\01Wall-Automate\_Start20240220\Excel-CSV Files\All_Walls-V7.xlsx")
excelread = ExcelReader(ReadExcelData=Toggle(True), WorkbookPath=path, WorksheetName="ZON-5-L07")  # -> Exceptions, ExcelData
shift = ShiftList(List=excelread.ExcelData, Shift=1, Wrap=False)  # -> simplify(List)
branch = TreeBranch(Tree=shift, Path="{4}", MaintainPaths=True)
branch_2 = TreeBranch(Tree=shift, Path="{5}", MaintainPaths=True)
pt = ConstructPoint(XCoordinate=branch, YCoordinate=branch_2, ZCoordinate=0)
item = ListItem(List=excelread.ExcelData, Index=0, Wrap=True)  # -> flatten(Item)
branch_3 = TreeBranch(Tree=shift, Path="{6}", MaintainPaths=True)
branch_4 = TreeBranch(Tree=shift, Path="{7}", MaintainPaths=True)
pt_2 = ConstructPoint(XCoordinate=branch_3, YCoordinate=branch_4, ZCoordinate=0)
ln = Line(StartPoint=pt, EndPoint=pt_2)
midpt = CurveMiddle(Curve=ln)

# ----
panel = Panel(path)
pt_3 = Point(midpt)
pdecon = Deconstruct(Point=pt_3)  # -> XComponent, YComponent, ZComponent
int = Integer([-5570, -70, 5430, 10930, 15230, 19530, 23830, 28130, 33630])
item_2 = ListItem(List=int, Index=Slider(7, range=0..8), Wrap=True)
addition = Addition(A=item_2, B=1800)
pt_4 = ConstructPoint(XCoordinate=pdecon.XComponent, YCoordinate=pdecon.YComponent, ZCoordinate=addition)
pt_5 = ConstructPoint(XCoordinate=0, YCoordinate=0, ZCoordinate=item_2)
xy = XYPlane(Origin=pt_5)
Z = UnitZ(Factor=-1)
mesh_z1 = Mesh([<mesh referenced from the Rhino model> x2592])
mesh_z2 = Mesh([<mesh referenced from the Rhino model> x2983])
mesh_z3 = Mesh([<mesh referenced from the Rhino model> x1083])
mesh_z4 = Mesh([<mesh referenced from the Rhino model> x1742])
mesh_z5 = Mesh([<mesh referenced from the Rhino model> x2320])
mesh = Mesh(mesh_z5)
line = LineSDL(Start=pt_4, Direction=Z, Length=5000)
line_2 = LineSDL(Start=pt_4, Direction=Vector(0, 0, 1), Length=5000)

number_slider = Slider(4, range=0..1000)
item_3 = ListItem(List=flatten(line_2), Index=number_slider, Wrap=True)
item_4 = ListItem(List=midpt, Index=number_slider, Wrap=True)
pdecon_2 = Deconstruct(Point=item_4)  # -> XComponent, YComponent, ZComponent
panel_2 = Panel(pdecon_2.YComponent)
panel_3 = Panel(pdecon_2.XComponent)
item_5 = ListItem(List=flatten(line), Index=number_slider, Wrap=True)

mcx = MeshCurve(Mesh=mesh, Curve=graft(line))  # -> simplify(Points), Faces
mcx_2 = MeshCurve(Mesh=mesh, Curve=graft(line_2))  # -> simplify(Points), Faces
clean = CleanTree(RemoveNulls=True, RemoveInvalid=True, RemoveEmpty=True, Tree=mcx.Points)

pshift = ShiftPaths(Data=mcx_2.Points, Offset=-1)
lng = ListLength(List=pshift)  # -> flatten(Length)
mindex = MemberIndex(Set=lng, Member=0)  # -> Index, Count
panel_4 = Panel(mindex.Index)

clean_2 = CleanTree(RemoveNulls=True, RemoveInvalid=True, RemoveEmpty=True, Tree=mcx_2.Points)
pshift_2 = ShiftPaths(Data=clean, Offset=-1)
pshift_3 = ShiftPaths(Data=clean_2, Offset=-1)

pshift_4 = ShiftPaths(Data=mcx.Points, Offset=-1)
lng_2 = ListLength(List=pshift_4)  # -> flatten(Length)
mindex_2 = MemberIndex(Set=lng_2, Member=0)  # -> Index, Count
panel_5 = Panel(mindex_2.Index)

pdecon_3 = Deconstruct(Point=pshift_2)  # -> XComponent, YComponent, ZComponent
pdecon_4 = Deconstruct(Point=pshift_3)  # -> XComponent, YComponent, ZComponent
extremums = MinMax(Number=pdecon_3.ZComponent)  # -> Minimum, Maximum
extremums_2 = MinMax(Number=pdecon_4.ZComponent)  # -> Minimum, Maximum
int_2 = Integer(extremums.Maximum)
int_3 = Integer(extremums_2.Minimum)

# ---- group: eksikleri doldur
int_4 = Integer(flatten(int_2))
int_5 = Integer(flatten(int_3))
ins = InsertItems(List=int_4, Item="250", Indices=mindex_2.Index, Wrap=True)
ins_2 = InsertItems(List=int_5, Item="1500", Indices=mindex.Index, Wrap=True)

# ----
panel_6 = Panel(ins_2)
subtraction = Subtraction(A=ins_2, B=ins)  # -> flatten(Result)
subtraction_2 = Subtraction(A=ins, B=item_2)  # -> flatten(Result)
panel_7 = Panel(int_5)
height = Panel(subtraction)
startx = Panel(branch)
panel_8 = Panel(item)
panel_9 = Panel(shift)
offset = Panel(subtraction_2)
panel_10 = Panel(int_2)
panel_11 = Panel(int_3)
txt = Text(["HEIGHT", "OFFSET"])
merge = Merge(Data1=panel_8, Data2=txt)
il = InsertList(Tree=panel_9, List=height, Indices=8, Wrap=True)
il_2 = InsertList(Tree=il, List=offset, Indices=9, Wrap=True)  # -> simplify(Tree)
lng_3 = ListLength(List=il_2)  # -> flatten(Length)
panel_12 = Panel(merge)
panel_13 = Panel(lng_3)
panel_14 = Panel("ZON-5-L07")
path_2 = FilePath("E:\000_COMAS\55-KAZAKISTAN-RNS-HSTNE\01Wall-Automate\_Start20240220\Excel-CSV Files\All_Walls-V8.xlsx")
lng_4 = ListLength(List=il_2)  # -> flatten(Length)
excelwrite = ExcelWrite(
    WriteExcelData=Toggle(True),
    WorkbookPath=path_2,
    WorksheetName=panel_14,
    ColumnHeadings=panel_12,
    Data=il_2,
    ClearSheet=True)
panel_15 = Panel(path_2)
panel_16 = Panel(lng_4)
