# Dynamo graph Step4-CutBeamsFromWalls.dyn "cutterdynamo2" (Dynamo 2.13.1.3887)
# packages: Clockwork for Dynamo 2.x 2.6.0, Synthesize toolkit 24.4.1203, get documents 2021.0.0

file_path = Filename(".\beam-clashes-zone2-v2.xlsx")  # graph input
file_from_path = FileObject(path=file_path)
string = StringInput("Sheet1")  # graph input
importExcel = Data.ImportExcel(file=file_from_path, sheetName=string)
transpose = List.Transpose(lists=importExcel)
code_block = CodeBlock { 0; }
getItemAtIndex = List.GetItemAtIndex(list=transpose, index=code_block)
trimLeadingWhitespace = String.TrimLeadingWhitespace(string=getItemAtIndex)
element_by_id = ElementById(Id=trimLeadingWhitespace)
flatten = List.Flatten(list=element_by_id)
family_types = FamilyTypes("Void_Family:Void_Family")
solids = Element.Solids(element=element_by_id)
code_block_2 = CodeBlock { 1; }
getItemAtIndex_2 = List.GetItemAtIndex(list=transpose, index=code_block_2)
trimLeadingWhitespace_2 = String.TrimLeadingWhitespace(string=getItemAtIndex_2)
get_documents = Custom[Get Documents]()  # package get documents; Queries all linked Revit files and retrieves their Name, LinkInstance and Document properties.
code_block_3 = CodeBlock { 0; }
getItemAtIndex_3 = List.GetItemAtIndex(list=get_documents.Link_Doc, index=code_block_3)
getElementById = SynthesizeToolkit.Revit.Select.GetElementById(Id=trimLeadingWhitespace_2, Document=getItemAtIndex_3)
solids_2 = Element.Solids(element=getElementById)
intersect = Geometry.Intersect(geometry=solids, other=solids_2)
byUnion = Solid.ByUnion(solids=intersect)
centroid = Solid.Centroid(solid=byUnion)
ZAxis = Vector.ZAxis()
location = StructuralFraming.Location(structuralFraming=getElementById)
coordinateSystemAtParameter = Curve.CoordinateSystemAtParameter(curve=location)
XAxis = CoordinateSystem.XAxis(coordinateSystem=coordinateSystemAtParameter)
XAxis_2 = Vector.XAxis()
ZAxis_2 = Vector.ZAxis()
angleAboutAxis = Vector.AngleAboutAxis(vector=XAxis, otherVector=XAxis_2, rotationAxis=ZAxis_2)
code_block_4 = CodeBlock(a=angleAboutAxis) { a*-1; }
rotate = Geometry.Rotate(geometry=byUnion, origin=centroid, axis=ZAxis, degrees=code_block_4)
centroid_2 = Solid.Centroid(solid=rotate)
flatten_2 = List.Flatten(list=centroid_2)
byPoint = FamilyInstance.ByPoint(familyType=family_types, point=flatten_2)
flatten_3 = List.Flatten(list=byPoint)
cutGeometry = Custom[Element.CutGeometry](elementToBeCut=flatten, cuttingElement=flatten_3)  # package Clockwork for Dynamo 2.x; Adds a solid-solid cut for two model elements (if possible).
code_block_5 = CodeBlock { "X-Dist"; }
parameterByName = Parameter.ParameterByName(element=byPoint, name=code_block_5)
boundingBox = Geometry.BoundingBox(geometry=rotate)
maxPoint = BoundingBox.MaxPoint(boundingBox=boundingBox)
X = Point.X(point=maxPoint)
minPoint = BoundingBox.MinPoint(boundingBox=boundingBox)
X_2 = Point.X(point=minPoint)
code_block_6 = CodeBlock(a=X, b=X_2) { a-b; }
abs = Math.Abs(number=code_block_6)
setValue = Parameter.SetValue(parameter=parameterByName, value=abs)
code_block_7 = CodeBlock { "Y-Dist"; }
parameterByName_2 = Parameter.ParameterByName(element=byPoint, name=code_block_7)
Y = Point.Y(point=maxPoint)
Y_2 = Point.Y(point=minPoint)
code_block_8 = CodeBlock(a=Y, b=Y_2) { a-b; }
abs_2 = Math.Abs(number=code_block_8)
setValue_2 = Parameter.SetValue(parameter=parameterByName_2, value=abs_2)
code_block_9 = CodeBlock { "Z-Dist"; }
parameterByName_3 = Parameter.ParameterByName(element=byPoint, name=code_block_9)
Z = Point.Z(point=maxPoint)
Z_2 = Point.Z(point=minPoint)
code_block_10 = CodeBlock(a=Z, b=Z_2) { a-b; }
abs_3 = Math.Abs(number=code_block_10)
setValue_3 = Parameter.SetValue(parameter=parameterByName_3, value=abs_3)
byOrigin = CoordinateSystem.ByOrigin(origin=centroid_2)
ZAxis_3 = CoordinateSystem.ZAxis(coordinateSystem=byOrigin)
ZAxis_4 = Vector.ZAxis()
setRotation = FamilyInstance.SetRotation(familyInstance=byPoint, degree=code_block_4)
flatten_4 = List.Flatten(list=byUnion)
isNull = Object.IsNull(object=flatten_4)
code_block_11 = CodeBlock { true; }
indexOf = List.IndexOf(list=isNull, element=code_block_11)
flatten_5 = List.Flatten(list=solids_2)
