# Grasshopper definition get_DOW_data.gh (Grasshopper 1.0.8)
# plug-ins: RhinoCodePluginGH, PANDA, EleFront, LunchBox, Python

geo = Geometry([<curve referenced from the Rhino model> x6, <instancereference referenced from the Rhino model> x3, <curve referenced from the Rhino model> x5, <instancereference referenced from the Rhino model>, <curve referenced from the Rhino model>, <instancereference referenced from the Rhino model> x3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])
py3 = Python3Script(x="L02")  # -> out, a; inputs x: String
# ---------- py3: Python ----------
# Ensure the input is treated as a list
name = x

if name == "LB1":        
    a = 0

elif name =="L01":
    a = 1

elif name =="L02":
    a = 2

elif name =="L03":
    a = 3

elif name =="L04":
    a = 4

elif name =="L05":
    a = 5

else:
    a = 6
# ---------- end py3 ----------
list = ValueList({"Point": 0, "Curve": 1, "Arc": 2, "Circle": 3, "Ellipse": 4, "Line": 5, "Polyline": 6, "Surface": 7, "Brep": 8, "Mesh": 9, "Polysurface": 10, "Block": 11, "Text": 12, "TextDot": 13, "Dimension": 14, "LinearDimension": 15, "AngularDimension": 16, "Hatch": 17, "Leader": 18}, selected="Leader")
list_2 = ValueList({"Point": 0, "Curve": 1, "Arc": 2, "Circle": 3, "Ellipse": 4, "Line": 5, "Polyline": 6, "Surface": 7, "Brep": 8, "Mesh": 9, "Polysurface": 10, "Block": 11, "Text": 12, "TextDot": 13, "Dimension": 14, "LinearDimension": 15, "AngularDimension": 16, "Hatch": 17, "Leader": 18}, selected="Curve")
list_3 = ValueList({"Point": 0, "Curve": 1, "Arc": 2, "Circle": 3, "Ellipse": 4, "Line": 5, "Polyline": 6, "Surface": 7, "Brep": 8, "Mesh": 9, "Polysurface": 10, "Block": 11, "Text": 12, "TextDot": 13, "Dimension": 14, "LinearDimension": 15, "AngularDimension": 16, "Hatch": 17, "Leader": 18}, selected="Hatch")
panel = Panel(py3.a)
filtertype = FilterByType(Geometry=geo, ObjectType=list)
filtertype_2 = FilterByType(Geometry=geo, ObjectType=list_2)
filtertype_3 = FilterByType(Geometry=geo, ObjectType=list_3)
clean = CleanTree(RemoveNulls=True, RemoveInvalid=True, RemoveEmpty=False, Tree=filtertype)
revise_x = Subtraction(B=47675)
revise_y = Subtraction(B=61600)
clean_2 = CleanTree(RemoveNulls=True, RemoveInvalid=True, RemoveEmpty=False, Tree=filtertype_2)
clean_3 = CleanTree(RemoveNulls=True, RemoveInvalid=True, RemoveEmpty=False, Tree=filtertype_3)

# ---- group: SELECT BY ANNOTATIONS
leader = Leader(clean)

# ---- group: ALL BLOCKS
block = Block([<block referenced from the Rhino model> x5000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])
db = DeconstructBlock(Block=block)  # -> Panda, Attributes, flatten(Name), Description, flatten(Base), Transform

# ---- group: Index of TAGS
rhatt = GetRhinoAttributes(Geometry=block)  # -> Name, Layer, Color
panel_2 = Panel(rhatt.Layer)
py3_2 = Python3Script(x=panel_2)  # -> out, a; inputs x: list of String
# ---------- py3_2: Python ----------
# Ensure the input is treated as a list
layer_names = list(x)

# Initialize an empty list to store the indices
indices = []

# Iterate through the list of layer names
for i, name in enumerate(layer_names):
    # Check if 'CAP' is in the layer name
    if 'CAP' in name and "DRENAJ" not in name:
        indices.append(i)

# Assign the result to the output parameter
a = indices
# ---------- end py3_2 ----------
panel_3 = Panel(py3_2.a)

# ---- group: All Curves
crv = Curve(clean_2)

# ----
hatch = Hatch(clean_3)
filterlay = FilterByLayer(Geometry=crv, Layer="-M-SHT-TNOR-CAP-")

# ---- group: -M-SHT-TNOR-CAP- curves
crv_2 = Curve(filterlay)

# ----
hatch_2 = Hatch(hatch)
filterlay_2 = FilterByLayer(Geometry=hatch_2, Layer="BIM-KRITIK ALANLAR")
item = ListItem(List=block, Index=panel_3, Wrap=True)  # -> flatten(Item)

# ---- group: All Curves
crv_3 = Curve(crv)

# ----
db_2 = DeconstructBlock(Block=item)  # -> Panda, Attributes, flatten(Name), Description, flatten(Base), Transform
crv_4 = Curve(db_2.Panda)
clean_4 = CleanTree(RemoveNulls=True, RemoveInvalid=True, RemoveEmpty=True, Tree=crv_4)  # -> simplify(Tree)
boundrec = BoundingRectangle(Geometries=clean_4, Accurate=False, Inflate=True)  # -> flatten(Rectangle), Center, X, Y, Width, Height
path = FilePath("E:\000_COMAS\55-KAZAKISTAN-RNS-HSTNE\_MEP\02-DOW\DOW-B100-layers.xlsx")
srf = Surface(filterlay_2)
boundary = BoundarySurfaces(Edges=boundrec.Rectangle)
excelread = ExcelReader(ReadExcelData=Toggle(True), WorkbookPath=path, WorksheetName="DOW-B100")  # -> Exceptions, ExcelData
branch = TreeBranch(Tree=excelread.ExcelData, Path="{1}", MaintainPaths=True)  # -> flatten(Branch)
branch_2 = TreeBranch(Tree=excelread.ExcelData, Path="{0}", MaintainPaths=True)  # -> flatten(Branch)
panel_4 = Panel(branch)
panel_5 = Panel(branch_2)
py3_3 = Python3Script(text_list=panel_5)  # -> out, cleaned_texts; inputs text_list: list
# ---------- py3_3: Python ----------
import ghpythonlib.components as ghcomp

def remove_equal_sign(text_list):
    cleaned_texts = [text.replace("=", "") for text in text_list]
    return cleaned_texts

cleaned_texts = remove_equal_sign(text_list)
# ---------- end py3_3 ----------
number_slider = Slider(19, range=0..666)

# ---- group: Index of TAGS
panel_6 = Panel(db.Name)
py3_4 = Python3Script(x=panel_6)  # -> out, a; inputs x: list of String
# ---------- py3_4: Python ----------
# Ensure the input is treated as a list
layer_names = list(x)

# Initialize an empty list to store the indices
indices = []

# Iterate through the list of layer names
for i, name in enumerate(layer_names):
    # Check if 'CAP' is in the layer name
    if 'nokta' in name:
        indices.append(i)

# Assign the result to the output parameter
a = indices
# ---------- end py3_4 ----------
panel_7 = Panel(py3_4.a)

# ----
txt = Text(["ZONE", "SystemType", "SystemName", "StartX", "StartY", "EndX", "EndY", "PSize", "Position", "Critical"])
panel_8 = Panel(txt)

# ---- group: Index of TAGS
rhatt_2 = GetRhinoAttributes(Geometry=crv_3)  # -> Name, Layer, Color
panel_9 = Panel(rhatt_2.Layer)

# ----
py3_5 = Python3Script(layer_names=py3_3.cleaned_texts, layer_linetypes=panel_4, object_layers=panel_9)  # -> out, flatten(object_linetypes); inputs layer_names: list, layer_linetypes: list, object_layers: list
# ---------- py3_5: Python ----------
# Inputs:
# layer_names: A list of layer names
# layer_linetypes: A list of linetypes corresponding to the layer names
# object_layers: A list of layer names for each object

def get_object_linetypes(layer_names, layer_linetypes, object_layers):
    # Create a dictionary to map layer names to linetypes
    layer_to_linetype = {layer_names[i]: layer_linetypes[i] for i in range(len(layer_names))}
    
    # Create the output list of linetypes for each object
    object_linetypes = [layer_to_linetype[obj_layer] if obj_layer in layer_to_linetype else None for obj_layer in object_layers]
    
    return object_linetypes

# Call the function and assign the output
object_linetypes = get_object_linetypes(layer_names, layer_linetypes, object_layers)
# ---------- end py3_5 ----------

# ---- group: Index of TAGS (continued)
panel_10 = Panel(py3_5.object_linetypes)
txt_2 = Text(flatten(panel_10))
nullrep = ReplaceNulls(Items=panel_10, Replacements="AAA")  # -> Items, Count
py3_6 = Python3Script(x=nullrep.Items)  # -> out, a; inputs x: list of String
# ---------- py3_6: Python ----------
# Ensure the input is treated as a list
layer_names = list(x)

# Initialize an empty list to store the indices
indices = []

# Iterate through the list of layer names
for i, name in enumerate(layer_names):
    # Check if 'CAP' is in the layer name
    if 'B1' in name or "T3" in name or "T4" in name:
        indices.append(i)

# Assign the result to the output parameter
a = indices
# ---------- end py3_6 ----------
panel_11 = Panel(py3_6.a)

# ----
item_2 = ListItem(List=crv_3, Index=panel_11, Wrap=True)
scx = SurfaceCurve(Surface=srf, Curve=graft(item_2))  # -> Curves, Points, UVPoints, Normals, Parameters, Tangents
len = Length(Curve=scx.Curves)
pshift = ShiftPaths(Data=len, Offset=-1)
item_3 = ListItem(List=panel_9, Index=panel_11, Wrap=True)
lng = ListLength(List=pshift)
larger = LargerThan(FirstNumber=lng, SecondNumber=0)  # -> flatten(LargerThan), OrEqualTo
py3_7 = Python3Script(booleans=larger.LargerThan)  # -> out, a; inputs booleans: list of Boolean
# ---------- py3_7: Python ----------
def convert_booleans_to_status(booleans):
    status = []
    for boolean in booleans:
        if boolean:
            status.append("critical")
        else:
            status.append("non-critical")
    return status

# Inputs (ensure these are set correctly in Grasshopper)
booleans = list(booleans)  # Ensure the input is treated as a list

# Convert booleans to status strings
status = convert_booleans_to_status(booleans)

# Outputs
a = status
# ---------- end py3_7 ----------
crv_5 = Curve(item_2)
len_2 = Length(Curve=crv_5)
larger_2 = LargerThan(FirstNumber=len_2, SecondNumber=350)  # -> flatten(LargerThan), OrEqualTo
dispatch = Dispatch(List=item_3, DispatchPattern=larger_2.LargerThan)  # -> ListA, ListB
dispatch_2 = Dispatch(List=crv_5, DispatchPattern=larger_2.LargerThan)  # -> ListA, ListB
crv_6 = Curve(dispatch_2.ListA)
midpt = CurveMiddle(Curve=crv_6)
item_4 = ListItem(List=txt_2, Index=panel_11, Wrap=True)
dispatch_3 = Dispatch(List=item_4, DispatchPattern=larger_2.LargerThan)  # -> ListA, ListB
dispatch_4 = Dispatch(List=py3_7.a, DispatchPattern=larger_2.LargerThan)  # -> ListA, ListB
cluster = Cluster(P=panel, pt=midpt)  # -> flatten(W)
end = EndPoints(Curve=crv_6)  # -> Start, End
pdecon = Deconstruct(Point=end.Start)  # -> XComponent, YComponent, ZComponent
pdecon_2 = Deconstruct(Point=end.End)  # -> XComponent, YComponent, ZComponent
panel_12 = Panel(cluster)
py3_8 = Python3Script(pipes_input=crv_6, pointing_lines_input=crv_2)  # -> out, pipe_to_pointing_line_index; inputs pipes_input: list of Curve, pointing_lines_input: list of Curve
# ---------- py3_8: Python ----------
import Rhino.Geometry as rg
from collections import defaultdict

def find_intersections(pipes, pointing_lines):
    intersections = defaultdict(list)
    for pipe in pipes:
        for line in pointing_lines:
            intersection_points = rg.Intersect.Intersection.CurveCurve(pipe, line, 0.01, 0.01)
            if intersection_points:
                for inter in intersection_points:
                    if inter.IsPoint:
                        intersections[pipe].append((line, inter.PointA))
    return intersections

def assign_pointing_lines(pipes, pointing_lines, intersections):
    pipe_to_pointing_line = [None] * len(pipes)
    
    for i, pipe in enumerate(pipes):
        if pipe not in intersections:
            continue
        
        intersection_data = intersections[pipe]
        closest_distance = float('inf')
        closest_line = None
        
        for line, intersection in intersection_data:
            # Check the distance from the endpoint of the pointing line to the intersection point
            distance = intersection.DistanceTo(line.PointAtEnd)
            if distance < closest_distance:
                closest_distance = distance
                closest_line = line
        
        if closest_line:
            pipe_to_pointing_line[i] = pointing_lines.index(closest_line)
    
    return pipe_to_pointing_line

# Inputs (ensure these are set correctly in Grasshopper)
pipes_input = [x for x in pipes_input if isinstance(x, rg.Curve)]
pointing_lines_input = [x for x in pointing_lines_input if isinstance(x, rg.Curve)]

# Find intersections
intersections = find_intersections(pipes_input, pointing_lines_input)

# Assign pointing lines to pipes
pipe_to_pointing_line_index = assign_pointing_lines(pipes_input, pointing_lines_input, intersections)

# Outputs
pipe_to_pointing_line_index
# ---------- end py3_8 ----------
panel_13 = Panel(dispatch_3.ListA)
py3_9 = Python3Script(x=panel_13)  # -> out, flatten(a); inputs x: list of String
# ---------- py3_9: Python ----------
# Ensure the input is treated as a list
layer_names = list(x)

# Initialize an empty list to store the indices
indices = []

# Iterate through the list of layer names
for i, name in enumerate(layer_names):
    # Check if 'CAP' is in the layer name
    if 'B1' in name:
        indices.append("CAPSOGUK")
    elif "T3" in name:
        indices.append("CAPSICAK")
    else:
        indices.append("CAPSIRK")


# Assign the result to the output parameter
a = indices
# ---------- end py3_9 ----------
panel_14 = Panel(py3_9.a)
panel_15 = Panel(py3_8.pipe_to_pointing_line_index)
py3_10 = Python3Script(x=dispatch.ListA)  # -> out, a; inputs x: list of String
# ---------- py3_10: Python ----------
# Ensure the input is treated as a list
texts = list(x)

# Initialize an empty list to store the modified texts
modified_texts = []

# Iterate through the list of texts
for text in texts:
    # Remove the substring '-M-' from the text
    modified_text = text.replace("-M-", "")
    modified_texts.append(modified_text)

# Assign the result to the output parameter
a = modified_texts
# ---------- end py3_10 ----------
panel_16 = Panel(py3_10.a)
nullrep_2 = ReplaceNulls(Items=panel_15, Replacements=0)  # -> Items, Count
panel_17 = Panel(nullrep_2.Items)
panel_18 = Panel(pdecon.XComponent)

item_5 = ListItem(List=db.Base, Index=panel_7, Wrap=True)
cir = Circle(Plane=item_5, Radius=50)
boundary_2 = BoundarySurfaces(Edges=cir)
Z = UnitZ(Factor=-10)
move = Move(Geometry=boundary_2, Motion=Z)  # -> Geometry, Transform
Z_2 = UnitZ(Factor=20)
extr = Extrude(Base=move.Geometry, Direction=Z_2)
py3_11 = Python3Script(input_breps=extr, input_curves=crv_6)  # -> out, output_classifications; inputs input_breps: list of Brep, input_curves: list of Curve
# ---------- py3_11: Python ----------
import Rhino.Geometry as rg

def classify_curves_by_direction(breps, curves):
    classifications = ["error"] * len(curves)  # Initialize all to "error"
    
    for brep_index, brep in enumerate(breps):
        print(f"Processing brep {brep_index}")
        brep_bbox = brep.GetBoundingBox(True)
        intersecting_indices = []

        # Find curves that intersect the brep
        for idx, curve in enumerate(curves):
            if brep_bbox.Contains(curve.PointAtStart) or brep_bbox.Contains(curve.PointAtEnd):
                intersecting_indices.append(idx)
                print(f"Curve {idx} intersects with brep {brep_index}")

        # Check if there are exactly 3 intersecting curves
        if len(intersecting_indices) == 3:
            directions = [curves[idx].PointAtEnd - curves[idx].PointAtStart for idx in intersecting_indices]
            xy_directions = [rg.Vector3d(dir.X, dir.Y, 0) for dir in directions]
            
            # Normalize directions
            for vec in xy_directions:
                vec.Unitize()
            print(f"XY Directions: {xy_directions}")

            # Calculate angles between each direction vector
            angles = []
            for i in range(3):
                angle_sum = 0
                for j in range(3):
                    if i != j:
                        angle = rg.Vector3d.VectorAngle(xy_directions[i], xy_directions[j])
                        angle_sum += angle
                        print(f"Angle between direction {i} and {j}: {angle}")
                angles.append(angle_sum)

            print(f"Angle sums: {angles}")

            # Find the index with the largest angle sum, which is the branch
            branch_index = angles.index(max(angles))
            print(f"Branch index: {branch_index}")

            # Create classification strings
            for i in range(3):
                if i == branch_index:
                    classifications[intersecting_indices[i]] = "branch"
                    print(f"Curve {intersecting_indices[i]} classified as branch")
                else:
                    classifications[intersecting_indices[i]] = "main"
                    print(f"Curve {intersecting_indices[i]} classified as main")
        else:
            print(f"Brep {brep_index} does not have exactly 3 intersecting curves")

    return classifications

# Inputs (ensure these are set correctly in Grasshopper)
input_breps = [x for x in input_breps if isinstance(x, rg.Brep)]
input_curves = [x for x in input_curves if isinstance(x, rg.Curve)]

# Debugging: Print the number of breps and curves
print(f"Number of breps: {len(input_breps)}")
print(f"Number of curves: {len(input_curves)}")

# Classify curves by direction
output_classifications = classify_curves_by_direction(input_breps, input_curves)

# Outputs
output_classifications
# ---------- end py3_11 ----------

item_6 = ListItem(List=crv_2, Index=panel_17, Wrap=True)
panel_19 = Panel(pdecon.YComponent)
py3_12 = Python3Script(pointing_lines_input=item_6, rectangles_input=boundary)  # -> out, pointing_line_to_rectangle_index; inputs pointing_lines_input: list of Curve, rectangles_input: list of Surface
# ---------- py3_12: Python ----------
import Rhino.Geometry as rg

def assign_blocks_to_pointing_lines(pointing_lines, rectangles):
    pointing_line_to_rectangle = [None] * len(pointing_lines)
    
    for i, line in enumerate(pointing_lines):
        for j, rect in enumerate(rectangles):
            # Check if the line intersects with the rectangle surface
            intersection_result = rg.Intersect.Intersection.CurveSurface(line, rect, 0.01, 0.01)
            if intersection_result:
                pointing_line_to_rectangle[i] = j
                break
    
    return pointing_line_to_rectangle

# Inputs (ensure these are set correctly in Grasshopper)
pointing_lines_input = [x for x in pointing_lines_input if isinstance(x, rg.Curve)]
rectangles_input = [x for x in rectangles_input if isinstance(x, rg.Surface)]

# Debugging: Print the types and lengths of inputs
print(f"Number of pointing lines: {len(pointing_lines_input)}")
print(f"Number of rectangles: {len(rectangles_input)}")

# Assign blocks to pointing lines
pointing_line_to_rectangle_index = assign_blocks_to_pointing_lines(pointing_lines_input, rectangles_input)

# Debugging: Print the result
print("Pointing line to rectangle index mapping:", pointing_line_to_rectangle_index)

# Outputs
pointing_line_to_rectangle_index
# ---------- end py3_12 ----------
item_7 = ListItem(List=crv_6, Index=number_slider, Wrap=True)
panel_20 = Panel(pdecon_2.XComponent)
item_8 = ListItem(List=item, Index=py3_12.pointing_line_to_rectangle_index, Wrap=True)
getuv = GetUserValue(Geometry=graft(item_8), Key=graft(panel_14))  # -> flatten(Values)
item_9 = ListItem(List=getuv, Index=number_slider, Wrap=True)
nullrep_3 = ReplaceNulls(Items=getuv, Replacements=0)  # -> Items, Count
panel_21 = Panel(py3_12.pointing_line_to_rectangle_index)

# ---- group: Check
number_slider_2 = Slider(330, range=0..666)
item_10 = ListItem(List=py3_8.pipe_to_pointing_line_index, Index=number_slider_2, Wrap=True)
item_11 = ListItem(List=panel_21, Index=number_slider_2, Wrap=True)
item_12 = ListItem(List=crv_6, Index=number_slider_2, Wrap=True)
item_13 = ListItem(List=crv_2, Index=item_10, Wrap=True)
item_14 = ListItem(List=boundary, Index=item_11, Wrap=True)

# ----
py3_13 = Python3Script(texts=nullrep_3.Items)  # -> out, a; inputs texts: list of String
# ---------- py3_13: Python ----------
def remove_percent_c(texts):
    cleaned_texts = []
    for text in texts:
        cleaned_text = text.replace("%%C", "")
        cleaned_texts.append(cleaned_text)
    return cleaned_texts

# Inputs (ensure these are set correctly in Grasshopper)
texts = list(texts)  # Ensure the input is treated as a list

# Remove "%%C" from each text
cleaned_texts = remove_percent_c(texts)

# Outputs
a = cleaned_texts
# ---------- end py3_13 ----------
lng_2 = ListLength(List=getuv)
panel_22 = Panel(pdecon_2.YComponent)
panel_23 = Panel(py3_13.a)
cset = CreateSet(List=getuv)  # -> Set, Map
panel_24 = Panel(cset.Set)
larger_3 = LargerThan(FirstNumber=panel_23, SecondNumber=0)  # -> LargerThan, OrEqualTo
cull_null = CullNull(List=larger_3.LargerThan)  # -> Cull, NullIndex
mindex = MemberIndex(Set=py3_11.output_classifications, Member="branch")  # -> Index, Count
null = NullItem(Item=larger_3.LargerThan)  # -> NullFlags, InvalidFlags, Description
nullrep_4 = ReplaceNulls(Items=larger_3.LargerThan, Replacements=50)  # -> Items, Count
replace = ReplaceItems(List=panel_23, Item=0, Indices=cull_null.NullIndex, Wrap=False)
panel_25 = Panel(replace)
panel_26 = Panel(py3_11.output_classifications)
item_15 = ListItem(List=crv_6, Index=mindex.Index, Wrap=True)
panel_27 = Panel(dispatch_4.ListA)
entwine = Entwine(
    Branch00=panel_12,
    Branch01=panel_13,
    Branch02=panel_16,
    Branch03=panel_18,
    Branch04=panel_19,
    Branch05=panel_20,
    Branch06=panel_22,
    Branch07=panel_25,
    Branch08=panel_26,
    Branch09=panel_27,
    FlattenInputs=True)
csv = CreateCSV(DataGridHeaders=panel_8, ValueTree=entwine, Delimiter=",")
curves = Panel(csv)

# ==== cluster Cluster
pt = ClusterInput()
pt_2 = Point(pt)

# ---- group: L04 / ZONE-Selector
crv_zone4 = Curve(<curve referenced from the Rhino model>)
crv_zone1 = Curve(<curve referenced from the Rhino model>)
crv_zone2 = Curve(<curve referenced from the Rhino model>)
crv_zone3 = Curve(<curve referenced from the Rhino model>)
crv_zone5 = Curve(<curve referenced from the Rhino model>)
weave = Weave(
    Pattern=[0, 1, 2, 3, 4],
    Stream0=crv_zone1,
    Stream1=crv_zone2,
    Stream2=crv_zone3,
    Stream3=crv_zone4,
    Stream4=crv_zone5,
    NullGaps=False)

# ---- group: L05 / ZONE-Selector
crv_zone4_2 = Curve(<curve referenced from the Rhino model>)
crv_zone1_2 = Curve(<curve referenced from the Rhino model>)
crv_zone2_2 = Curve(<curve referenced from the Rhino model>)
crv_zone3_2 = Curve(crv_zone3)
crv_zone5_2 = Curve(<curve referenced from the Rhino model>)
weave_2 = Weave(
    Pattern=[0, 1, 2, 3, 4],
    Stream0=crv_zone1_2,
    Stream1=crv_zone2_2,
    Stream2=crv_zone3_2,
    Stream3=crv_zone4_2,
    Stream4=crv_zone5_2,
    NullGaps=False)

# ---- group: L06 / ZONE-Selector
crv_zone4_3 = Curve(<curve referenced from the Rhino model>)
crv_zone1_3 = Curve(<curve referenced from the Rhino model>)
crv_zone2_3 = Curve(<curve referenced from the Rhino model>)
crv_zone3_3 = Curve(crv_zone3_2)
crv_zone5_3 = Curve(<curve referenced from the Rhino model>)
weave_3 = Weave(
    Pattern=[0, 1, 2, 3, 4],
    Stream0=crv_zone1_3,
    Stream1=crv_zone2_3,
    Stream2=crv_zone3_3,
    Stream3=crv_zone4_3,
    Stream4=crv_zone5_3,
    NullGaps=False)

# ---- group: L07 / ZONE-Selector
crv_zone4_4 = Curve(crv_zone4_3)
crv_zone1_4 = Curve(crv_zone1_3)
crv_zone2_4 = Curve(<curve referenced from the Rhino model>)
crv_zone3_4 = Curve(crv_zone3_3)
crv_zone5_4 = Curve(<curve referenced from the Rhino model>)
weave_4 = Weave(
    Pattern=[0, 1, 2, 3, 4],
    Stream0=crv_zone1_4,
    Stream1=crv_zone2_4,
    Stream2=crv_zone3_4,
    Stream3=crv_zone4_4,
    Stream4=crv_zone5_4,
    NullGaps=False)

# ---- group: L03 / ZONE-Selector
crv_zone4_5 = Curve(<curve referenced from the Rhino model>)
crv_zone1_5 = Curve(<curve referenced from the Rhino model>)
crv_zone2_5 = Curve(<curve referenced from the Rhino model>)
crv_zone3_5 = Curve(<curve referenced from the Rhino model>)
crv_zone5_5 = Curve(<curve referenced from the Rhino model>)
weave_5 = Weave(
    Pattern=[0, 1, 2, 3, 4],
    Stream0=crv_zone1_5,
    Stream1=crv_zone2_5,
    Stream2=crv_zone3_5,
    Stream3=crv_zone4_5,
    Stream4=crv_zone5_5,
    NullGaps=False)

# ---- group: L02 / ZONE-Selector
crv_zone4_6 = Curve(<curve referenced from the Rhino model>)
crv_zone1_6 = Curve(<curve referenced from the Rhino model>)
crv_zone2_6 = Curve(<curve referenced from the Rhino model>)
crv_zone3_6 = Curve(<curve referenced from the Rhino model>)
crv_zone5_6 = Curve(<curve referenced from the Rhino model>)
weave_6 = Weave(
    Pattern=[0, 1, 2, 3, 4],
    Stream0=crv_zone1_6,
    Stream1=crv_zone2_6,
    Stream2=crv_zone3_6,
    Stream3=crv_zone4_6,
    Stream4=crv_zone5_6,
    NullGaps=False)

# ---- group: L01 / ZONE-Selector
crv_zone1_7 = Curve(<curve referenced from the Rhino model>)
crv_zone4_7 = Curve(<curve referenced from the Rhino model>)
crv_zone2_7 = Curve(<curve referenced from the Rhino model>)
crv_zone3_7 = Curve(<curve referenced from the Rhino model>)
crv_zone5_7 = Curve(<curve referenced from the Rhino model>)
weave_7 = Weave(
    Pattern=[0, 1, 2, 3, 4],
    Stream0=crv_zone1_7,
    Stream1=crv_zone2_7,
    Stream2=crv_zone3_7,
    Stream3=crv_zone4_7,
    Stream4=crv_zone5_7,
    NullGaps=False)

# ---- group: LB1 / ZONE-Selector
crv_zone4_8 = Curve(<curve referenced from the Rhino model>)
crv_zone1_8 = Curve(<curve referenced from the Rhino model>)
crv_zone2_8 = Curve(<curve referenced from the Rhino model>)
crv_zone3_8 = Curve(<curve referenced from the Rhino model>)
crv_zone5_8 = Curve(<curve referenced from the Rhino model>)
weave_8 = Weave(
    Pattern=[0, 1, 2, 3, 4],
    Stream0=crv_zone1_8,
    Stream1=crv_zone2_8,
    Stream2=crv_zone3_8,
    Stream3=crv_zone4_8,
    Stream4=crv_zone5_8,
    NullGaps=False)

# ---- group: L07 / Find Zone
pt_3 = Point(pt_2)
weave_9 = Weave(
    Pattern=[0, 1, 2, 3, 4],
    Stream0="ZON-1",
    Stream1="ZON-2",
    Stream2="ZON-3",
    Stream3="ZON-4",
    Stream4="ZON-5",
    NullGaps=False)
incurves = PointInCurves(Point=pt_3, Curves=weave_4)  # -> Relationship, Index, Point
item = ListItem(List=weave_9, Index=incurves.Index, Wrap=True)

# ---- group: L06 / Find Zone
pt_4 = Point(pt_2)
weave_10 = Weave(
    Pattern=[0, 1, 2, 3, 4],
    Stream0="ZON-1",
    Stream1="ZON-2",
    Stream2="ZON-3",
    Stream3="ZON-4",
    Stream4="ZON-5",
    NullGaps=False)
incurves_2 = PointInCurves(Point=pt_4, Curves=weave_3)  # -> Relationship, Index, Point
item_2 = ListItem(List=weave_10, Index=incurves_2.Index, Wrap=True)

# ---- group: L04 / Find Zone
pt_5 = Point(pt_2)
weave_11 = Weave(
    Pattern=[0, 1, 2, 3, 4],
    Stream0="ZON-1",
    Stream1="ZON-2",
    Stream2="ZON-3",
    Stream3="ZON-4",
    Stream4="ZON-5",
    NullGaps=False)
incurves_3 = PointInCurves(Point=pt_5, Curves=weave)  # -> Relationship, Index, Point
item_3 = ListItem(List=weave_11, Index=incurves_3.Index, Wrap=True)

# ---- group: L05 / Find Zone
pt_6 = Point(pt_2)
weave_12 = Weave(
    Pattern=[0, 1, 2, 3, 4],
    Stream0="ZON-1",
    Stream1="ZON-2",
    Stream2="ZON-3",
    Stream3="ZON-4",
    Stream4="ZON-5",
    NullGaps=False)
incurves_4 = PointInCurves(Point=pt_6, Curves=weave_2)  # -> Relationship, Index, Point
item_4 = ListItem(List=weave_12, Index=incurves_4.Index, Wrap=True)

# ---- group: L03 / Find Zone
pt_7 = Point(pt_2)
weave_13 = Weave(
    Pattern=[0, 1, 2, 3, 4],
    Stream0="ZON-1",
    Stream1="ZON-2",
    Stream2="ZON-3",
    Stream3="ZON-4",
    Stream4="ZON-5",
    NullGaps=False)
incurves_5 = PointInCurves(Point=pt_7, Curves=weave_5)  # -> Relationship, Index, Point
item_5 = ListItem(List=weave_13, Index=incurves_5.Index, Wrap=True)

# ---- group: L01 / Find Zone
pt_8 = Point(pt_2)
weave_14 = Weave(
    Pattern=[0, 1, 2, 3, 4],
    Stream0="ZON-1",
    Stream1="ZON-2",
    Stream2="ZON-3",
    Stream3="ZON-4",
    Stream4="ZON-5",
    NullGaps=False)
incurves_6 = PointInCurves(Point=pt_8, Curves=weave_7)  # -> Relationship, Index, Point
item_6 = ListItem(List=weave_14, Index=incurves_6.Index, Wrap=True)

# ---- group: L02 / Find Zone
pt_9 = Point(pt_2)
weave_15 = Weave(
    Pattern=[0, 1, 2, 3, 4],
    Stream0="ZON-1",
    Stream1="ZON-2",
    Stream2="ZON-3",
    Stream3="ZON-4",
    Stream4="ZON-5",
    NullGaps=False)
incurves_7 = PointInCurves(Point=pt_9, Curves=weave_6)  # -> Relationship, Index, Point
item_7 = ListItem(List=weave_15, Index=incurves_7.Index, Wrap=True)

# ---- group: LB1 / Find Zone
pt_10 = Point(pt_2)
weave_16 = Weave(
    Pattern=[0, 1, 2, 3, 4],
    Stream0="ZON-1",
    Stream1="ZON-2",
    Stream2="ZON-3",
    Stream3="ZON-4",
    Stream4="ZON-5",
    NullGaps=False)
incurves_8 = PointInCurves(Point=pt_10, Curves=weave_8)  # -> Relationship, Index, Point
item_8 = ListItem(List=weave_16, Index=incurves_8.Index, Wrap=True)

# ----
P = ClusterInput()
weave_17 = Weave(
    Pattern=P,
    Stream0=item_8,
    Stream1=item_6,
    Stream2=item_7,
    Stream3=item_5,
    Stream4=item_3,
    Stream5=item_4,
    Stream6=item_2,
    Stream7=item,
    NullGaps=False)
W = ClusterOutput(weave_17)
