# Grasshopper definition get_VentDuct_data_v03-LB1.gh (Grasshopper 1.0.8)
# plug-ins: RhinoCodePluginGH, PANDA, EleFront, LunchBox

geo = Geometry([<curve referenced from the Rhino model> x3, <instancereference referenced from the Rhino model>, <curve referenced from the Rhino model> x6, <textentity referenced from the Rhino model> x2, <leader referenced from the Rhino model>, <instancereference referenced from the Rhino model> x2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])
list = ValueList({"Point": 0, "Curve": 1, "Arc": 2, "Circle": 3, "Ellipse": 4, "Line": 5, "Polyline": 6, "Surface": 7, "Brep": 8, "Mesh": 9, "Polysurface": 10, "Block": 11, "Text": 12, "TextDot": 13, "Dimension": 14, "LinearDimension": 15, "AngularDimension": 16, "Hatch": 17, "Leader": 18}, selected="Hatch")
py3 = Python3Script(x="L05")  # -> out, a; inputs x: String
# ---------- py3: Python ----------
# Ensure the input is treated as a list
name = x

if name == "LB1":        
    a = 0

elif name =="L01":
    a = 1

elif name =="L02":
    a = 2

elif name =="L03":
    a = 3

elif name =="L04":
    a = 4

elif name =="L05":
    a = 5

elif name =="L06":
    a = 6

else:
    a = 7
# ---------- end py3 ----------
list_2 = ValueList({"Point": 0, "Curve": 1, "Arc": 2, "Circle": 3, "Ellipse": 4, "Line": 5, "Polyline": 6, "Surface": 7, "Brep": 8, "Mesh": 9, "Polysurface": 10, "Block": 11, "Text": 12, "TextDot": 13, "Dimension": 14, "LinearDimension": 15, "AngularDimension": 16, "Hatch": 17, "Leader": 18}, selected="Curve")
panel = Panel(py3.a)
filtertype = FilterByType(Geometry=geo, ObjectType=list)
filtertype_2 = FilterByType(Geometry=geo, ObjectType=list_2)
clean = CleanTree(RemoveNulls=True, RemoveInvalid=True, RemoveEmpty=False, Tree=filtertype)
clean_2 = CleanTree(RemoveNulls=True, RemoveInvalid=True, RemoveEmpty=False, Tree=filtertype_2)
hatch = Hatch(clean)

# ---- group: All Curves
crv = Curve(clean_2)

# ---- group: ALL BLOCKS
block = Block([<block referenced from the Rhino model> x5000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])
db = DeconstructBlock(Block=block)  # -> Panda, Attributes, flatten(Name), Description, flatten(Base), Transform

# ---- group: filter KNL2B
rhatt = GetRhinoAttributes(Geometry=crv)  # -> Name, Layer, Color
panel_2 = Panel(rhatt.Layer)
py3_2 = Python3Script(x=panel_2)  # -> out, a; inputs x: list of String
# ---------- py3_2: Python ----------
# Ensure the input is treated as a list
layer_names = list(x)

# Initialize an empty list to store the indices
indices = []

# Iterate through the list of layer names
for i, name in enumerate(layer_names):
    # Check if 'CAP' is in the layer name
    if 'KNL2B' in name:
        indices.append(i)

# Assign the result to the output parameter
a = indices
# ---------- end py3_2 ----------
panel_3 = Panel(py3_2.a)
item = ListItem(List=crv, Index=panel_3, Wrap=True)

# ----
rhatt_2 = GetRhinoAttributes(Geometry=item)  # -> Name, Layer, Color

# ---- group: kanat olmayan
py3_3 = Python3Script(x=rhatt_2.Layer)  # -> out, a; inputs x: list of String
# ---------- py3_3: Python ----------
# Ensure the input is treated as a list
layer_names = list(x)

# Initialize an empty list to store the indices
indices = []

# Iterate through the list of layer names
for i, name in enumerate(layer_names):
    # Check if 'CAP' is in the layer name
    if "KANAT" not in name:
        indices.append(i)

# Assign the result to the output parameter
a = indices
# ---------- end py3_3 ----------

# ---- group: filterBLOCKS KNLTXT
rhatt_3 = GetRhinoAttributes(Geometry=block)  # -> Name, Layer, Color
panel_4 = Panel(rhatt_3.Layer)
py3_4 = Python3Script(x=panel_4)  # -> out, a; inputs x: list of String
# ---------- py3_4: Python ----------
# Ensure the input is treated as a list
layer_names = list(x)

# Initialize an empty list to store the indices
indices = []

# Iterate through the list of layer names
for i, name in enumerate(layer_names):
    # Check if 'CAP' is in the layer name
    if 'KNLTXT' in name:
        indices.append(i)

# Assign the result to the output parameter
a = indices
# ---------- end py3_4 ----------
panel_5 = Panel(py3_4.a)
item_2 = ListItem(List=block, Index=panel_5, Wrap=True)
rhatt_4 = GetRhinoAttributes(Geometry=item_2)  # -> Name, Layer, Color

# ----
panel_6 = Panel(rhatt_3.Layer)

# ---- group: filterBLOCKS KNL2B
rhatt_5 = GetRhinoAttributes(Geometry=block)  # -> Name, Layer, Color
panel_7 = Panel(rhatt_5.Layer)
py3_5 = Python3Script(x=panel_7)  # -> out, a; inputs x: list of String; same code as py3_2
panel_8 = Panel(py3_5.a)
item_3 = ListItem(List=block, Index=panel_8, Wrap=True)
rhatt_6 = GetRhinoAttributes(Geometry=item_3)  # -> Name, Layer, Color

# ----
cset = CreateSet(List=panel_6)  # -> Set, Map
item_4 = ListItem(List=rhatt_2.Layer, Index=py3_3.a, Wrap=True)
tsort = SortText(Keys=cset.Set, Culture=127)  # -> Keys, Values
panel_9 = Panel(item_4)
cset_2 = CreateSet(List=panel_9)  # -> Set, Map
tsort_2 = SortText(Keys=cset_2.Set, Culture=127)  # -> Keys, Values
panel_10 = Panel(tsort_2.Keys)
panel_11 = Panel(tsort.Keys)
py3_6 = Python3Script(texts=panel_10)  # -> out, modified_texts; inputs texts: list of String
# ---------- py3_6: Python ----------
def remove_before_hvac(texts):
    modified_texts = []
    for text in texts:
        index = text.find("HVAC")
        if index != -1:
            modified_texts.append(text[index:])
        else:
            modified_texts.append(text)  # Keep the original if "HVAC" is not found
    return modified_texts

# Inputs (ensure these are set correctly in Grasshopper)
texts = texts

# Remove strings before "HVAC"
modified_texts = remove_before_hvac(texts)

# Outputs
modified_texts
# ---------- end py3_6 ----------
py3_7 = Python3Script(texts=py3_6.modified_texts)  # -> out, a; inputs texts: list of String
# ---------- py3_7: Python ----------
def remove_substring(texts, substring):
    cleaned_texts = [text.replace(substring, "") for text in texts]
    return cleaned_texts

# Ensure inputs are treated as lists
texts = list(texts)

# Define the substring to remove
substring = "-KNL2B-"

# Remove the substring from each text
cleaned_texts = remove_substring(texts, substring)

# Output the cleaned texts
a = cleaned_texts
# ---------- end py3_7 ----------
py3_8 = Python3Script(texts=py3_7.a)  # -> out, a; inputs texts: list of String
# ---------- py3_8: Python ----------
def remove_substring(texts, substring):
    cleaned_texts = [text.replace(substring, "") for text in texts]
    return cleaned_texts

# Ensure inputs are treated as lists
texts = list(texts)

# Define the substring to remove
substring = "-AKS-"

# Remove the substring from each text
cleaned_texts = remove_substring(texts, substring)

# Output the cleaned texts
a = cleaned_texts
# ---------- end py3_8 ----------
py3_9 = Python3Script(texts=py3_8.a)  # -> out, a; inputs texts: list of String
# ---------- py3_9: Python ----------
def remove_substring(texts, substring):
    cleaned_texts = [text.replace(substring, "") for text in texts]
    return cleaned_texts

# Ensure inputs are treated as lists
texts = list(texts)

# Define the substring to remove
substring = "-KNLTXT-"

# Remove the substring from each text
cleaned_texts = remove_substring(texts, substring)

# Output the cleaned texts
a = cleaned_texts
# ---------- end py3_9 ----------
panel_12 = Panel(py3_9.a)
cset_3 = CreateSet(List=panel_12)  # -> Set, Map
tsort_3 = SortText(Keys=cset_3.Set, Culture=127)  # -> Keys, Values
panel_13 = Panel(tsort_3.Keys)

# ---- group: ilgili sistem adını al
item_5 = ListItem(List=panel_13, Index=Slider(72, range=0..80), Wrap=True)

# ----
panel_14 = Panel(item_5)

# ---- group: Blocks in selected system
py3_10 = Python3Script(x=rhatt_6.Layer, y=item_5)  # -> out, a; inputs x: list of String, y: String
# ---------- py3_10: Python ----------
# Ensure the input is treated as a list
layer_names = list(x)
system = y

# Initialize an empty list to store the indices
indices = []

# Iterate through the list of layer names
for i, name in enumerate(layer_names):
    # Check if 'CAP' is in the layer name
    if system in name and "TEF" not in name:
        indices.append(i)

# Assign the result to the output parameter
a = indices
# ---------- end py3_10 ----------
item_6 = ListItem(List=item_3, Index=py3_10.a, Wrap=True)

# ---- group: curves in selected system
py3_11 = Python3Script(x=rhatt_2.Layer, y=item_5)  # -> out, a; inputs x: list of String, y: String; same code as py3_10
item_7 = ListItem(List=item, Index=py3_11.a, Wrap=True)

# ---- group: Blocks in selected system
py3_12 = Python3Script(x=rhatt_4.Layer, y=item_5)  # -> out, a; inputs x: list of String, y: String
# ---------- py3_12: Python ----------
# Ensure the input is treated as a list
layer_names = list(x)
system = y

# Initialize an empty list to store the indices
indices = []

# Iterate through the list of layer names
for i, name in enumerate(layer_names):
    # Check if 'CAP' is in the layer name
    if system in name:
        indices.append(i)

# Assign the result to the output parameter
a = indices
# ---------- end py3_12 ----------
item_8 = ListItem(List=item_2, Index=py3_12.a, Wrap=True)

# ----
db_2 = DeconstructBlock(Block=item_8)  # -> Panda, Attributes, flatten(Name), Description, flatten(Base), Transform

# ---- group: Filter 4 Sides
explode = Explode(Curve=item_7, Recursive=True)  # -> Segments, Vertices
lng = ListLength(List=explode.Segments)  # -> flatten(Length)
equals = Equality(FirstNumber=lng, SecondNumber=4)  # -> Equality, Inequality
panel_15 = Panel(equals.Equality)
dispatch = Dispatch(List=item_7, DispatchPattern=equals.Equality)  # -> ListA, ListB
crv_2 = Curve(dispatch.ListA)

# ----
cir = Circle(Plane=db_2.Base, Radius=125)
boundary = BoundarySurfaces(Edges=cir)

# ---- group: Filter Rectangulars
py3_13 = Python3Script(curves_input=crv_2)  # -> out, rectangular_indexes; inputs curves_input: list of Curve
# ---------- py3_13: Python ----------
import Rhino.Geometry as rg
import math

def is_rectangular(curve):
    if not isinstance(curve, (rg.PolylineCurve, rg.Curve)):
        print(f"Curve is not a PolylineCurve or Curve: {curve}")
        return False
    
    # Convert curve to polyline
    polyline = curve.TryGetPolyline()[1]
    if not polyline:
        print(f"Curve could not be converted to Polyline: {curve}")
        return False

    # Check if the polyline has 5 points (4 segments and a closing point)
    if len(polyline) != 5:
        print(f"Polyline with {len(polyline)} points is not rectangular.")
        return False

    # Calculate angles between consecutive segments
    angles = []
    for i in range(3):
        vec1 = polyline[i + 1] - polyline[i]
        vec2 = polyline[(i + 2) % 5] - polyline[i + 1]
        angle = rg.Vector3d.VectorAngle(vec1, vec2)
        angles.append(math.degrees(angle))

    print(f"Angles for polyline: {angles}")

    # Check if all angles are close to 90 or 270 degrees
    for angle in angles:
        if not (88 <= angle <= 92 or 268 <= angle <= 272):
            print(f"Angle {angle} is not close to 90 or 270 degrees.")
            return False
    
    return True

def find_rectangular_indexes(curves):
    indexes = []
    for i, curve in enumerate(curves):
        print(f"Processing curve {i}: {curve}")
        if is_rectangular(curve):
            indexes.append(i)
    return indexes

# Inputs (ensure these are set correctly in Grasshopper)
curves_input = [x for x in curves_input if isinstance(x, rg.Curve)]

# Debugging: Print the number of curves
print(f"Number of curves: {len(curves_input)}")

# Find indexes of rectangular polycurves
rectangular_indexes = find_rectangular_indexes(curves_input)

# Outputs
rectangular_indexes
# ---------- end py3_13 ----------
panel_16 = Panel(py3_13.rectangular_indexes)
item_9 = ListItem(List=crv_2, Index=py3_13.rectangular_indexes, Wrap=True)
crv_3 = Curve(item_9)
boundary_2 = BoundarySurfaces(Edges=graft(crv_3))  # -> flatten(Surfaces)

# ---- group: Find Direct Blocks
srf = Surface(boundary_2)
scx = SurfaceCurve(Surface=graft(srf), Curve=cir)  # -> simplify(Curves), simplify(Points), UVPoints, Normals, Parameters, Tangents
pshift = ShiftPaths(Data=scx.Curves, Offset=-1)
lng_2 = ListLength(List=pshift)
larger = LargerThan(FirstNumber=lng_2, SecondNumber=0)  # -> flatten(LargerThan), OrEqualTo
dispatch_2 = Dispatch(List=boundary_2, DispatchPattern=larger.LargerThan)  # -> ListA, ListB
crv_4 = Curve(flatten(dispatch_2.ListA))

# ----
boundary_3 = BoundarySurfaces(Edges=graft(crv_3))  # -> flatten(Surfaces)
item_10 = ListItem(List=boundary_2, Index=139, Wrap=True)
number_slider = Slider(87, range=0..100)
lng_3 = ListLength(List=scx.Curves)
larger_2 = LargerThan(FirstNumber=lng_3, SecondNumber=0)  # -> LargerThan, OrEqualTo
pshift_2 = ShiftPaths(Data=larger_2.LargerThan, Offset=-1)
crv_5 = Curve(boundary_2)
item_11 = ListItem(List=boundary_2, Index=Slider(29, range=0..60), Wrap=True)
mindex = MemberIndex(Set=pshift_2, Member=Toggle(True))  # -> Index, Count
pshift_3 = ShiftPaths(Data=mindex.Index, Offset=-1)

# ---- group: DuctWidth by Geometry
explode_2 = Explode(Curve=crv_5, Recursive=True)  # -> Segments, Vertices
len = Length(Curve=explode_2.Segments)
sort = SortList(Keys=len)  # -> reverse(Keys), ValuesA
item_12 = ListItem(List=sort.Keys, Index=0, Wrap=True)  # -> flatten(Item)
int = Integer(item_12)

# ---- group: Filter Single Lines
explode_3 = Explode(Curve=item_7, Recursive=True)  # -> Segments, Vertices
lng_4 = ListLength(List=explode_3.Segments)  # -> flatten(Length)
equals_2 = Equality(FirstNumber=lng_4, SecondNumber=1)  # -> Equality, Inequality
panel_17 = Panel(equals_2.Equality)
dispatch_3 = Dispatch(List=item_7, DispatchPattern=equals_2.Equality)  # -> ListA, ListB
crv_6 = Curve(dispatch_3.ListA)

# ----
py3_14 = Python3Script(A=pshift_3)  # -> out, B; inputs A: tree of Int32
# ---------- py3_14: Python ----------
import scriptcontext as sc

def process_tree(input_tree):
    output_list = []
    
    # Iterate through all paths in the tree
    for path in input_tree.Paths:
        branch = input_tree.Branch(path)
        
        if len(branch) == 0:
            # Branch is empty
            output_list.append(-1)
        else:
            # Branch contains data
            value = branch[0]
            if isinstance(value, int):
                output_list.append(value)
            else:
                # If the value is not an integer, append -1
                output_list.append(-1)
    
    return output_list

# Assume the input data tree is connected to input parameter 'A'
input_tree = A

result = process_tree(input_tree)

# Assign the result to output parameter 'B'
B = result
# ---------- end py3_14 ----------
panel_18 = Panel(py3_14.B)
panel_19 = Panel(int)

# ---- group: Rect Downbbranches
db_3 = DeconstructBlock(Block=item_6)  # -> Panda, Attributes, flatten(Name), Description, flatten(Base), Transform
py3_15 = Python3Script(x=db_3.Name)  # -> out, a; inputs x: list of String
# ---------- py3_15: Python ----------
# Ensure the input is treated as a list
layer_names = list(x)

# Initialize an empty list to store the indices
indices = []

# Iterate through the list of layer names
for i, name in enumerate(layer_names):
    # Check if 'CAP' is in the layer name
    if 'KR2004AS-2D' in name or 'KR2004AR-2D' in name:
        indices.append(i)

# Assign the result to the output parameter
a = indices
# ---------- end py3_15 ----------
item_13 = ListItem(List=item_6, Index=py3_15.a, Wrap=True)
db_4 = DeconstructBlock(Block=item_13)  # -> Panda, Attributes, flatten(Name), Description, flatten(Base), Transform
panel_20 = Panel(py3_15.a)
circle = Circle(db_4.Panda)
clean_3 = CleanTree(RemoveNulls=True, RemoveInvalid=True, RemoveEmpty=False, Tree=circle)  # -> flatten(Tree)
number_slider_2 = Slider(3, range=0..10)
item_14 = ListItem(List=item_13, Index=number_slider_2, Wrap=True)
item_15 = ListItem(List=clean_3, Index=number_slider_2, Wrap=True)

# ---- group: Round Downbbranches
db_5 = DeconstructBlock(Block=item_6)  # -> Panda, Attributes, flatten(Name), Description, flatten(Base), Transform
py3_16 = Python3Script(x=db_5.Name)  # -> out, a; inputs x: list of String
# ---------- py3_16: Python ----------
# Ensure the input is treated as a list
layer_names = list(x)

# Initialize an empty list to store the indices
indices = []

# Iterate through the list of layer names
for i, name in enumerate(layer_names):
    # Check if 'CAP' is in the layer name
    if '2D-KND90001' in name:
        indices.append(i)

# Assign the result to the output parameter
a = indices
# ---------- end py3_16 ----------
item_16 = ListItem(List=item_6, Index=py3_16.a, Wrap=True)
db_6 = DeconstructBlock(Block=item_16)  # -> Panda, Attributes, flatten(Name), Description, flatten(Base), Transform
panel_21 = Panel(py3_16.a)
circle_2 = Circle(db_6.Panda)
clean_4 = CleanTree(RemoveNulls=True, RemoveInvalid=True, RemoveEmpty=False, Tree=circle_2)  # -> flatten(Tree)
number_slider_3 = Slider(3, range=0..10)
item_17 = ListItem(List=item_16, Index=number_slider_3, Wrap=True)
item_18 = ListItem(List=clean_4, Index=number_slider_3, Wrap=True)

# ----
mindex_2 = MemberIndex(Set=py3_14.B, Member=-1)  # -> Index, Count

# ---- group: Round Ducts
line = Line(crv_6)
clean_5 = CleanTree(RemoveNulls=True, RemoveInvalid=True, RemoveEmpty=False, Tree=line)
py3_17 = Python3Script(surfaces=boundary_2, lines=clean_5, lengths=int)  # -> out, classifications; inputs surfaces: list of Brep, lines: list of Line, lengths: list of Int32
# ---------- py3_17: Python ----------
import Rhino.Geometry as rg

def classify_intersections(surfaces, lines, lengths):
    classifications = []
    for i, surface in enumerate(surfaces):
        classification = "Rectangular"  # Default classification
        print(f"Processing surface {i}:")
        for line in lines:
            line_curve = rg.LineCurve(line)
            intersection_events = rg.Intersect.Intersection.CurveBrep(line_curve, surface, 0.01)[1]
            if intersection_events:
                print(f"  Found {len(intersection_events)} intersection events")
                for event in intersection_events:
                    intersection_curve = event
                    intersection_length = intersection_curve.GetLength()
                    print(f"    Intersection length: {intersection_length}")
                    print(lengths[i])
                    # Compare the length of the intersection to the input length
                    if int(round(intersection_length)) == lengths[i]:
                        classification = "Round"
                        print(f"    Classification changed to Round for surface {i}")
                        break
        classifications.append(classification)
    return classifications

# Inputs (ensure these are set correctly in Grasshopper)
print(f"Surfaces input type: {type(surfaces)}")
surfaces = [x for x in surfaces if isinstance(x, rg.Brep)]
lines = [x for x in lines if isinstance(x, rg.Line)]
lengths = [int(x) for x in lengths]

# Debugging: Print the number of surfaces and lines
print(f"Number of surfaces: {len(surfaces)}")
print(f"Number of lines: {len(lines)}")

# Classify intersections
classifications = classify_intersections(surfaces, lines, lengths)

# Outputs
classifications
# ---------- end py3_17 ----------
panel_22 = Panel(py3_17.classifications)
mindex_3 = MemberIndex(Set=panel_22, Member="Round")  # -> Index, Count
item_19 = ListItem(List=boundary_2, Index=mindex_3.Index, Wrap=True)
crv_7 = Curve(item_19)

# ----
panel_23 = Panel(boundary_2)
number_slider_4 = Slider(30, range=0..120)
panel_24 = Panel(clean_5)
darc = DeconstructArc(Arc=clean_4)  # -> BasePlane, Radius, Angle
deplane = DeconstructPlane(Plane=darc.BasePlane)  # -> Origin, XAxis, YAxis, ZAxis

# ---- group: Short Lines
explode_4 = Explode(Curve=crv_7, Recursive=True)  # -> Segments, Vertices
len_2 = Length(Curve=explode_4.Segments)
sort_2 = SortList(Keys=len_2)  # -> Keys, ValuesA
int_2 = Integer(sort_2.Keys)
item_20 = ListItem(List=int_2, Index=0, Wrap=True)
int_3 = Integer(len_2)
mindex_4 = MemberIndex(Set=int_3, Member=item_20)  # -> Index, Count
int_4 = Integer(flatten(item_20))
item_21 = ListItem(List=explode_4.Segments, Index=mindex_4.Index, Wrap=True)  # -> simplify(Item)
item_22 = ListItem(List=item_21, Index=0, Wrap=True)  # -> flatten(Item)
item_23 = ListItem(List=item_21, Index=1, Wrap=True)  # -> flatten(Item)
midpt = CurveMiddle(Curve=item_22)
midpt_2 = CurveMiddle(Curve=item_23)
pdecon = Deconstruct(Point=midpt)  # -> XComponent, YComponent, ZComponent
pdecon_2 = Deconstruct(Point=midpt_2)  # -> XComponent, YComponent, ZComponent

# ----
lng_5 = ListLength(List=clean_4)
repeat = RepeatData(Data=panel_14, Length=lng_5)  # -> simplify(flatten(Data))
pdecon_3 = Deconstruct(Point=deplane.Origin)  # -> XComponent, YComponent, ZComponent
multiplication = Multiplication(A=darc.Radius, B=2)
pdecon_4 = Deconstruct(Point=db_4.Base)  # -> XComponent, YComponent, ZComponent
lng_6 = ListLength(List=pdecon_4.XComponent)
repeat_2 = RepeatData(Data=panel_14, Length=lng_6)  # -> simplify(flatten(Data))
system = Panel(repeat)

panel_25 = Panel(system)
clean_6 = CleanTree(RemoveNulls=True, RemoveInvalid=True, RemoveEmpty=True, Tree=panel_25)
lng_7 = ListLength(List=clean_6)
cull_null = CullNull(List=panel_25)  # -> Cull, NullIndex
lng_8 = ListLength(List=panel_25)
panel_26 = Panel(lng_7)
panel_27 = Panel(cull_null.NullIndex)
panel_28 = Panel(lng_8)

system_2 = Panel(repeat_2)

panel_29 = Panel(system_2)
clean_7 = CleanTree(RemoveNulls=True, RemoveInvalid=True, RemoveEmpty=True, Tree=panel_29)
lng_9 = ListLength(List=clean_7)
cull_null_2 = CullNull(List=panel_29)  # -> Cull, NullIndex
lng_10 = ListLength(List=panel_29)
panel_30 = Panel(cull_null_2.NullIndex)
panel_31 = Panel(lng_9)
panel_32 = Panel(lng_10)

lng_11 = ListLength(List=crv_7)
start_x = Panel(pdecon_3.XComponent)

panel_33 = Panel(start_x)
clean_8 = CleanTree(RemoveNulls=True, RemoveInvalid=True, RemoveEmpty=True, Tree=panel_33)
lng_12 = ListLength(List=clean_8)
cull_null_3 = CullNull(List=panel_33)  # -> Cull, NullIndex
lng_13 = ListLength(List=panel_33)
panel_34 = Panel(cull_null_3.NullIndex)
panel_35 = Panel(lng_12)
panel_36 = Panel(lng_13)

repeat_3 = RepeatData(Data=panel_14, Length=lng_11)  # -> simplify(flatten(Data))
start_x_2 = Panel(pdecon_4.XComponent)

panel_37 = Panel(start_x_2)
clean_9 = CleanTree(RemoveNulls=True, RemoveInvalid=True, RemoveEmpty=True, Tree=panel_37)
lng_14 = ListLength(List=clean_9)
cull_null_4 = CullNull(List=panel_37)  # -> Cull, NullIndex
lng_15 = ListLength(List=panel_37)
panel_38 = Panel(lng_14)
panel_39 = Panel(cull_null_4.NullIndex)
panel_40 = Panel(lng_15)

start_y = Panel(pdecon_3.YComponent)

panel_41 = Panel(start_y)
clean_10 = CleanTree(RemoveNulls=True, RemoveInvalid=True, RemoveEmpty=True, Tree=panel_41)
lng_16 = ListLength(List=clean_10)
cull_null_5 = CullNull(List=panel_41)  # -> Cull, NullIndex
lng_17 = ListLength(List=panel_41)
panel_42 = Panel(cull_null_5.NullIndex)
panel_43 = Panel(lng_16)
panel_44 = Panel(lng_17)

start_y_2 = Panel(pdecon_4.YComponent)

panel_45 = Panel(start_y_2)
clean_11 = CleanTree(RemoveNulls=True, RemoveInvalid=True, RemoveEmpty=True, Tree=panel_45)
lng_18 = ListLength(List=clean_11)
cull_null_6 = CullNull(List=panel_45)  # -> Cull, NullIndex
lng_19 = ListLength(List=panel_45)
panel_46 = Panel(lng_18)
panel_47 = Panel(cull_null_6.NullIndex)
panel_48 = Panel(lng_19)

system_3 = Panel(repeat_3)

panel_49 = Panel(system_3)
clean_12 = CleanTree(RemoveNulls=True, RemoveInvalid=True, RemoveEmpty=True, Tree=panel_49)
lng_20 = ListLength(List=clean_12)
cull_null_7 = CullNull(List=panel_49)  # -> Cull, NullIndex
lng_21 = ListLength(List=panel_49)
panel_50 = Panel(cull_null_7.NullIndex)
panel_51 = Panel(lng_20)
panel_52 = Panel(lng_21)

diameter = Panel(multiplication)

panel_53 = Panel(diameter)
clean_13 = CleanTree(RemoveNulls=True, RemoveInvalid=True, RemoveEmpty=True, Tree=panel_53)
lng_22 = ListLength(List=clean_13)
cull_null_8 = CullNull(List=panel_53)  # -> Cull, NullIndex
lng_23 = ListLength(List=panel_53)
panel_54 = Panel(cull_null_8.NullIndex)
panel_55 = Panel(lng_22)
panel_56 = Panel(lng_23)

start_x_3 = Panel(pdecon.XComponent)

panel_57 = Panel(start_x_3)
clean_14 = CleanTree(RemoveNulls=True, RemoveInvalid=True, RemoveEmpty=True, Tree=panel_57)
lng_24 = ListLength(List=clean_14)
cull_null_9 = CullNull(List=panel_57)  # -> Cull, NullIndex
lng_25 = ListLength(List=panel_57)
panel_58 = Panel(lng_24)
panel_59 = Panel(cull_null_9.NullIndex)
panel_60 = Panel(lng_25)

start_y_3 = Panel(pdecon.YComponent)

panel_61 = Panel(start_y_3)
clean_15 = CleanTree(RemoveNulls=True, RemoveInvalid=True, RemoveEmpty=True, Tree=panel_61)
lng_26 = ListLength(List=clean_15)
cull_null_10 = CullNull(List=panel_61)  # -> Cull, NullIndex
lng_27 = ListLength(List=panel_61)
panel_62 = Panel(lng_26)
panel_63 = Panel(cull_null_10.NullIndex)
panel_64 = Panel(lng_27)

end_x = Panel(pdecon_2.XComponent)

panel_65 = Panel(end_x)
clean_16 = CleanTree(RemoveNulls=True, RemoveInvalid=True, RemoveEmpty=True, Tree=panel_65)
lng_28 = ListLength(List=clean_16)
cull_null_11 = CullNull(List=panel_65)  # -> Cull, NullIndex
lng_29 = ListLength(List=panel_65)
panel_66 = Panel(lng_28)
panel_67 = Panel(cull_null_11.NullIndex)
panel_68 = Panel(lng_29)

end_y = Panel(pdecon_2.YComponent)

panel_69 = Panel(end_y)
clean_17 = CleanTree(RemoveNulls=True, RemoveInvalid=True, RemoveEmpty=True, Tree=panel_69)
lng_30 = ListLength(List=clean_17)
cull_null_12 = CullNull(List=panel_69)  # -> Cull, NullIndex
lng_31 = ListLength(List=panel_69)
panel_70 = Panel(cull_null_12.NullIndex)
panel_71 = Panel(lng_30)
panel_72 = Panel(lng_31)

kesit_x = Panel(int_4)

panel_73 = Panel(kesit_x)
clean_18 = CleanTree(RemoveNulls=True, RemoveInvalid=True, RemoveEmpty=True, Tree=panel_73)
lng_32 = ListLength(List=clean_18)
cull_null_13 = CullNull(List=panel_73)  # -> Cull, NullIndex
lng_33 = ListLength(List=panel_73)
panel_74 = Panel(cull_null_13.NullIndex)
panel_75 = Panel(lng_32)
panel_76 = Panel(lng_33)

txt = Text(["SystemName", "StartX", "StartY", "EndX", "EndY", "Diameter"])
txt_2 = Text(["SystemName", "StartX", "StartY", "EndX", "EndY", "KesitX", "KesitY"])
txt_3 = Text(["SystemName", "StartX", "StartY"])
txt_4 = Text(["SystemName", "StartX", "StartY", "Diameter"])
panel_77 = Panel(txt)
panel_78 = Panel(txt_2)
panel_79 = Panel(txt_3)
panel_80 = Panel(txt_4)
entwine = Entwine(Branch00=panel_29, Branch01=panel_37, Branch02=panel_45, FlattenInputs=True)
entwine_2 = Entwine(
    Branch00=panel_49,
    Branch01=panel_57,
    Branch02=panel_61,
    Branch03=panel_65,
    Branch04=panel_69,
    Branch05=panel_73,
    FlattenInputs=True)
entwine_3 = Entwine(Branch00=panel_25, Branch01=panel_33, Branch02=panel_41, Branch03=panel_53, FlattenInputs=True)
csv = CreateCSV(DataGridHeaders=panel_77, ValueTree=entwine_2, Delimiter=",")
csv_2 = CreateCSV(DataGridHeaders=panel_79, ValueTree=entwine, Delimiter=",")
csv_3 = CreateCSV(DataGridHeaders=panel_80, ValueTree=entwine_3, Delimiter=",")
curves = Panel(csv)
downrects = Panel(csv_2)
curves_2 = Panel(csv_3)

# ---- group: filter KNLTXT
rhatt_7 = GetRhinoAttributes(Geometry=crv)  # -> Name, Layer, Color
panel_81 = Panel(rhatt_7.Layer)
py3_18 = Python3Script(x=panel_81)  # -> out, a; inputs x: list of String; same code as py3_4
panel_82 = Panel(py3_18.a)
item_24 = ListItem(List=crv, Index=panel_82, Wrap=True)

# ---- group: ALAKASIZ LEADERLAR
len_3 = Length(Curve=item_24)
larger_3 = LargerThan(FirstNumber=len_3, SecondNumber=25)  # -> LargerThan, OrEqualTo
dispatch_4 = Dispatch(List=item_24, DispatchPattern=larger_3.LargerThan)  # -> ListA, ListB
crv_8 = Curve(dispatch_4.ListA)
item_25 = ListItem(List=crv_8, Index=1, Wrap=True)

# ---- group: filter KNLTXT (continued)
rhatt_8 = GetRhinoAttributes(Geometry=crv_8)  # -> Name, Layer, Color

# ---- group: LDR curves in selected system
py3_19 = Python3Script(x=rhatt_8.Layer, y=item_5)  # -> out, a; inputs x: list of String, y: String; same code as py3_12
item_26 = ListItem(List=crv_8, Index=py3_19.a, Wrap=True)

# ----
join = JoinCurves(Curves=item_26, Preserve=False)

# ---- group: Filter for Leadered Ducts
srf_2 = Surface(boundary_2)
scx_2 = SurfaceCurve(Surface=graft(srf_2), Curve=join)  # -> Curves, simplify(Points), UVPoints, Normals, Parameters, Tangents
pshift_4 = ShiftPaths(Data=scx_2.Points, Offset=-1)
lng_34 = ListLength(List=pshift_4)
larger_4 = LargerThan(FirstNumber=lng_34, SecondNumber=0)  # -> flatten(LargerThan), OrEqualTo
dispatch_5 = Dispatch(List=boundary_2, DispatchPattern=larger_4.LargerThan)  # -> ListA, ListB
crv_9 = Curve(flatten(dispatch_5.ListA))

# ---- group: Find Blocks for leaders
srf_3 = Surface(boundary)
scx_3 = SurfaceCurve(Surface=srf_3, Curve=graft(join))  # -> simplify(Curves), simplify(Points), UVPoints, Normals, Parameters, Tangents
pshift_5 = ShiftPaths(Data=scx_3.Curves, Offset=-1)
lng_35 = ListLength(List=pshift_5)
larger_5 = LargerThan(FirstNumber=lng_35, SecondNumber=0)  # -> flatten(LargerThan), OrEqualTo
dispatch_6 = Dispatch(List=join, DispatchPattern=larger_5.LargerThan)  # -> ListA, ListB
crv_10 = Curve(flatten(dispatch_6.ListA))

# ----
lng_36 = ListLength(List=scx_3.Curves)
lng_37 = ListLength(List=scx_2.Points)
larger_6 = LargerThan(FirstNumber=lng_36, SecondNumber=0)  # -> LargerThan, OrEqualTo
larger_7 = LargerThan(FirstNumber=lng_37, SecondNumber=0)  # -> LargerThan, OrEqualTo
pshift_6 = ShiftPaths(Data=larger_6.LargerThan, Offset=-1)
pshift_7 = ShiftPaths(Data=larger_7.LargerThan, Offset=-1)
mindex_5 = MemberIndex(Set=pshift_6, Member=Toggle(True))  # -> Index, Count
mindex_6 = MemberIndex(Set=pshift_7, Member=Toggle(True))  # -> Index, Count
item_27 = ListItem(List=join, Index=number_slider, Wrap=True)
pshift_8 = ShiftPaths(Data=mindex_5.Index, Offset=-1)
pshift_9 = ShiftPaths(Data=mindex_6.Index, Offset=-1)
py3_20 = Python3Script(A=pshift_8)  # -> out, B; inputs A: tree of Int32; same code as py3_14
item_28 = ListItem(List=py3_20.B, Index=number_slider, Wrap=True)
py3_21 = Python3Script(A=pshift_9)  # -> out, B; inputs A: tree of Int32; same code as py3_14
item_29 = ListItem(List=boundary, Index=item_28, Wrap=True)
item_30 = ListItem(List=py3_20.B, Index=-1, Wrap=False)
panel_83 = Panel(py3_21.B)
panel_84 = Panel(py3_20.B)
item_31 = ListItem(List=py3_20.B, Index=py3_21.B, Wrap=False)
panel_85 = Panel(item_30)
panel_86 = Panel(item_31)
item_32 = ListItem(List=panel_86, Index=mindex_2.Index, Wrap=True)
replace = ReplaceItems(List=py3_14.B, Item=item_32, Indices=mindex_2.Index, Wrap=False)

# ---- group: RECTANGULAR DUCTS / duct Curves
equals_3 = Equality(FirstNumber=replace, SecondNumber=-1)  # -> Equality, Inequality
dispatch_7 = Dispatch(List=boundary_2, DispatchPattern=equals_3.Inequality)  # -> ListA, ListB
crv_11 = Curve(dispatch_7.ListA)

# ----
panel_87 = Panel(replace)

# ---- group: RECTANGULAR DUCTS
blocks_circle = ListItem(List=item_8, Index=panel_87, Wrap=True)
dispatch_8 = Dispatch(List=blocks_circle, DispatchPattern=equals_3.Inequality)  # -> ListA, ListB
db_7 = DeconstructBlock(Block=dispatch_8.ListA)  # -> Panda, Attributes, flatten(Name), Description, flatten(Base), Transform
cir_2 = Circle(Plane=db_7.Base, Radius=125)

# ----
getuv = GetUserValue(Geometry=dispatch_8.ListA, Key="KESITX")  # -> flatten(KESITX)
getuv_2 = GetUserValue(Geometry=dispatch_8.ListA, Key="KESITY")  # -> flatten(KESITY)
item_33 = ListItem(List=crv_11, Index=number_slider_4, Wrap=True)
item_34 = ListItem(List=cir_2, Index=number_slider_4, Wrap=True)

# ---- group: Short Lines
explode_5 = Explode(Curve=crv_11, Recursive=True)  # -> Segments, Vertices
len_4 = Length(Curve=explode_5.Segments)
sort_3 = SortList(Keys=len_4)  # -> Keys, ValuesA
int_5 = Integer(sort_3.Keys)
item_35 = ListItem(List=int_5, Index=0, Wrap=True)
int_6 = Integer(len_4)
int_7 = Integer(item_35)
mindex_7 = MemberIndex(Set=int_6, Member=item_35)  # -> Index, Count
item_36 = ListItem(List=explode_5.Segments, Index=mindex_7.Index, Wrap=True)  # -> simplify(Item)
item_37 = ListItem(List=item_36, Index=0, Wrap=True)  # -> flatten(Item)
item_38 = ListItem(List=item_36, Index=1, Wrap=True)  # -> flatten(Item)
midpt_3 = CurveMiddle(Curve=item_37)
midpt_4 = CurveMiddle(Curve=item_38)
pdecon_5 = Deconstruct(Point=midpt_3)  # -> XComponent, YComponent, ZComponent
pdecon_6 = Deconstruct(Point=midpt_4)  # -> XComponent, YComponent, ZComponent

# ----
panel_88 = Panel(sort_3.Keys)
lng_38 = ListLength(List=mindex_7.Index)  # -> flatten(Length)
equals_4 = Equality(FirstNumber=lng_38, SecondNumber=2)  # -> Equality, Inequality
mindex_8 = MemberIndex(Set=equals_4.Equality, Member=Toggle(False))  # -> Index, Count
lng_39 = ListLength(List=crv_11)
repeat_4 = RepeatData(Data=panel_14, Length=lng_39)  # -> simplify(flatten(Data))
system_4 = Panel(repeat_4)

panel_89 = Panel(system_4)
clean_19 = CleanTree(RemoveNulls=True, RemoveInvalid=True, RemoveEmpty=True, Tree=panel_89)
lng_40 = ListLength(List=clean_19)
cull_null_14 = CullNull(List=panel_89)  # -> Cull, NullIndex
lng_41 = ListLength(List=panel_89)
panel_90 = Panel(lng_40)
panel_91 = Panel(cull_null_14.NullIndex)
panel_92 = Panel(lng_41)

start_x_4 = Panel(pdecon_5.XComponent)

panel_93 = Panel(start_x_4)
clean_20 = CleanTree(RemoveNulls=True, RemoveInvalid=True, RemoveEmpty=True, Tree=panel_93)
lng_42 = ListLength(List=clean_20)
cull_null_15 = CullNull(List=panel_93)  # -> Cull, NullIndex
lng_43 = ListLength(List=panel_93)
panel_94 = Panel(lng_42)
panel_95 = Panel(cull_null_15.NullIndex)
panel_96 = Panel(lng_43)

start_y_4 = Panel(pdecon_5.YComponent)

panel_97 = Panel(start_y_4)
clean_21 = CleanTree(RemoveNulls=True, RemoveInvalid=True, RemoveEmpty=True, Tree=panel_97)
lng_44 = ListLength(List=clean_21)
cull_null_16 = CullNull(List=panel_97)  # -> Cull, NullIndex
lng_45 = ListLength(List=panel_97)
panel_98 = Panel(lng_44)
panel_99 = Panel(cull_null_16.NullIndex)
panel_100 = Panel(lng_45)

end_x_2 = Panel(pdecon_6.XComponent)

panel_101 = Panel(end_x_2)
clean_22 = CleanTree(RemoveNulls=True, RemoveInvalid=True, RemoveEmpty=True, Tree=panel_101)
lng_46 = ListLength(List=clean_22)
cull_null_17 = CullNull(List=panel_101)  # -> Cull, NullIndex
lng_47 = ListLength(List=panel_101)
panel_102 = Panel(cull_null_17.NullIndex)
panel_103 = Panel(lng_46)
panel_104 = Panel(lng_47)

end_y_2 = Panel(pdecon_6.YComponent)

panel_105 = Panel(end_y_2)
clean_23 = CleanTree(RemoveNulls=True, RemoveInvalid=True, RemoveEmpty=True, Tree=panel_105)
lng_48 = ListLength(List=clean_23)
cull_null_18 = CullNull(List=panel_105)  # -> Cull, NullIndex
lng_49 = ListLength(List=panel_105)
panel_106 = Panel(lng_48)
panel_107 = Panel(cull_null_18.NullIndex)
panel_108 = Panel(lng_49)

kesit_x_2 = Panel(getuv)
nullrep = ReplaceNulls(Items=kesit_x_2, Replacements=0)  # -> Items, Count

panel_109 = Panel(nullrep.Items)
clean_24 = CleanTree(RemoveNulls=True, RemoveInvalid=True, RemoveEmpty=True, Tree=panel_109)
lng_50 = ListLength(List=clean_24)
cull_null_19 = CullNull(List=panel_109)  # -> Cull, NullIndex
lng_51 = ListLength(List=panel_109)
panel_110 = Panel(cull_null_19.NullIndex)
panel_111 = Panel(lng_50)
panel_112 = Panel(lng_51)

kesit_y = Panel(getuv_2)
nullrep_2 = ReplaceNulls(Items=kesit_y, Replacements=0)  # -> Items, Count

panel_113 = Panel(nullrep_2.Items)
clean_25 = CleanTree(RemoveNulls=True, RemoveInvalid=True, RemoveEmpty=True, Tree=panel_113)
lng_52 = ListLength(List=clean_25)
cull_null_20 = CullNull(List=panel_113)  # -> Cull, NullIndex
lng_53 = ListLength(List=panel_113)
panel_114 = Panel(lng_52)
panel_115 = Panel(cull_null_20.NullIndex)
panel_116 = Panel(lng_53)

entwine_4 = Entwine(
    Branch00=panel_89,
    Branch01=panel_93,
    Branch02=panel_97,
    Branch03=panel_101,
    Branch04=panel_105,
    Branch05=panel_109,
    Branch06=panel_113,
    FlattenInputs=True)
csv_4 = CreateCSV(DataGridHeaders=panel_78, ValueTree=entwine_4, Delimiter=",")
curves_3 = Panel(csv_4)
