# Grasshopper definition get_WWS_data.gh (Grasshopper 1.0.8)
# plug-ins: RhinoCodePluginGH, PANDA, EleFront, LunchBox, Python

panel = Panel("L05")  # disabled
py3 = Python3Script(x=panel)  # -> out, a; inputs x: String; disabled
# ---------- py3: Python ----------
# Ensure the input is treated as a list
name = x

if name == "LB1":        
    a = 0

elif name =="L01":
    a = 1

elif name =="L02":
    a = 2

elif name =="L03":
    a = 3

elif name =="L04":
    a = 4

elif name =="L05":
    a = 5

else:
    a = 6
# ---------- end py3 ----------
panel_2 = Panel(py3.a)  # disabled
geo = Geometry([<curve referenced from the Rhino model> x934, <textentity referenced from the Rhino model>, <curve referenced from the Rhino model>, <textentity referenced from the Rhino model>, <curve referenced from the Rhino model>, <textentity referenced from the Rhino model>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])  # disabled
list = ValueList({"Point": 0, "Curve": 1, "Arc": 2, "Circle": 3, "Ellipse": 4, "Line": 5, "Polyline": 6, "Surface": 7, "Brep": 8, "Mesh": 9, "Polysurface": 10, "Block": 11, "Text": 12, "TextDot": 13, "Dimension": 14, "LinearDimension": 15, "AngularDimension": 16, "Hatch": 17, "Leader": 18}, selected="Leader")  # disabled
list_2 = ValueList({"Point": 0, "Curve": 1, "Arc": 2, "Circle": 3, "Ellipse": 4, "Line": 5, "Polyline": 6, "Surface": 7, "Brep": 8, "Mesh": 9, "Polysurface": 10, "Block": 11, "Text": 12, "TextDot": 13, "Dimension": 14, "LinearDimension": 15, "AngularDimension": 16, "Hatch": 17, "Leader": 18}, selected="Curve")  # disabled
list_3 = ValueList({"Point": 0, "Curve": 1, "Arc": 2, "Circle": 3, "Ellipse": 4, "Line": 5, "Polyline": 6, "Surface": 7, "Brep": 8, "Mesh": 9, "Polysurface": 10, "Block": 11, "Text": 12, "TextDot": 13, "Dimension": 14, "LinearDimension": 15, "AngularDimension": 16, "Hatch": 17, "Leader": 18}, selected="Hatch")  # disabled
revise_x = Subtraction(B=47675)
revise_y = Subtraction(B=61600)
geo_2 = Geometry([<instancereference referenced from the Rhino model> x4, <curve referenced from the Rhino model> x3, <instancereference referenced from the Rhino model> x3, <curve referenced from the Rhino model> x3, <instancereference referenced from the Rhino model>, <curve referenced from the Rhino model>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])
filtertype = FilterByType(Geometry=geo, ObjectType=list)  # disabled
filtertype_2 = FilterByType(Geometry=geo, ObjectType=list_2)  # disabled
filtertype_3 = FilterByType(Geometry=geo, ObjectType=list_3)  # disabled
clean = CleanTree(RemoveNulls=True, RemoveInvalid=True, RemoveEmpty=False, Tree=filtertype)  # disabled

# ---- group: ALL BLOCKS
block = Block([<block referenced from the Rhino model> x992])  # disabled
db = DeconstructBlock(Block=block)  # -> Panda, Attributes, flatten(Name), Description, flatten(Base), Transform; disabled

# ----
clean_2 = CleanTree(RemoveNulls=True, RemoveInvalid=True, RemoveEmpty=False, Tree=filtertype_2)  # disabled
clean_3 = CleanTree(RemoveNulls=True, RemoveInvalid=True, RemoveEmpty=False, Tree=filtertype_3)  # disabled
list_4 = ValueList({"Point": 0, "Curve": 1, "Arc": 2, "Circle": 3, "Ellipse": 4, "Line": 5, "Polyline": 6, "Surface": 7, "Brep": 8, "Mesh": 9, "Polysurface": 10, "Block": 11, "Text": 12, "TextDot": 13, "Dimension": 14, "LinearDimension": 15, "AngularDimension": 16, "Hatch": 17, "Leader": 18}, selected="Leader")
list_5 = ValueList({"Point": 0, "Curve": 1, "Arc": 2, "Circle": 3, "Ellipse": 4, "Line": 5, "Polyline": 6, "Surface": 7, "Brep": 8, "Mesh": 9, "Polysurface": 10, "Block": 11, "Text": 12, "TextDot": 13, "Dimension": 14, "LinearDimension": 15, "AngularDimension": 16, "Hatch": 17, "Leader": 18}, selected="Curve")
panel_3 = Panel("BIM-KRITIK ALANLAR")  # disabled

# ---- group: SELECT BY ANNOTATIONS
leader = Leader(clean)  # disabled

# ---- group: All Curves
crv = Curve(clean_2)  # disabled

# ----
hatch = Hatch(clean_3)  # disabled
filtertype_4 = FilterByType(Geometry=geo_2, ObjectType=list_4)
filtertype_5 = FilterByType(Geometry=geo_2, ObjectType=list_5)
clean_4 = CleanTree(RemoveNulls=True, RemoveInvalid=True, RemoveEmpty=False, Tree=filtertype_4)
filterlay = FilterByLayer(Geometry=hatch, Layer=panel_3)  # disabled

# ---- group: ALL BLOCKS
block_2 = Block([<block referenced from the Rhino model> x3327])
db_2 = DeconstructBlock(Block=block_2)  # -> Panda, Attributes, flatten(Name), Description, flatten(Base), Transform

# ----
clean_5 = CleanTree(RemoveNulls=True, RemoveInvalid=True, RemoveEmpty=False, Tree=filtertype_5)

# ---- group: layerda CAP yazanlar
rhatt = GetRhinoAttributes(Geometry=block_2)  # -> Name, Layer, Color
panel_4 = Panel(rhatt.Layer)
py3_2 = Python3Script(x=panel_4)  # -> out, a; inputs x: list of String
# ---------- py3_2: Python ----------
# Ensure the input is treated as a list
layer_names = list(x)

# Initialize an empty list to store the indices
indices = []

# Iterate through the list of layer names
for i, name in enumerate(layer_names):
    # Check if 'CAP' is in the layer name
    if "CAP" in name:
        indices.append(i)

# Assign the result to the output parameter
a = indices
# ---------- end py3_2 ----------
panel_5 = Panel(py3_2.a)
item = ListItem(List=block_2, Index=panel_5, Wrap=True)

# ---- group: SELECT BY ANNOTATIONS
leader_2 = Leader(clean_4)

# ---- group: All Curves
crv_2 = Curve(clean_5)

# ----
rhatt_2 = GetRhinoAttributes(Geometry=crv)  # -> Name, Layer, Color
panel_6 = Panel(rhatt_2.Layer)
py3_3 = Python3Script(x=panel_6)  # -> out, a; inputs x: list of String
# ---------- py3_3: Python ----------
# Ensure the input is treated as a list
layer_names = list(x)

# Initialize an empty list to store the indices
indices = []

# Iterate through the list of layer names
for i, name in enumerate(layer_names):
    # Check if 'ISSO' or 'PIPE' is in the layer name
    # and 'CAP', 'LDR', 'EQUIP', 'ETK', 'FLOOR' are not in the layer name
    if ("ISSO" in name or "PIPE" in name) and not any(exclude in name for exclude in ["CAP", "LDR", "EQUIP", "ETK", "FLOOR"]):
        indices.append(i)

# Assign the result to the output parameter
a = indices
# ---------- end py3_3 ----------
panel_7 = Panel(py3_3.a)

# ---- group: Filter Hatch
srf = Surface(filterlay)
item_2 = ListItem(List=crv, Index=panel_7, Wrap=True)
scx = SurfaceCurve(Surface=srf, Curve=graft(item_2))  # -> Curves, Points, UVPoints, Normals, Parameters, Tangents
len = Length(Curve=scx.Curves)
pshift = ShiftPaths(Data=len, Offset=-1)
item_3 = ListItem(List=panel_6, Index=panel_7, Wrap=True)
item_4 = ListItem(List=panel_6, Index=panel_7, Wrap=True)
lng = ListLength(List=pshift)
py3_4 = Python3Script(x=item_3)  # -> out, a; inputs x: list of String
# ---------- py3_4: Python ----------
# Ensure the input is treated as a list
texts = list(x)

# Initialize an empty list to store the modified texts
modified_texts = []

# Iterate through the list of texts
for text in texts:
    # Remove the substring '-M-' from the text
    modified_text = text.replace("-M-", "")
    modified_texts.append(modified_text)

# Assign the result to the output parameter
a = modified_texts
# ---------- end py3_4 ----------
larger = LargerThan(FirstNumber=lng, SecondNumber=0)  # -> flatten(LargerThan), OrEqualTo
py3_5 = Python3Script(x=item_4)  # -> out, a; inputs x: list of String; same code as py3_4
dispatch = Dispatch(List=py3_4.a, DispatchPattern=larger.LargerThan)  # -> ListA, ListB
dispatch_2 = Dispatch(List=py3_5.a, DispatchPattern=larger.LargerThan)  # -> ListA, ListB
dispatch_3 = Dispatch(List=item_2, DispatchPattern=larger.LargerThan)  # -> ListA, ListB

# ---- group: layerda REZERVASYON, SAFT, HAVALIK, KOT, NOTE yazmayanlar
rhatt_3 = GetRhinoAttributes(Geometry=crv_2)  # -> Name, Layer, Color
panel_8 = Panel(rhatt_3.Layer)
py3_6 = Python3Script(x=panel_8)  # -> out, a; inputs x: list of String
# ---------- py3_6: Python ----------
# Ensure the input is treated as a list
layer_names = list(x)

# Initialize an empty list to store the indices
indices = []

# Iterate through the list of layer names
for i, name in enumerate(layer_names):
    # Check if 'CAP' is in the layer name
    if 'REZERVASYON' not in name and 'SAFT' not in name and 'HAVALIK' not in name and 'KOT' not in name and 'NOTE' not in name:
        indices.append(i)

# Assign the result to the output parameter
a = indices
# ---------- end py3_6 ----------
panel_9 = Panel(py3_6.a)
item_5 = ListItem(List=crv_2, Index=panel_9, Wrap=True)
crv_3 = Curve(item_5)

# ----
crv_4 = Curve(crv)

# ---- group: ELK DN / Index of TAGS
rhatt_4 = GetRhinoAttributes(Geometry=block)  # -> Name, Layer, Color
panel_10 = Panel(rhatt_4.Layer)
py3_7 = Python3Script(x=panel_10)  # -> out, a; inputs x: list of String
# ---------- py3_7: Python ----------
# Ensure the input is treated as a list
layer_names = list(x)

# Initialize an empty list to store the indices
indices = []

# Iterate through the list of layer names
for i, name in enumerate(layer_names):
    # Check if 'CAP' is in the layer name
    if 'CAP-ELK' in name:
        indices.append(i)

# Assign the result to the output parameter
a = indices
# ---------- end py3_7 ----------
panel_11 = Panel(py3_7.a)

# ---- group: NOT ELK DN / Index of TAGS
rhatt_5 = GetRhinoAttributes(Geometry=block)  # -> Name, Layer, Color
panel_12 = Panel(rhatt_5.Layer)
py3_8 = Python3Script(x=panel_12)  # -> out, a; inputs x: list of String
# ---------- py3_8: Python ----------
# Ensure the input is treated as a list
layer_names = list(x)

# Initialize an empty list to store the indices
indices = []

# Iterate through the list of layer names
for i, name in enumerate(layer_names):
    # Check if 'CAP' is in the layer name
    if 'ISSO' in name:
        indices.append(i)

# Assign the result to the output parameter
a = indices
# ---------- end py3_8 ----------
panel_13 = Panel(py3_8.a)

# ---- group: AHU PIPE DN / Index of TAGS
rhatt_6 = GetRhinoAttributes(Geometry=block)  # -> Name, Layer, Color
panel_14 = Panel(rhatt_6.Layer)
py3_9 = Python3Script(x=panel_14)  # -> out, a; inputs x: list of String
# ---------- py3_9: Python ----------
# Ensure the input is treated as a list
layer_names = list(x)

# Initialize an empty list to store the indices
indices = []

# Iterate through the list of layer names
for i, name in enumerate(layer_names):
    # Check if 'CAP' is in the layer name
    if 'AHU' in name and "CAP" in name:
        indices.append(i)

# Assign the result to the output parameter
a = indices
# ---------- end py3_9 ----------
panel_15 = Panel(py3_9.a)

# ---- group: DRENAJ DN / Index of TAGS
rhatt_7 = GetRhinoAttributes(Geometry=block)  # -> Name, Layer, Color
panel_16 = Panel(rhatt_7.Layer)
py3_10 = Python3Script(x=panel_16)  # -> out, a; inputs x: list of String
# ---------- py3_10: Python ----------
# Ensure the input is treated as a list
layer_names = list(x)

# Initialize an empty list to store the indices
indices = []

# Iterate through the list of layer names
for i, name in enumerate(layer_names):
    # Check if 'CAP' is in the layer name
    if 'DREN-CAP' in name:
        indices.append(i)

# Assign the result to the output parameter
a = indices
# ---------- end py3_10 ----------
panel_17 = Panel(py3_10.a)

# ---- group: AHU PIPE DN / Index of TAGS
rhatt_8 = GetRhinoAttributes(Geometry=block)  # -> Name, Layer, Color
panel_18 = Panel(rhatt_8.Layer)
py3_11 = Python3Script(x=panel_18)  # -> out, a; inputs x: list of String
# ---------- py3_11: Python ----------
# Ensure the input is treated as a list
layer_names = list(x)

# Initialize an empty list to store the indices
indices = []

# Iterate through the list of layer names
for i, name in enumerate(layer_names):
    # Check if 'CAP' is in the layer name
    if 'RDY' in name and "CAP" in name:
        indices.append(i)

# Assign the result to the output parameter
a = indices
# ---------- end py3_11 ----------
panel_19 = Panel(py3_11.a)

# ---- group: ELK DN / Index of TAGS
rhatt_9 = GetRhinoAttributes(Geometry=leader)  # -> Name, Layer, Color
panel_20 = Panel(rhatt_9.Layer)
py3_12 = Python3Script(x=panel_20)  # -> out, a; inputs x: list of String; same code as py3_7
panel_21 = Panel(py3_12.a)

# ---- group: NOT ELK DN / Index of TAGS
rhatt_10 = GetRhinoAttributes(Geometry=leader)  # -> Name, Layer, Color
panel_22 = Panel(rhatt_10.Layer)
py3_13 = Python3Script(x=panel_22)  # -> out, a; inputs x: list of String; same code as py3_8
panel_23 = Panel(py3_13.a)

# ---- group: AHU PIPE DN / Index of TAGS
rhatt_11 = GetRhinoAttributes(Geometry=crv_4)  # -> Name, Layer, Color
panel_24 = Panel(rhatt_11.Layer)
py3_14 = Python3Script(x=panel_24)  # -> out, a; inputs x: list of String
# ---------- py3_14: Python ----------
# Ensure the input is treated as a list
layer_names = list(x)

# Initialize an empty list to store the indices
indices = []

# Iterate through the list of layer names
for i, name in enumerate(layer_names):
    # Check if 'CAP' is in the layer name
    if "RDY" in name and "CAP" in name:
        indices.append(i)

# Assign the result to the output parameter
a = indices
# ---------- end py3_14 ----------
panel_25 = Panel(py3_14.a)

# ---- group: DRENAJ DN / Index of TAGS
rhatt_12 = GetRhinoAttributes(Geometry=leader)  # -> Name, Layer, Color
panel_26 = Panel(rhatt_12.Layer)
py3_15 = Python3Script(x=panel_26)  # -> out, a; inputs x: list of String
# ---------- py3_15: Python ----------
# Ensure the input is treated as a list
layer_names = list(x)

# Initialize an empty list to store the indices
indices = []

# Iterate through the list of layer names
for i, name in enumerate(layer_names):
    # Check if 'CAP' is in the layer name
    if 'DREN-LDR' in name:
        indices.append(i)

# Assign the result to the output parameter
a = indices
# ---------- end py3_15 ----------
panel_27 = Panel(py3_15.a)

# ---- group: AHU PIPE DN / Index of TAGS
rhatt_13 = GetRhinoAttributes(Geometry=crv_4)  # -> Name, Layer, Color
panel_28 = Panel(rhatt_13.Layer)
py3_16 = Python3Script(x=panel_28)  # -> out, a; inputs x: list of String; same code as py3_11
panel_29 = Panel(py3_16.a)

# ----
cset = CreateSet(List=panel_28)  # -> Set, Map
panel_30 = Panel(cset.Set)
item_6 = ListItem(List=panel_28, Index=panel_29, Wrap=True)
cset_2 = CreateSet(List=panel_28)  # -> Set, Map
panel_31 = Panel(item_6)
panel_32 = Panel(cset_2.Set)
crv_5 = Curve(dispatch_3.ListA)
len_2 = Length(Curve=crv_5)
larger_2 = LargerThan(FirstNumber=len_2, SecondNumber=350)  # -> flatten(LargerThan), OrEqualTo
dispatch_4 = Dispatch(List=dispatch_2.ListA, DispatchPattern=larger_2.LargerThan)  # -> ListA, ListB
py3_17 = Python3Script(x=dispatch_4.ListA)  # -> out, a; inputs x: String
# ---------- py3_17: Python ----------
# Ensure the input is treated as a list
name = x

if "ISD" in name or "RETURN" in name:        
    a = "return"
elif "DREN" in name:
    a = "drenaj"
else:
    a = "supply"
# ---------- end py3_17 ----------
dispatch_5 = Dispatch(List=crv_5, DispatchPattern=larger_2.LargerThan)  # -> ListA, ListB
dispatch_6 = Dispatch(List=dispatch.ListA, DispatchPattern=larger_2.LargerThan)  # -> ListA, ListB

# ---- group: Index of TAGS
panel_33 = Panel(db.Name)
py3_18 = Python3Script(x=panel_33)  # -> out, a; inputs x: list of String
# ---------- py3_18: Python ----------
# Ensure the input is treated as a list
layer_names = list(x)

# Initialize an empty list to store the indices
indices = []

# Iterate through the list of layer names
for i, name in enumerate(layer_names):
    # Check if 'CAP' is in the layer name
    if 'nokta' in name:
        indices.append(i)

# Assign the result to the output parameter
a = indices
# ---------- end py3_18 ----------
panel_34 = Panel(py3_18.a)

# ----
crv_6 = Curve(dispatch_5.ListA)

item_7 = ListItem(List=db.Base, Index=panel_34, Wrap=True)
cir = Circle(Plane=item_7, Radius=50)
boundary = BoundarySurfaces(Edges=cir)
Z = UnitZ(Factor=-10)
move = Move(Geometry=boundary, Motion=Z)  # -> Geometry, Transform
Z_2 = UnitZ(Factor=20)
extr = Extrude(Base=move.Geometry, Direction=Z_2)
py3_19 = Python3Script(input_breps=extr, input_curves=crv_6)  # -> out, output_classifications; inputs input_breps: list of Brep, input_curves: list of Curve
# ---------- py3_19: Python ----------
import Rhino.Geometry as rg

def classify_curves_by_direction(breps, curves):
    classifications = ["error"] * len(curves)  # Initialize all to "error"
    
    for brep_index, brep in enumerate(breps):
        print(f"Processing brep {brep_index}")
        brep_bbox = brep.GetBoundingBox(True)
        intersecting_indices = []

        # Find curves that intersect the brep
        for idx, curve in enumerate(curves):
            if brep_bbox.Contains(curve.PointAtStart) or brep_bbox.Contains(curve.PointAtEnd):
                intersecting_indices.append(idx)
                print(f"Curve {idx} intersects with brep {brep_index}")

        # Check if there are exactly 3 intersecting curves
        if len(intersecting_indices) == 3:
            directions = [curves[idx].PointAtEnd - curves[idx].PointAtStart for idx in intersecting_indices]
            xy_directions = [rg.Vector3d(dir.X, dir.Y, 0) for dir in directions]
            
            # Normalize directions
            for vec in xy_directions:
                vec.Unitize()
            print(f"XY Directions: {xy_directions}")

            # Calculate angles between each direction vector
            angles = []
            for i in range(3):
                angle_sum = 0
                for j in range(3):
                    if i != j:
                        angle = rg.Vector3d.VectorAngle(xy_directions[i], xy_directions[j])
                        angle_sum += angle
                        print(f"Angle between direction {i} and {j}: {angle}")
                angles.append(angle_sum)

            print(f"Angle sums: {angles}")

            # Find the index with the largest angle sum, which is the branch
            branch_index = angles.index(max(angles))
            print(f"Branch index: {branch_index}")

            # Create classification strings
            for i in range(3):
                if i == branch_index:
                    classifications[intersecting_indices[i]] = "branch"
                    print(f"Curve {intersecting_indices[i]} classified as branch")
                else:
                    classifications[intersecting_indices[i]] = "main"
                    print(f"Curve {intersecting_indices[i]} classified as main")
        else:
            print(f"Brep {brep_index} does not have exactly 3 intersecting curves")

    return classifications

# Inputs (ensure these are set correctly in Grasshopper)
input_breps = [x for x in input_breps if isinstance(x, rg.Brep)]
input_curves = [x for x in input_curves if isinstance(x, rg.Curve)]

# Debugging: Print the number of breps and curves
print(f"Number of breps: {len(input_breps)}")
print(f"Number of curves: {len(input_curves)}")

# Classify curves by direction
output_classifications = classify_curves_by_direction(input_breps, input_curves)

# Outputs
output_classifications
# ---------- end py3_19 ----------

midpt = CurveMiddle(Curve=crv_6)
end = EndPoints(Curve=crv_6)  # -> Start, End
cluster = Cluster(P=panel_2, pt=midpt)  # -> flatten(W)

# ---- group: Pipe To Block Leader Curves
rhatt_14 = GetRhinoAttributes(Geometry=crv_3)  # -> Name, Layer, Color
panel_35 = Panel(rhatt_14.Layer)
py3_20 = Python3Script(x=panel_35)  # -> out, a; inputs x: list of String
# ---------- py3_20: Python ----------
# Ensure the input is treated as a list
layer_names = list(x)

# Initialize an empty list to store the indices
indices = []

# Iterate through the list of layer names
for i, name in enumerate(layer_names):
    # Check if 'CAP' is in the layer name
    if 'CAP' in name:
        indices.append(i)

# Assign the result to the output parameter
a = indices
# ---------- end py3_20 ----------
panel_36 = Panel(py3_20.a)
item_8 = ListItem(List=crv_3, Index=panel_36, Wrap=True)
crv_7 = Curve(item_8)

# ----
pdecon = Deconstruct(Point=end.Start)  # -> XComponent, YComponent, ZComponent
pdecon_2 = Deconstruct(Point=end.End)  # -> XComponent, YComponent, ZComponent
panel_37 = Panel(cluster)
panel_38 = Panel(py3_17.a)

# ---- group: DRENAJ DN
item_9 = ListItem(List=block, Index=panel_17, Wrap=True)
db_3 = DeconstructBlock(Block=item_9)  # -> Panda, Attributes, flatten(Name), Description, flatten(Base), Transform
item_10 = ListItem(List=leader, Index=panel_27, Wrap=True)
pt = Point(db_3.Base)
leader_3 = Leader(Leader=item_10)  # -> Leader, Curve, Text, Plane
crv_8 = Curve(leader_3.Curve)
end_2 = EndPoints(Curve=crv_8)  # -> Start, End
pt_2 = Point(end_2.End)
pt_3 = Point(end_2.Start)
xy = XYPlane(Origin=pt_3)
cir_2 = Circle(Plane=xy, Radius=30)
cp = ClosestPoint(Point=pt_2, Cloud=pt)  # -> ClosestPoint, CPIndex, Distance
getuv = GetUserValue(Geometry=item_9, Key="CAP")
panel_39 = Panel(panel_38)
panel_40 = Panel(cp.CPIndex)
panel_41 = Panel(getuv)
crv_9 = Curve(crv_6)
py3_21 = Python3Script(texts=panel_41)  # -> out, processed_texts; inputs texts: list of String
# ---------- py3_21: Python ----------
import ghpythonlib.treehelpers as th

def remove_before_C(texts):
    result = []
    for text in texts:
        # Find the index of 'C'
        index = text.find('C')
        if index != -1:
            # Remove everything before and including 'C'
            result.append(text[index+1:])
        else:
            # If 'C' is not found, append the original text
            result.append(text)
    return result

# Example usage in Grasshopper
# Assume texts is a list of strings input into the Grasshopper Python component
texts = [str(x) for x in texts]  # Ensure all elements are strings

processed_texts = remove_before_C(texts)

# Output the processed texts
a = th.list_to_tree(processed_texts)
# ---------- end py3_21 ----------
py3_22 = Python3Script(input_circles=cir_2, input_curves=crv_9, input_systems=panel_39)  # -> out, output_intersections; inputs input_circles: list of Curve, input_curves: list of Curve, input_systems: list of String
# ---------- py3_22: Python ----------
import Rhino.Geometry as rg

def find_intersecting_circles(circles, curves, systems):
    result = [None] * len(curves)  # Initialize with None
    
    for curve_index, curve in enumerate(curves):
        if systems[curve_index].lower() == "drenaj":
            print(f"Processing curve {curve_index} with system 'drenaj'")
            for circle_index, circle in enumerate(circles):
                intersection_events = rg.Intersect.Intersection.CurveCurve(circle, curve, 0.001, 0.001)
                if intersection_events:
                    if len(intersection_events) > 0:  # Check if there are valid intersection events
                        print(f"Intersection found between curve {curve_index} and circle {circle_index}")
                        result[curve_index] = circle_index
                        break
    
    return result

# Inputs (ensure these are set correctly in Grasshopper)
input_circles = [x for x in input_circles if isinstance(x, rg.Curve)]
input_curves = [x for x in input_curves if isinstance(x, rg.Curve)]
input_systems = list(input_systems)

# Debugging: Print the number of circles, curves, and systems
print(f"Number of circles: {len(input_circles)}")
print(f"Number of curves: {len(input_curves)}")
print(f"Number of systems: {len(input_systems)}")

# Find intersecting circles for each drenaj curve
output_intersections = find_intersecting_circles(input_circles, input_curves, input_systems)

# Outputs
output_intersections
# ---------- end py3_22 ----------
item_11 = ListItem(List=panel_40, Index=py3_22.output_intersections, Wrap=True)
item_12 = ListItem(List=py3_21.processed_texts, Index=item_11, Wrap=True)

# ----
panel_42 = Panel(dispatch_6.ListA)

# ---- group: ELK DN
item_13 = ListItem(List=block, Index=panel_11, Wrap=True)
item_14 = ListItem(List=leader, Index=panel_21, Wrap=True)
leader_4 = Leader(Leader=item_14)  # -> Leader, Curve, Text, Plane
db_4 = DeconstructBlock(Block=item_13)  # -> Panda, Attributes, flatten(Name), Description, flatten(Base), Transform
pt_4 = Point(db_4.Base)
crv_10 = Curve(leader_4.Curve)
end_3 = EndPoints(Curve=crv_10)  # -> Start, End
pt_5 = Point(end_3.End)
boundrec = BoundingRectangle(Geometries=graft(crv_10), Inflate=True)  # -> flatten(Rectangle), Center, X, Y, Width, Height
crv_11 = Curve(boundrec.Rectangle)
panel_43 = Panel(panel_42)
cp_2 = ClosestPoint(Point=pt_5, Cloud=pt_4)  # -> ClosestPoint, CPIndex, Distance
getuv_2 = GetUserValue(Geometry=item_13, Key="SOGW")
panel_44 = Panel(cp_2.CPIndex)
panel_45 = Panel(getuv_2)
crv_12 = Curve(crv_6)
py3_23 = Python3Script(texts=panel_45)  # -> out, processed_texts; inputs texts: list of String
# ---------- py3_23: Python ----------
import ghpythonlib.treehelpers as th

def remove_before_C(texts):
    result = []
    for text in texts:
        # Find the index of 'C'
        index = text.find('DN')
        if index != -1:
            # Remove everything before and including 'C'
            result.append(text[index+2:])
        else:
            # If 'C' is not found, append the original text
            result.append(text)
    return result

# Example usage in Grasshopper
# Assume texts is a list of strings input into the Grasshopper Python component
texts = [str(x) for x in texts]  # Ensure all elements are strings

processed_texts = remove_before_C(texts)

# Output the processed texts
a = th.list_to_tree(processed_texts)
# ---------- end py3_23 ----------
py3_24 = Python3Script(input_circles=crv_11, input_curves=crv_12, input_systems=panel_43)  # -> out, output_intersections; inputs input_circles: list of Curve, input_curves: list of Curve, input_systems: list of String
# ---------- py3_24: Python ----------
import Rhino.Geometry as rg

def find_intersecting_circles(circles, curves, systems):
    result = [None] * len(curves)  # Initialize with None
    
    for curve_index, curve in enumerate(curves):
        if "ELK" in systems[curve_index]:
            print(f"Processing curve {curve_index} with system 'drenaj'")
            for circle_index, circle in enumerate(circles):
                intersection_events = rg.Intersect.Intersection.CurveCurve(circle, curve, 0.001, 0.001)
                if intersection_events:
                    if len(intersection_events) > 0:  # Check if there are valid intersection events
                        print(f"Intersection found between curve {curve_index} and circle {circle_index}")
                        result[curve_index] = circle_index
                        break
    
    return result

# Inputs (ensure these are set correctly in Grasshopper)
input_circles = [x for x in input_circles if isinstance(x, rg.Curve)]
input_curves = [x for x in input_curves if isinstance(x, rg.Curve)]
input_systems = list(input_systems)

# Debugging: Print the number of circles, curves, and systems
print(f"Number of circles: {len(input_circles)}")
print(f"Number of curves: {len(input_curves)}")
print(f"Number of systems: {len(input_systems)}")

# Find intersecting circles for each drenaj curve
output_intersections = find_intersecting_circles(input_circles, input_curves, input_systems)

# Outputs
output_intersections
# ---------- end py3_24 ----------
item_15 = ListItem(List=panel_44, Index=py3_24.output_intersections, Wrap=True)
item_16 = ListItem(List=py3_23.processed_texts, Index=item_15, Wrap=True)

# ----
getuv_3 = GetUserValue(Geometry=item, Key="CAPPS")

# ---- group: Rest of Curves / index list
lng_2 = ListLength(List=crv_3)
series = Series(Start=0, Step=1, Count=lng_2)

# ----
mindex = MemberIndex(Set=py3_19.output_classifications, Member="branch")  # -> Index, Count
panel_46 = Panel(getuv_3)

# ---- group: SEARCHES FOR TEXT AND GIVE COUNT AND INDEXES
py3_25 = Python3Script(x=panel_46, y="CAPPS")  # -> out, a, b; inputs x: list of String, y: list of String
# ---------- py3_25: Python ----------
def find_occurrences(string_list, search_strings):
    indexes = []
    for i, s in enumerate(string_list):
        if any(substring in s for substring in search_strings):
            indexes.append(i)
    count = len(indexes)
    return count, indexes

# Input x: List of strings
# Input y: List of substrings

# Ensure the inputs are properly set
if not isinstance(x, list):
    x = [x]
if not isinstance(y, list):
    y = [y]

# Get the count and indexes
count, indexes = find_occurrences(x, y)

# Output the results
a = count
b = indexes
# ---------- end py3_25 ----------
panel_47 = Panel(py3_25.b)
panel_48 = Panel(py3_25.a)

# ----
panel_49 = Panel(panel_38)
panel_50 = Panel(mindex.Index)
item_17 = ListItem(List=crv_6, Index=mindex.Index, Wrap=True)

# ---- group: Rest of Curves
cull_i = CullIndex(List=series, Indices=panel_36, Wrap=True)
item_18 = ListItem(List=crv_3, Index=cull_i, Wrap=True)
crv_13 = Curve(item_18)

# ----
panel_51 = Panel(pdecon.XComponent)
db_5 = DeconstructBlock(Block=item)  # -> Panda, Attributes, flatten(Name), Description, flatten(Base), Transform
rhatt_15 = GetRhinoAttributes(Geometry=item)  # -> Name, Layer, Color

# ---- group: REMOVES STRINGS
py3_26 = Python3Script(x=rhatt_15.Layer, y="-M-SHP-")  # -> out, flatten(a); inputs x: list of String
# ---------- py3_26: Python ----------
def remove_substring(string_list, substring):
    return [s.replace(substring, '') for s in string_list]

# Input x: List of strings
# Input y: Substring to be removed (in this case, "-TAVAN-")

# Ensure the inputs are properly set
if not isinstance(x, list):
    x = [x]
if not isinstance(y, str):
    y = str(y)

# Remove the substring from each string in the list
result = remove_substring(x, y)

# Output the results
a = result
# ---------- end py3_26 ----------
panel_52 = Panel(py3_26.a)

# ---- group: See SET
rhatt_16 = GetRhinoAttributes(Geometry=item)  # -> Name, Layer, Color
panel_53 = Panel(rhatt_15.Layer)
cset_3 = CreateSet(List=panel_53)  # -> Set, Map
panel_54 = Panel(cset_3.Set)

# ---- group: layerda TAVAN yazanlar ( egimli )
rhatt_17 = GetRhinoAttributes(Geometry=crv_13)  # -> Name, Layer, Color
panel_55 = Panel(rhatt_17.Layer)
py3_27 = Python3Script(x=panel_55)  # -> out, a; inputs x: list of String
# ---------- py3_27: Python ----------
# Ensure the input is treated as a list
layer_names = list(x)

# Initialize an empty list to store the indices
indices = []

# Iterate through the list of layer names
for i, name in enumerate(layer_names):
    # Check if 'CAP' is in the layer name
    if 'TAVAN' in name:
        indices.append(i)

# Assign the result to the output parameter
a = indices
# ---------- end py3_27 ----------
panel_56 = Panel(py3_27.a)
item_19 = ListItem(List=crv_13, Index=panel_56, Wrap=True)
crv_14 = Curve(item_19)

# ----
panel_57 = Panel(pdecon.YComponent)

# ---- group: ELK DN / ELK DIAMETERS
elk = Panel(item_16)

# ---- group: REMOVES STRINGS
py3_28 = Python3Script(x=panel_46, y="%%C")  # -> out, flatten(a); inputs x: list of String; same code as py3_26
panel_58 = Panel(py3_28.a)

# ---- group: DRENAJ DN / DRENAJ DIAMETERS
panel_59 = Panel(item_12)

# ----
panel_60 = Panel(pdecon_2.XComponent)
txt = Text(["pX", "pY"])
txt_2 = Text(["pX", "pY"])
panel_61 = Panel(txt)
panel_62 = Panel(txt_2)

# ---- group: Rest of Curves / index list
lng_3 = ListLength(List=crv_13)
series_2 = Series(Start=0, Step=1, Count=lng_3)

# ----
leader_curves = Curve(crv_7)
block_points = Point(db_5.Base)
panel_63 = Panel(pdecon_2.YComponent)
txt_3 = Text(["pX", "pY"])
larger_3 = LargerThan(FirstNumber=elk, SecondNumber=0)  # -> LargerThan, OrEqualTo
larger_4 = LargerThan(FirstNumber=panel_59, SecondNumber=0)  # -> LargerThan, OrEqualTo
sph = Sphere(Base=block_points, Radius=25)
py3_29 = Python3Script(leader_curves=leader_curves, block_points=block_points, block_spheres=sph)  # -> out, a; inputs leader_curves: list of Curve, block_points: list of Point3d, block_spheres: list of Brep
# ---------- py3_29: Python ----------
import rhinoscriptsyntax as rs
import Rhino.Geometry as rg

def set_z_to_zero(point):
    """Helper function to set the z-coordinate of a point to 0."""
    return rg.Point3d(point.X, point.Y, 0)

def find_output_points(leader_curves, block_points, block_spheres, tolerance=0.1):
    output_points = []

    for block_index, sphere in enumerate(block_spheres):
        block_point = set_z_to_zero(block_points[block_index])
        found_leader_point = False

        # Check if any leader curve endpoint is within the sphere
        for leader in leader_curves:
            start_point = set_z_to_zero(rs.CurveStartPoint(leader))
            end_point = set_z_to_zero(rs.CurveEndPoint(leader))

            if sphere.IsPointInside(start_point, tolerance, True):
                output_points.append(end_point)
                found_leader_point = True
                print(f"Sphere at index {block_index} contains start point of leader curve. Adding end point {end_point} as output.")
                break
            elif sphere.IsPointInside(end_point, tolerance, True):
                output_points.append(start_point)
                found_leader_point = True
                print(f"Sphere at index {block_index} contains end point of leader curve. Adding start point {start_point} as output.")
                break

        if not found_leader_point:
            output_points.append(block_point)
            print(f"Sphere at index {block_index} contains no leader curve point. Adding block point {block_point} as output.")

    return output_points

# Inputs
# leader_curves: List of leader curve GUIDs
# block_points: List of block point coordinates
# block_spheres: List of block point spheres (breps)
# tolerance: Tolerance for containment and intersection checks

# Ensure the inputs are properly set
if not isinstance(leader_curves, list):
    leader_curves = [leader_curves]
if not isinstance(block_points, list):
    block_points = [block_points]
if not isinstance(block_spheres, list):
    block_spheres = [block_spheres]

# Convert block points to Breps if necessary
block_spheres = [rg.Brep.TryConvertBrep(sphere) if not isinstance(sphere, rg.Brep) else sphere for sphere in block_spheres]

# Debug prints for inputs
print("Leader Curves:", leader_curves)
print("Block Points:", block_points)
print("Block Spheres:", block_spheres)

# Get the output points
output_points = find_output_points(leader_curves, block_points, block_spheres, tolerance=0.1)

# Output the results
a = output_points
# ---------- end py3_29 ----------
panel_64 = Panel(txt_3)

# ---- group: Rest of Curves
cull_i_2 = CullIndex(List=series_2, Indices=panel_56, Wrap=True)
item_20 = ListItem(List=crv_13, Index=cull_i_2, Wrap=True)
crv_15 = Curve(item_20)

# ---- group: REMOVES STRINGS
py3_30 = Python3Script(x=panel_58, y="DN")  # -> out, flatten(a); inputs x: list of String; same code as py3_26
panel_65 = Panel(py3_30.a)

# ----
mindex_2 = MemberIndex(Set=larger_3.LargerThan, Member=Toggle(True))  # -> Index, Count
item_21 = ListItem(List=elk, Index=mindex_2.Index, Wrap=True)
mindex_3 = MemberIndex(Set=larger_4.LargerThan, Member=Toggle(True))  # -> Index, Count
item_22 = ListItem(List=panel_59, Index=mindex_3.Index, Wrap=True)
number_slider = Slider(107, range=0..1600)
panel_66 = Panel(py3_19.output_classifications)
panel_67 = Panel(py3_29.a)

# ---- group: REMOVES STRINGS
py3_31 = Python3Script(x=panel_52, y="-M-SHP-")  # -> out, flatten(a); inputs x: list of String; same code as py3_26
panel_68 = Panel(py3_31.a)

# ----
pt_6 = Point(py3_29.a)

# ---- group: Borular
list_6 = ValueList({"Point": 0, "Curve": 1, "Arc": 2, "Circle": 3, "Ellipse": 4, "Line": 5, "Polyline": 6, "Surface": 7, "Brep": 8, "Mesh": 9, "Polysurface": 10, "Block": 11, "Text": 12, "TextDot": 13, "Dimension": 14, "LinearDimension": 15, "AngularDimension": 16, "Hatch": 17, "Leader": 18}, selected="Line")
filtertype_6 = FilterByType(Geometry=crv_14, ObjectType=list_6)
clean_6 = CleanTree(RemoveNulls=True, RemoveInvalid=True, RemoveEmpty=False, Tree=filtertype_6)
crv_16 = Curve(clean_6)

# ---- group: CCO'lar
list_7 = ValueList({"Point": 0, "Curve": 1, "Arc": 2, "Circle": 3, "Ellipse": 4, "Line": 5, "Polyline": 6, "Surface": 7, "Brep": 8, "Mesh": 9, "Polysurface": 10, "Block": 11, "Text": 12, "TextDot": 13, "Dimension": 14, "LinearDimension": 15, "AngularDimension": 16, "Hatch": 17, "Leader": 18}, selected="Polyline")
filtertype_7 = FilterByType(Geometry=crv_14, ObjectType=list_7)
clean_7 = CleanTree(RemoveNulls=True, RemoveInvalid=True, RemoveEmpty=False, Tree=filtertype_7)
crv_17 = Curve(clean_7)

# ----
item_23 = ListItem(List=crv_6, Index=476, Wrap=True)

# ---- group: layerda PW yazanlar ( basincli )
rhatt_18 = GetRhinoAttributes(Geometry=crv_15)  # -> Name, Layer, Color
panel_69 = Panel(rhatt_18.Layer)
py3_32 = Python3Script(x=panel_69)  # -> out, a; inputs x: list of String
# ---------- py3_32: Python ----------
# Ensure the input is treated as a list
layer_names = list(x)

# Initialize an empty list to store the indices
indices = []

# Iterate through the list of layer names
for i, name in enumerate(layer_names):
    # Check if 'CAP' is in the layer name
    if 'PW' in name:
        indices.append(i)

# Assign the result to the output parameter
a = indices
# ---------- end py3_32 ----------
panel_70 = Panel(py3_32.a)
item_24 = ListItem(List=crv_15, Index=panel_70, Wrap=True)
crv_18 = Curve(item_24)

# ----
item_25 = ListItem(List=py3_29.a, Index=number_slider, Wrap=True)
item_26 = ListItem(List=sph, Index=number_slider, Wrap=True)
pdecon_3 = Deconstruct(Point=pt_6)  # -> XComponent, YComponent, ZComponent
texts = Text(["ZONE", "SystemType", "SystemName", "StartX", "StartY", "EndX", "EndY", "Position", "Diameters"])
panel_71 = Panel(texts)

# ---- group: See SET
rhatt_19 = GetRhinoAttributes(Geometry=crv_16)  # -> Name, Layer, Color
panel_72 = Panel(rhatt_19.Layer)
cset_4 = CreateSet(List=panel_72)  # -> Set, Map
panel_73 = Panel(cset_4.Set)

# ---- group: Rest of Curves / index list
lng_4 = ListLength(List=crv_15)
series_3 = Series(Start=0, Step=1, Count=lng_4)

# ----
boundrec_2 = BoundingRectangle(Geometries=graft(crv_17))  # -> Rectangle, flatten(Center), X, Y, Width, Height
end_4 = EndPoints(Curve=crv_16)  # -> Start, End

# ---- group: Rest of Curves
cull_i_3 = CullIndex(List=series_3, Indices=panel_70, Wrap=True)
item_27 = ListItem(List=crv_15, Index=cull_i_3, Wrap=True)
crv_19 = Curve(item_27)

# ----
pdecon_4 = Deconstruct(Point=end_4.Start)  # -> XComponent, YComponent, ZComponent
pdecon_5 = Deconstruct(Point=end_4.End)  # -> XComponent, YComponent, ZComponent
pt_7 = Point(boundrec_2.Center)

# ---- group: Borular
list_8 = ValueList({"Point": 0, "Curve": 1, "Arc": 2, "Circle": 3, "Ellipse": 4, "Line": 5, "Polyline": 6, "Surface": 7, "Brep": 8, "Mesh": 9, "Polysurface": 10, "Block": 11, "Text": 12, "TextDot": 13, "Dimension": 14, "LinearDimension": 15, "AngularDimension": 16, "Hatch": 17, "Leader": 18}, selected="Line")
filtertype_8 = FilterByType(Geometry=crv_18, ObjectType=list_8)
clean_8 = CleanTree(RemoveNulls=True, RemoveInvalid=True, RemoveEmpty=False, Tree=filtertype_8)
crv_20 = Curve(clean_8)

# ---- group: REMOVES STRINGS
py3_33 = Python3Script(x=panel_72, y="-TAVAN-")  # -> out, flatten(a); inputs x: list of String; same code as py3_26
panel_74 = Panel(py3_33.a)

# ---- group: Circles ( Risers )
list_9 = ValueList({"Point": 0, "Curve": 1, "Arc": 2, "Circle": 3, "Ellipse": 4, "Line": 5, "Polyline": 6, "Surface": 7, "Brep": 8, "Mesh": 9, "Polysurface": 10, "Block": 11, "Text": 12, "TextDot": 13, "Dimension": 14, "LinearDimension": 15, "AngularDimension": 16, "Hatch": 17, "Leader": 18}, selected="Circle")
filtertype_9 = FilterByType(Geometry=crv_19, ObjectType=list_9)
clean_9 = CleanTree(RemoveNulls=True, RemoveInvalid=True, RemoveEmpty=False, Tree=filtertype_9)
crv_21 = Curve(clean_9)

# ----
pdecon_6 = Deconstruct(Point=pt_7)  # -> XComponent, YComponent, ZComponent

# ---- group: REST
cull_null = CullNull(List=filtertype_9)  # -> Cull, NullIndex
item_28 = ListItem(List=crv_19, Index=cull_null.NullIndex, Wrap=True)

# ---- group: REMOVES STRINGS
py3_34 = Python3Script(x=panel_74, y="-M-SHP-")  # -> out, flatten(a); inputs x: list of String; same code as py3_26
panel_75 = Panel(py3_34.a)

# ---- group: See SET
rhatt_20 = GetRhinoAttributes(Geometry=crv_20)  # -> Name, Layer, Color
panel_76 = Panel(rhatt_20.Layer)
cset_5 = CreateSet(List=panel_76)  # -> Set, Map
panel_77 = Panel(cset_5.Set)

# ----
txt_4 = Text(["pX", "pY"])
panel_78 = Panel(txt_4)

# ---- group: BE sure All filtered
lng_5 = ListLength(List=crv_19)
lng_6 = ListLength(List=[item_28, crv_21])
ma = MassAddition(Input=flatten(lng_6))  # -> Result, PartialResults
equals = Equality(FirstNumber=lng_5, SecondNumber=ma.Result)  # -> Equality, Inequality
panel_79 = Panel(equals.Equality)

# ----
txt_5 = Text(["StartX", "StartY", "EndX", "EndY", "System"])
entwine = Entwine(Branch00=pdecon_6.XComponent, Branch01=pdecon_6.YComponent, FlattenInputs=True)
panel_80 = Panel(txt_5)
csv = CreateCSV(DataGridHeaders=panel_78, ValueTree=entwine, Delimiter=",")

# ---- group: REMOVES STRINGS
py3_35 = Python3Script(x=panel_76, y="-TAVAN-")  # -> out, flatten(a); inputs x: list of String; same code as py3_26
panel_81 = Panel(py3_35.a)

# ----
entwine_2 = Entwine(
    Branch00=pdecon_4.XComponent,
    Branch01=pdecon_4.YComponent,
    Branch02=pdecon_5.XComponent,
    Branch03=pdecon_5.YComponent,
    Branch04=panel_75,
    FlattenInputs=True)
csv_2 = CreateCSV(DataGridHeaders=panel_80, ValueTree=entwine_2, Delimiter=",")
curves = Panel(csv)
txt_6 = Text(["pX", "pY", "Size", "System"])
curves_2 = Panel(csv_2)
panel_82 = Panel(txt_6)
end_5 = EndPoints(Curve=crv_20)  # -> Start, End

# ---- group: REMOVES STRINGS
py3_36 = Python3Script(x=panel_81, y="-M-SHP-")  # -> out, flatten(a); inputs x: list of String; same code as py3_26
panel_83 = Panel(py3_36.a)

# ----
pdecon_7 = Deconstruct(Point=end_5.Start)  # -> XComponent, YComponent, ZComponent
pdecon_8 = Deconstruct(Point=end_5.End)  # -> XComponent, YComponent, ZComponent
entwine_3 = Entwine(Branch00=pdecon_3.XComponent, Branch01=pdecon_3.YComponent, Branch02=panel_65, Branch03=panel_68, FlattenInputs=True)
csv_3 = CreateCSV(DataGridHeaders=panel_82, ValueTree=entwine_3, Delimiter=",")
txt_7 = Text(["StartX", "StartY", "EndX", "EndY", "System"])
curves_3 = Panel(csv_3)
panel_84 = Panel(txt_7)
entwine_4 = Entwine(
    Branch00=pdecon_7.XComponent,
    Branch01=pdecon_7.YComponent,
    Branch02=pdecon_8.XComponent,
    Branch03=pdecon_8.YComponent,
    Branch04=panel_83,
    FlattenInputs=True)
csv_4 = CreateCSV(DataGridHeaders=panel_84, ValueTree=entwine_4, Delimiter=",")
curves_4 = Panel(csv_4)

# ---- group: NOT ELK DN
item_29 = ListItem(List=block, Index=panel_13, Wrap=True)
item_30 = ListItem(List=leader, Index=panel_23, Wrap=True)
leader_5 = Leader(Leader=item_30)  # -> Leader, Curve, Text, Plane
db_6 = DeconstructBlock(Block=item_29)  # -> Panda, Attributes, flatten(Name), Description, flatten(Base), Transform
pt_8 = Point(db_6.Base)
crv_22 = Curve(leader_5.Curve)
end_6 = EndPoints(Curve=crv_22)  # -> Start, End
pt_9 = Point(end_6.End)
panel_85 = Panel(panel_42)
getuv_4 = GetUserValue(Geometry=item_29, Key="ISIW")
cp_3 = ClosestPoint(Point=pt_9, Cloud=pt_8)  # -> ClosestPoint, CPIndex, Distance
panel_86 = Panel(cp_3.CPIndex)
panel_87 = Panel(getuv_4)
crv_23 = Curve(crv_6)
py3_37 = Python3Script(texts=panel_87)  # -> out, processed_texts; inputs texts: list of String; same code as py3_23

# ----
cir_3 = Circle(Plane=end_6.Start, Radius=350)

# ---- group: NOT ELK DN (continued)
crv_24 = Curve(cir_3)
py3_38 = Python3Script(input_circles=crv_24, input_curves=crv_23, input_systems=panel_85)  # -> out, output_intersections; inputs input_circles: list of Curve, input_curves: list of Curve, input_systems: list of String
# ---------- py3_38: Python ----------
import Rhino.Geometry as rg

def find_intersecting_circles(circles, curves, systems):
    result = [None] * len(curves)  # Initialize with None
    
    for curve_index, curve in enumerate(curves):
        if 'ISSO' in systems[curve_index]:
            print(f"Processing curve {curve_index} with system 'drenaj'")
            for circle_index, circle in enumerate(circles):
                intersection_events = rg.Intersect.Intersection.CurveCurve(circle, curve, 0.001, 0.001)
                if intersection_events:
                    if len(intersection_events) > 0:  # Check if there are valid intersection events
                        print(f"Intersection found between curve {curve_index} and circle {circle_index}")
                        result[curve_index] = circle_index
                        break
    
    return result

# Inputs (ensure these are set correctly in Grasshopper)
input_circles = [x for x in input_circles if isinstance(x, rg.Curve)]
input_curves = [x for x in input_curves if isinstance(x, rg.Curve)]
input_systems = list(input_systems)

# Debugging: Print the number of circles, curves, and systems
print(f"Number of circles: {len(input_circles)}")
print(f"Number of curves: {len(input_curves)}")
print(f"Number of systems: {len(input_systems)}")

# Find intersecting circles for each drenaj curve
output_intersections = find_intersecting_circles(input_circles, input_curves, input_systems)

# Outputs
output_intersections
# ---------- end py3_38 ----------
item_31 = ListItem(List=panel_86, Index=py3_38.output_intersections, Wrap=True)
item_32 = ListItem(List=py3_37.processed_texts, Index=item_31, Wrap=True)

# ---- group: NOT ELK DN / NOT ELK DIAMETERS
not_elk = Panel(item_32)

# ----
larger_5 = LargerThan(FirstNumber=not_elk, SecondNumber=0)  # -> LargerThan, OrEqualTo
mindex_4 = MemberIndex(Set=larger_5.LargerThan, Member=Toggle(True))  # -> Index, Count
item_33 = ListItem(List=not_elk, Index=mindex_4.Index, Wrap=True)

# ---- group: AHU PIPE DN
item_34 = ListItem(List=block, Index=panel_15, Wrap=True)
item_35 = ListItem(List=leader, Index=panel_25, Wrap=True)
db_7 = DeconstructBlock(Block=item_34)  # -> Panda, Attributes, flatten(Name), Description, flatten(Base), Transform
pt_10 = Point(db_7.Base)
panel_88 = Panel(panel_42)
getuv_5 = GetUserValue(Geometry=item_34, Key="ISIW")
panel_89 = Panel(getuv_5)
crv_25 = Curve(crv_6)
py3_39 = Python3Script(texts=panel_89)  # -> out, processed_texts; inputs texts: list of String; same code as py3_23

# ----
leader_6 = Leader(Leader=item_35)  # -> Leader, Curve, Text, Plane
crv_26 = Curve(leader_6.Curve)
end_7 = EndPoints(Curve=crv_26)  # -> Start, End
boundrec_3 = BoundingRectangle(Geometries=graft(crv_26), Inflate=True)  # -> flatten(Rectangle), Center, X, Y, Width, Height

# ---- group: AHU PIPE DN (continued)
end_8 = EndPoints(Curve=crv_26)  # -> Start, End
pt_11 = Point(end_8.End)
crv_27 = Curve(boundrec_3.Rectangle)
cp_4 = ClosestPoint(Point=pt_11, Cloud=pt_10)  # -> ClosestPoint, CPIndex, Distance
panel_90 = Panel(cp_4.CPIndex)
py3_40 = Python3Script(input_circles=crv_27, input_curves=crv_25, input_systems=panel_88)  # -> out, output_intersections; inputs input_circles: list of Curve, input_curves: list of Curve, input_systems: list of String
# ---------- py3_40: Python ----------
import Rhino.Geometry as rg

def find_intersecting_circles(circles, curves, systems):
    result = [None] * len(curves)  # Initialize with None
    
    for curve_index, curve in enumerate(curves):
        if 'PIPE' in systems[curve_index]:
            print(f"Processing curve {curve_index} with system 'drenaj'")
            for circle_index, circle in enumerate(circles):
                intersection_events = rg.Intersect.Intersection.CurveCurve(circle, curve, 0.001, 0.001)
                if intersection_events:
                    if len(intersection_events) > 0:  # Check if there are valid intersection events
                        print(f"Intersection found between curve {curve_index} and circle {circle_index}")
                        result[curve_index] = circle_index
                        break
    
    return result

# Inputs (ensure these are set correctly in Grasshopper)
input_circles = [x for x in input_circles if isinstance(x, rg.Curve)]
input_curves = [x for x in input_curves if isinstance(x, rg.Curve)]
input_systems = list(input_systems)

# Debugging: Print the number of circles, curves, and systems
print(f"Number of circles: {len(input_circles)}")
print(f"Number of curves: {len(input_curves)}")
print(f"Number of systems: {len(input_systems)}")

# Find intersecting circles for each drenaj curve
output_intersections = find_intersecting_circles(input_circles, input_curves, input_systems)

# Outputs
output_intersections
# ---------- end py3_40 ----------
item_36 = ListItem(List=panel_90, Index=py3_40.output_intersections, Wrap=True)
item_37 = ListItem(List=py3_39.processed_texts, Index=item_36, Wrap=True)
ahu_pipe_diameters = Panel(item_37)

# ----
pt_12 = Point(end_8.Start)

# ---- group: AHU PIPE DN
item_38 = ListItem(List=block, Index=panel_19, Wrap=True)
item_39 = ListItem(List=crv_4, Index=panel_29, Wrap=True)
db_8 = DeconstructBlock(Block=item_38)  # -> Panda, Attributes, flatten(Name), Description, flatten(Base), Transform
pt_13 = Point(db_8.Base)
crv_28 = Curve(item_39)
end_9 = EndPoints(Curve=crv_28)  # -> Start, End
pt_14 = Point(end_9.End)
boundrec_4 = BoundingRectangle(Geometries=graft(crv_28), Inflate=True)  # -> flatten(Rectangle), Center, X, Y, Width, Height
crv_29 = Curve(boundrec_4.Rectangle)
panel_91 = Panel(panel_42)
getuv_6 = GetUserValue(Geometry=item_38, Key="ISIW")
panel_92 = Panel(getuv_6)
crv_30 = Curve(crv_6)
py3_41 = Python3Script(texts=panel_92)  # -> out, processed_texts; inputs texts: list of String; same code as py3_23
py3_42 = Python3Script(input_circles=crv_29, input_curves=crv_30, input_systems=panel_91)  # -> out, output_intersections; inputs input_circles: list of Curve, input_curves: list of Curve, input_systems: list of String; same code as py3_40

# ----
item_40 = ListItem(List=db_8.Base, Index=0, Wrap=True)
pt_15 = Point(end_9.Start)

# ---- group: AHU PIPE DN (continued)
cp_5 = ClosestPoint(Point=pt_15, Cloud=pt_13)  # -> ClosestPoint, CPIndex, Distance
panel_93 = Panel(cp_5.CPIndex)
item_41 = ListItem(List=panel_93, Index=py3_42.output_intersections, Wrap=True)
item_42 = ListItem(List=py3_41.processed_texts, Index=item_41, Wrap=True)
ahu_pipe_diameters_2 = Panel(item_42)

# ----
replace = ReplaceItems(List=ahu_pipe_diameters_2, Item=item_33, Indices=mindex_4.Index, Wrap=False)  # -> flatten(List)
replace_2 = ReplaceItems(List=replace, Item=item_21, Indices=mindex_2.Index, Wrap=False)  # -> flatten(List)
replace_3 = ReplaceItems(List=replace_2, Item=item_22, Indices=mindex_3.Index, Wrap=False)  # -> flatten(List)
nullrep = ReplaceNulls(Items=replace_3, Replacements=0)  # -> Items, Count
panel_94 = Panel(replace)
panel_95 = Panel(nullrep.Items)
panel_96 = Panel(replace_2)
panel_97 = Panel(replace_3)
panel_98 = Panel(nullrep.Items)
entwine_5 = Entwine(
    Branch00=panel_37,
    Branch01=panel_42,
    Branch02=panel_49,
    Branch03=panel_51,
    Branch04=panel_57,
    Branch05=panel_60,
    Branch06=panel_63,
    Branch07=panel_66,
    Branch08=panel_95,
    FlattenInputs=True)
csv_5 = CreateCSV(DataGridHeaders=panel_71, ValueTree=entwine_5, Delimiter=",")
curves_5 = Panel(csv_5)

# ==== cluster Cluster
pt = ClusterInput()
pt_2 = Point(pt)

# ---- group: L04 / ZONE-Selector
crv_zone4 = Curve(<curve referenced from the Rhino model>)
crv_zone1 = Curve(<curve referenced from the Rhino model>)
crv_zone2 = Curve(<curve referenced from the Rhino model>)
crv_zone3 = Curve(<curve referenced from the Rhino model>)
crv_zone5 = Curve(<curve referenced from the Rhino model>)
weave = Weave(
    Pattern=[0, 1, 2, 3, 4],
    Stream0=crv_zone1,
    Stream1=crv_zone2,
    Stream2=crv_zone3,
    Stream3=crv_zone4,
    Stream4=crv_zone5,
    NullGaps=False)

# ---- group: L05 / ZONE-Selector
crv_zone4_2 = Curve(<curve referenced from the Rhino model>)
crv_zone1_2 = Curve(<curve referenced from the Rhino model>)
crv_zone2_2 = Curve(<curve referenced from the Rhino model>)
crv_zone3_2 = Curve(crv_zone3)
crv_zone5_2 = Curve(<curve referenced from the Rhino model>)
weave_2 = Weave(
    Pattern=[0, 1, 2, 3, 4],
    Stream0=crv_zone1_2,
    Stream1=crv_zone2_2,
    Stream2=crv_zone3_2,
    Stream3=crv_zone4_2,
    Stream4=crv_zone5_2,
    NullGaps=False)

# ---- group: L06 / ZONE-Selector
crv_zone4_3 = Curve(<curve referenced from the Rhino model>)
crv_zone1_3 = Curve(<curve referenced from the Rhino model>)
crv_zone2_3 = Curve(<curve referenced from the Rhino model>)
crv_zone3_3 = Curve(crv_zone3_2)
crv_zone5_3 = Curve(<curve referenced from the Rhino model>)
weave_3 = Weave(
    Pattern=[0, 1, 2, 3, 4],
    Stream0=crv_zone1_3,
    Stream1=crv_zone2_3,
    Stream2=crv_zone3_3,
    Stream3=crv_zone4_3,
    Stream4=crv_zone5_3,
    NullGaps=False)

# ---- group: L07 / ZONE-Selector
crv_zone4_4 = Curve(crv_zone4_3)
crv_zone1_4 = Curve(crv_zone1_3)
crv_zone2_4 = Curve(<curve referenced from the Rhino model>)
crv_zone3_4 = Curve(crv_zone3_3)
crv_zone5_4 = Curve(<curve referenced from the Rhino model>)
weave_4 = Weave(
    Pattern=[0, 1, 2, 3, 4],
    Stream0=crv_zone1_4,
    Stream1=crv_zone2_4,
    Stream2=crv_zone3_4,
    Stream3=crv_zone4_4,
    Stream4=crv_zone5_4,
    NullGaps=False)

# ---- group: L03 / ZONE-Selector
crv_zone4_5 = Curve(<curve referenced from the Rhino model>)
crv_zone1_5 = Curve(<curve referenced from the Rhino model>)
crv_zone2_5 = Curve(<curve referenced from the Rhino model>)
crv_zone3_5 = Curve(<curve referenced from the Rhino model>)
crv_zone5_5 = Curve(<curve referenced from the Rhino model>)
weave_5 = Weave(
    Pattern=[0, 1, 2, 3, 4],
    Stream0=crv_zone1_5,
    Stream1=crv_zone2_5,
    Stream2=crv_zone3_5,
    Stream3=crv_zone4_5,
    Stream4=crv_zone5_5,
    NullGaps=False)

# ---- group: L02 / ZONE-Selector
crv_zone4_6 = Curve(<curve referenced from the Rhino model>)
crv_zone1_6 = Curve(<curve referenced from the Rhino model>)
crv_zone2_6 = Curve(<curve referenced from the Rhino model>)
crv_zone3_6 = Curve(<curve referenced from the Rhino model>)
crv_zone5_6 = Curve(<curve referenced from the Rhino model>)
weave_6 = Weave(
    Pattern=[0, 1, 2, 3, 4],
    Stream0=crv_zone1_6,
    Stream1=crv_zone2_6,
    Stream2=crv_zone3_6,
    Stream3=crv_zone4_6,
    Stream4=crv_zone5_6,
    NullGaps=False)

# ---- group: L01 / ZONE-Selector
crv_zone1_7 = Curve(<curve referenced from the Rhino model>)
crv_zone4_7 = Curve(<curve referenced from the Rhino model>)
crv_zone2_7 = Curve(<curve referenced from the Rhino model>)
crv_zone3_7 = Curve(<curve referenced from the Rhino model>)
crv_zone5_7 = Curve(<curve referenced from the Rhino model>)
weave_7 = Weave(
    Pattern=[0, 1, 2, 3, 4],
    Stream0=crv_zone1_7,
    Stream1=crv_zone2_7,
    Stream2=crv_zone3_7,
    Stream3=crv_zone4_7,
    Stream4=crv_zone5_7,
    NullGaps=False)

# ---- group: LB1 / ZONE-Selector
crv_zone4_8 = Curve(<curve referenced from the Rhino model>)
crv_zone1_8 = Curve(<curve referenced from the Rhino model>)
crv_zone2_8 = Curve(<curve referenced from the Rhino model>)
crv_zone3_8 = Curve(<curve referenced from the Rhino model>)
crv_zone5_8 = Curve(<curve referenced from the Rhino model>)
weave_8 = Weave(
    Pattern=[0, 1, 2, 3, 4],
    Stream0=crv_zone1_8,
    Stream1=crv_zone2_8,
    Stream2=crv_zone3_8,
    Stream3=crv_zone4_8,
    Stream4=crv_zone5_8,
    NullGaps=False)

# ---- group: L07 / Find Zone
pt_3 = Point(pt_2)
weave_9 = Weave(
    Pattern=[0, 1, 2, 3, 4],
    Stream0="ZON-1",
    Stream1="ZON-2",
    Stream2="ZON-3",
    Stream3="ZON-4",
    Stream4="ZON-5",
    NullGaps=False)
incurves = PointInCurves(Point=pt_3, Curves=weave_4)  # -> Relationship, Index, Point
item = ListItem(List=weave_9, Index=incurves.Index, Wrap=True)

# ---- group: L06 / Find Zone
pt_4 = Point(pt_2)
weave_10 = Weave(
    Pattern=[0, 1, 2, 3, 4],
    Stream0="ZON-1",
    Stream1="ZON-2",
    Stream2="ZON-3",
    Stream3="ZON-4",
    Stream4="ZON-5",
    NullGaps=False)
incurves_2 = PointInCurves(Point=pt_4, Curves=weave_3)  # -> Relationship, Index, Point
item_2 = ListItem(List=weave_10, Index=incurves_2.Index, Wrap=True)

# ---- group: L04 / Find Zone
pt_5 = Point(pt_2)
weave_11 = Weave(
    Pattern=[0, 1, 2, 3, 4],
    Stream0="ZON-1",
    Stream1="ZON-2",
    Stream2="ZON-3",
    Stream3="ZON-4",
    Stream4="ZON-5",
    NullGaps=False)
incurves_3 = PointInCurves(Point=pt_5, Curves=weave)  # -> Relationship, Index, Point
item_3 = ListItem(List=weave_11, Index=incurves_3.Index, Wrap=True)

# ---- group: L05 / Find Zone
pt_6 = Point(pt_2)
weave_12 = Weave(
    Pattern=[0, 1, 2, 3, 4],
    Stream0="ZON-1",
    Stream1="ZON-2",
    Stream2="ZON-3",
    Stream3="ZON-4",
    Stream4="ZON-5",
    NullGaps=False)
incurves_4 = PointInCurves(Point=pt_6, Curves=weave_2)  # -> Relationship, Index, Point
item_4 = ListItem(List=weave_12, Index=incurves_4.Index, Wrap=True)

# ---- group: L03 / Find Zone
pt_7 = Point(pt_2)
weave_13 = Weave(
    Pattern=[0, 1, 2, 3, 4],
    Stream0="ZON-1",
    Stream1="ZON-2",
    Stream2="ZON-3",
    Stream3="ZON-4",
    Stream4="ZON-5",
    NullGaps=False)
incurves_5 = PointInCurves(Point=pt_7, Curves=weave_5)  # -> Relationship, Index, Point
item_5 = ListItem(List=weave_13, Index=incurves_5.Index, Wrap=True)

# ---- group: L01 / Find Zone
pt_8 = Point(pt_2)
weave_14 = Weave(
    Pattern=[0, 1, 2, 3, 4],
    Stream0="ZON-1",
    Stream1="ZON-2",
    Stream2="ZON-3",
    Stream3="ZON-4",
    Stream4="ZON-5",
    NullGaps=False)
incurves_6 = PointInCurves(Point=pt_8, Curves=weave_7)  # -> Relationship, Index, Point
item_6 = ListItem(List=weave_14, Index=incurves_6.Index, Wrap=True)

# ---- group: L02 / Find Zone
pt_9 = Point(pt_2)
weave_15 = Weave(
    Pattern=[0, 1, 2, 3, 4],
    Stream0="ZON-1",
    Stream1="ZON-2",
    Stream2="ZON-3",
    Stream3="ZON-4",
    Stream4="ZON-5",
    NullGaps=False)
incurves_7 = PointInCurves(Point=pt_9, Curves=weave_6)  # -> Relationship, Index, Point
item_7 = ListItem(List=weave_15, Index=incurves_7.Index, Wrap=True)

# ---- group: LB1 / Find Zone
pt_10 = Point(pt_2)
weave_16 = Weave(
    Pattern=[0, 1, 2, 3, 4],
    Stream0="ZON-1",
    Stream1="ZON-2",
    Stream2="ZON-3",
    Stream3="ZON-4",
    Stream4="ZON-5",
    NullGaps=False)
incurves_8 = PointInCurves(Point=pt_10, Curves=weave_8)  # -> Relationship, Index, Point
item_8 = ListItem(List=weave_16, Index=incurves_8.Index, Wrap=True)

# ----
P = ClusterInput()
weave_17 = Weave(
    Pattern=P,
    Stream0=item_8,
    Stream1=item_6,
    Stream2=item_7,
    Stream3=item_5,
    Stream4=item_3,
    Stream5=item_4,
    Stream6=item_2,
    Stream7=item,
    NullGaps=False)
W = ClusterOutput(weave_17)
