# Grasshopper definition P2-create-EXCEL-data-T1.gh (Grasshopper 1.0.8)
# plug-ins: EleFront, LunchBox

crv = Curve(graft([<curve referenced from the Rhino model> x16]))
explode = Explode(Curve=crv, Recursive=True)  # -> flatten(Segments), Vertices
crv_2 = Curve(explode.Segments)
len = Length(Curve=crv_2)
smaller = SmallerThan(FirstNumber=len, SecondNumber=500)  # -> SmallerThan, OrEqualTo
dispatch = Dispatch(List=crv_2, DispatchPattern=smaller.SmallerThan)  # -> ListA, ListB
Z = UnitZ(Factor=1050)
crv_3 = Curve(dispatch.ListB)
extr = Extrude(Base=crv_3, Direction=Z)
srf = Surface(extr)
planar = IsPlanar(Surface=srf, Interior=True)  # -> Planar, Plane
mindex = MemberIndex(Set=planar.Planar, Member=Toggle(False))  # -> Index, Count
mindex_2 = MemberIndex(Set=planar.Planar, Member=Toggle(True))  # -> Index, Count
item = ListItem(List=srf, Index=mindex.Index, Wrap=True)
item_2 = ListItem(List=srf, Index=mindex_2.Index, Wrap=True)
rhatt = GetRhinoAttributes(Geometry=item_2)  # -> Name, Layer, Color
srf_2 = Surface(item)
rhatt_2 = GetRhinoAttributes(Geometry=srf_2)  # -> Name, Layer, Color
srf_3 = Surface(item_2)
chars = Characters(Text=rhatt.Layer)  # -> Result, Unicode
debrep = DeconstructBrep(Brep=srf_2)  # -> Faces, Edges, Vertices
pt = Point(debrep.Vertices)
ma = MassAddition(Input=pt)  # -> flatten(Result), PartialResults
division = Division(A=ma.Result, B=4)
pt_2 = Point(division)
chars_2 = Characters(Text=rhatt_2.Layer)  # -> Result, Unicode
panel = Panel(rhatt.Layer)
cull_i = CullIndex(List=chars.Result, Indices=0, Wrap=True)
debrep_2 = DeconstructBrep(Brep=srf_3)  # -> Faces, Edges, Vertices
crv_4 = Curve(debrep.Edges)
panel_2 = Panel(rhatt_2.Layer)
cull_i_2 = CullIndex(List=chars_2.Result, Indices=0, Wrap=True)
curvepoint = PointOnCurve(crv_4, parameter=0.504)
pt_3 = Point(debrep_2.Vertices)
pdecon = Deconstruct(Point=pt)  # -> XComponent, YComponent, ZComponent
srf_cp = SurfaceClosestPoint(Point=flatten(pt_2), Surface=srf_2)  # -> Point, UVPoint, Distance
sort = SortList(Keys=pdecon.ZComponent, ValuesA=pt)  # -> Keys, ValuesA
pdecon_2 = Deconstruct(Point=pt_3)  # -> XComponent, YComponent, ZComponent
pdecon_3 = Deconstruct(Point=curvepoint)  # -> XComponent, YComponent, ZComponent
sort_2 = SortList(Keys=pdecon_2.ZComponent, ValuesA=pt_3)  # -> Keys, ValuesA
ma_2 = MassAddition(Input=sort_2.ValuesA)  # -> Result, PartialResults
division_2 = Division(A=ma_2.Result, B=4)
split = SplitList(List=sort.ValuesA, Index=2)  # -> BasePoints, TopPoints
pt_4 = Point(division_2)
srf_cp_2 = SurfaceClosestPoint(Point=flatten(pt_4), Surface=srf_3)  # -> Point, UVPoint, Distance
evalsrf = EvaluateSurface(Surface=srf_3, Point=srf_cp_2.UVPoint)  # -> Point, Normal, Frame
sort_3 = SortList(Keys=pdecon_3.ZComponent, ValuesA=crv_4)  # -> Keys, ValuesA
evalsrf_2 = EvaluateSurface(Surface=srf_2, Point=srf_cp.UVPoint)  # -> Point, Normal, Frame
split_2 = SplitList(List=sort_2.ValuesA, Index=2)  # -> BasePoints, TopPoints
Y = UnitY(Factor=1)
base_arc = ListItem(List=sort_3.ValuesA, Index=0, Wrap=True)  # -> flatten(Item)
pt_5 = Point(split_2.BasePoints)
Y_2 = UnitY(Factor=1)
pdecon_4 = Deconstruct(Point=split.TopPoints)  # -> XComponent, YComponent, ZComponent
pdecon_5 = Deconstruct(Point=split.BasePoints)  # -> XComponent, YComponent, ZComponent
line = LineSDL(Start=evalsrf.Point, Direction=Y, Length=35000)
line_2 = LineSDL(Start=evalsrf.Point, Direction=evalsrf.Normal, Length=1500)
curvepoint_2 = PointOnCurve(base_arc, parameter=0.504)
end = EndPoints(Curve=base_arc)  # -> Start, End
pdecon_6 = Deconstruct(Point=split_2.TopPoints)  # -> XComponent, YComponent, ZComponent
pdecon_7 = Deconstruct(Point=split_2.BasePoints)  # -> XComponent, YComponent, ZComponent
line_3 = LineSDL(Start=evalsrf_2.Point, Direction=evalsrf_2.Normal, Length=1500)
split_3 = SplitList(List=pt_5, Index=1)  # -> ListA, ListB
subtraction = Subtraction(A=pdecon_4.ZComponent, B=pdecon_5.ZComponent)
split_4 = SplitList(List=pdecon_6.ZComponent, Index=1)  # -> flatten(ListA), flatten(ListB)
ln = Line(StartPoint=split_3.ListA, EndPoint=split_3.ListB)
end_2 = EndPoints(Curve=line_3)  # -> Start, End
split_5 = SplitList(List=pdecon_7.ZComponent, Index=1)  # -> flatten(ListA), flatten(ListB)
xy = XYPlane(Origin=Point(0, 0, 0))
start_point = Point(end.Start)
insert_point = Point(flatten(pt_4))
end_point = Point(end.End)
arc = Arc3Pt(PointA=start_point, PointB=curvepoint_2, PointC=end_point)  # -> Arc, Plane, Radius
pdecon_8 = Deconstruct(Point=end_2.End)  # -> XComponent, YComponent, ZComponent
xy_2 = XYPlane(Origin=Point(0, 0, 0))
pdecon_9 = Deconstruct(Point=insert_point)  # -> XComponent, YComponent, ZComponent
darc = DeconstructArc(Arc=arc.Arc)  # -> BasePlane, Radius, Angle
angle = Angle(VectorA=line_2, VectorB=line, Plane=xy_2)  # -> Angle, Reflex
split_6 = SplitList(List=subtraction, Index=1)  # -> flatten(ListA), flatten(ListB)
layer = TextJoin(Text=cull_i_2)  # -> flatten(Result)
deg = Degrees(Radians=darc.Angle)  # -> flatten(Degrees)
deplane = DeconstructPlane(Plane=darc.BasePlane)  # -> Origin, XAxis, YAxis, ZAxis
line_4 = LineSDL(Start=deplane.Origin, Direction=Y_2, Length=35000)
ln_2 = Line(StartPoint=deplane.Origin, EndPoint=curvepoint_2)
pdecon_10 = Deconstruct(Point=deplane.Origin)  # -> XComponent, YComponent, ZComponent
angle_2 = Angle(VectorA=ln_2, VectorB=line_4, Plane=xy)  # -> Angle, Reflex
deg_2 = Degrees(Radians=angle_2.Angle)  # -> flatten(Degrees)
pt_6 = ConstructPoint(XCoordinate=pdecon_8.XComponent, YCoordinate=pdecon_8.YComponent, ZCoordinate=pdecon_10.ZComponent)
len_2 = Length(Curve=ln)  # -> flatten(Length)
deg_3 = Degrees(Radians=angle.Angle)  # -> flatten(Degrees)
layer_2 = TextJoin(Text=cull_i)  # -> flatten(Result)
subtraction_2 = Subtraction(A=split_4.ListA, B=pdecon_9.ZComponent)
subtraction_3 = Subtraction(A=pdecon_9.ZComponent, B=split_5.ListA)
subtraction_4 = Subtraction(A=pdecon_9.ZComponent, B=split_5.ListB)
subtraction_5 = Subtraction(A=split_4.ListB, B=pdecon_9.ZComponent)
pdecon_11 = Deconstruct(Point=insert_point)  # -> XComponent, YComponent, ZComponent
pdecon_12 = Deconstruct(Point=deplane.Origin)  # -> XComponent, YComponent, ZComponent
dist = Distance(PointA=deplane.Origin, PointB=pt_6)
smaller_2 = SmallerThan(FirstNumber=arc.Radius, SecondNumber=dist)  # -> SmallerThan, OrEqualTo
combine = CombineData(Input0=pdecon_11.XComponent, Input1=pdecon_11.YComponent)  # -> Result, Index
dispatch_2 = Dispatch(List=srf_2, DispatchPattern=smaller_2.SmallerThan)  # -> ListA, Concave
button = Button()
replace = ReplaceMembers(Set=smaller_2.SmallerThan, Find=Toggle(True), Replace=1)
entwine = Entwine(
    Branch00=pdecon_11.XComponent,
    Branch01=pdecon_11.YComponent,
    Branch02=pdecon_11.ZComponent,
    Branch03=subtraction_3,
    Branch04=subtraction_4,
    Branch05=subtraction_2,
    Branch06=subtraction_5,
    Branch07=len_2,
    Branch08=deg_3,
    FlattenInputs=True)  # -> simplify(Result)
replace_2 = ReplaceMembers(Set=replace, Find=Toggle(False), Replace=0)
entwine_2 = Entwine(
    Branch00=pdecon_12.XComponent,
    Branch01=pdecon_12.YComponent,
    Branch02=pdecon_12.ZComponent,
    Branch03=darc.Radius,
    Branch04=deg,
    Branch05=deg_2,
    Branch06=split_6.ListA,
    Branch07=split_6.ListB,
    Branch08=replace_2,
    FlattenInputs=True)  # -> simplify(Result)
path = FilePath("E:\000_COMAS\26-BNP - Cephe\COMAS\_updated_model\excel\shadow_box.xlsx")
srf_4 = Surface(dispatch_2.ListA)
srf_5 = Surface(dispatch_2.Concave)
panel_3 = Panel(replace_2)
excelwrite = ExcelWrite(
    WriteExcelData=button,
    WorkbookPath=path,
    WorksheetName="Curved",
    ColumnHeadings=["cX", "cY", "cZ", "R", "A", "Axy", "h1", "h2", "Form"],
    Data=entwine_2,
    ClearSheet=True)
excelwrite_2 = ExcelWrite(
    WriteExcelData=button,
    WorkbookPath=path,
    WorksheetName="planar",
    ColumnHeadings=["X", "Y", "Z", "lh1", "lh2", "h1", "h2", "W", "Ang"],
    Data=entwine,
    ClearSheet=True)
