# Dynamo graph P2_Create_Face_Families.dyn "Create_Face_Families" (Dynamo 2.13.1.3887)

select_model_element = DSModelElementSelection()  # 1 picked in the model
geometry = Element.Geometry(element=select_model_element)
area = Surface.Area(surface=geometry)
isNull = Object.IsNull(object=area)
filterByBoolMask = List.FilterByBoolMask(list=geometry, mask=isNull)
perimeterCurves = Surface.PerimeterCurves(surface=filterByBoolMask.out)
byJoinedCurves = PolyCurve.ByJoinedCurves(curves=perimeterCurves)
isPlanar = Curve.IsPlanar(curve=byJoinedCurves)
filterByBoolMask_2 = List.FilterByBoolMask(list=filterByBoolMask.out, mask=isPlanar)
perimeterCurves_2 = Surface.PerimeterCurves(surface=filterByBoolMask_2.out)
code_block = CodeBlock { 0.5; }
pointAtParameter = Curve.PointAtParameter(curve=perimeterCurves_2, param=code_block)
Z = Point.Z(point=pointAtParameter)
round = Math.Round(number=Z)
minimumItem = List.MinimumItem(list=round)
eq = round == minimumItem
filterByBoolMask_3 = List.FilterByBoolMask(list=perimeterCurves_2, mask=eq)
code_block_2 = CodeBlock { [0,0.2,0.3,0.4,0.5,0.6,0.7,0.8,0.9,1]; }
pointAtParameter_2 = Curve.PointAtParameter(curve=filterByBoolMask_3.in@L1, param=code_block_2)
byBestFitThroughPoints = Arc.ByBestFitThroughPoints(points=pointAtParameter_2)
endPoint = Curve.EndPoint(curve=byBestFitThroughPoints)
Z_2 = Point.Z(point=endPoint)
byCoordinates = Point.ByCoordinates(z=Z_2)
byPoint = FamilyInstance.ByPoint(point=byCoordinates)  # unwired: familyType
parameters = Element.Parameters(element=byPoint)
code_block_3 = CodeBlock { "End_X"; }
startPoint = Curve.StartPoint(curve=byBestFitThroughPoints)
X = Point.X(point=startPoint)
setParameterByName = Element.SetParameterByName(element=byPoint, parameterName=code_block_3, value=X)
code_block_4 = CodeBlock { "End_Y"; }
Y = Point.Y(point=startPoint)
setParameterByName_2 = Element.SetParameterByName(element=byPoint, parameterName=code_block_4, value=Y)
code_block_5 = CodeBlock { "Start_X"; }
X_2 = Point.X(point=endPoint)
setParameterByName_3 = Element.SetParameterByName(element=byPoint, parameterName=code_block_5, value=X_2)
code_block_6 = CodeBlock { "Start_Y"; }
Y_2 = Point.Y(point=endPoint)
setParameterByName_4 = Element.SetParameterByName(element=byPoint, parameterName=code_block_6, value=Y_2)
code_block_7 = CodeBlock { "h1"; }
round_2 = Math.Round(number=Z)
maximumItem = List.MaximumItem(list=round_2)
eq_2 = round_2 == maximumItem
filterByBoolMask_4 = List.FilterByBoolMask(list=perimeterCurves_2, mask=eq_2)
pointAtParameter_3 = Curve.PointAtParameter(curve=filterByBoolMask_4.in@L1, param=code_block_2)
byBestFitThroughPoints_2 = Arc.ByBestFitThroughPoints(points=pointAtParameter_3)
endPoint_2 = Curve.EndPoint(curve=byBestFitThroughPoints_2)
Z_3 = Point.Z(point=endPoint_2)
Z_4 = Point.Z(point=endPoint)
code_block_8 = CodeBlock(a=Z_3, b=Z_4) { a-b; }
setParameterByName_5 = Element.SetParameterByName(element=byPoint, parameterName=code_block_7, value=code_block_8)
code_block_9 = CodeBlock { "h2"; }
startPoint_2 = Curve.StartPoint(curve=byBestFitThroughPoints_2)
Z_5 = Point.Z(point=startPoint_2)
code_block_10 = CodeBlock(a=Z_5, b=Z_2) { a-b; }
setParameterByName_6 = Element.SetParameterByName(element=byPoint, parameterName=code_block_9, value=code_block_10)
code_block_11 = CodeBlock { "Sweep Radius"; }
sweepAngle = Arc.SweepAngle(arc=byBestFitThroughPoints)
setParameterByName_7 = Element.SetParameterByName(element=byPoint, parameterName=code_block_11, value=sweepAngle)
code_block_12 = CodeBlock { 0.5; }
pointAtParameter_4 = Surface.PointAtParameter(surface=filterByBoolMask_2.out, u=code_block_12, v=code_block_12)
family_types = FamilyTypes()  # nothing selected
perimeterCurves_3 = Surface.PerimeterCurves(surface=filterByBoolMask_2.in)
code_block_13 = CodeBlock { 0.5; }
pointAtParameter_5 = Curve.PointAtParameter(curve=perimeterCurves_3, param=code_block_13)
Z_6 = Point.Z(point=pointAtParameter_5)
round_3 = Math.Round(number=Z_6)
minimumItem_2 = List.MinimumItem(list=round_3)
eq_3 = round_3 == minimumItem_2
filterByBoolMask_5 = List.FilterByBoolMask(list=perimeterCurves_3, mask=eq_3)
code_block_14 = CodeBlock { 0.5; }
pointAtParameter_6 = Curve.PointAtParameter(curve=filterByBoolMask_5.in, param=code_block_14)
byPoint_2 = FamilyInstance.ByPoint(familyType=family_types, point=pointAtParameter_6)
code_block_15 = CodeBlock { "Width"; }
length = Curve.Length(curve=filterByBoolMask_5.in)
round_4 = Math.Round(number=length)
setParameterByName_8 = Element.SetParameterByName(element=byPoint_2, parameterName=code_block_15, value=round_4)
startPoint_3 = Curve.StartPoint(curve=filterByBoolMask_5.in)
X_3 = Point.X(point=startPoint_3)
Y_3 = Point.Y(point=startPoint_3)
byCoordinates_2 = Point.ByCoordinates(x=X_3, y=Y_3)
endPoint_3 = Curve.EndPoint(curve=filterByBoolMask_5.in)
X_4 = Point.X(point=endPoint_3)
Y_4 = Point.Y(point=endPoint_3)
byCoordinates_3 = Point.ByCoordinates(x=X_4, y=Y_4)
byTwoPoints = Vector.ByTwoPoints(start=byCoordinates_2, end=byCoordinates_3)
XAxis = Vector.XAxis()
ZAxis = Vector.ZAxis()
angleAboutAxis = Vector.AngleAboutAxis(vector=byTwoPoints, otherVector=XAxis, rotationAxis=ZAxis)
setRotation = FamilyInstance.SetRotation(familyInstance=byPoint_2, degree=angleAboutAxis)
YAxis = Vector.YAxis()
code_block_16 = CodeBlock { 0.5; }
normalAtParameter = Surface.NormalAtParameter(surface=filterByBoolMask_2.in, u=code_block_16, v=code_block_16)
code_block_17 = CodeBlock { "base_H1"; }
Z_7 = Point.Z(point=endPoint_3)
setParameterByName_9 = Element.SetParameterByName(element=byPoint_2, parameterName=code_block_17, value=Z_7)
code_block_18 = CodeBlock { "base_H2"; }
Z_8 = Point.Z(point=startPoint_3)
setParameterByName_10 = Element.SetParameterByName(element=byPoint_2, parameterName=code_block_18, value=Z_8)
code_block_19 = CodeBlock { "top_H1"; }
round_5 = Math.Round(number=Z_6)
maximumItem_2 = List.MaximumItem(list=round_5)
eq_4 = round_5 == maximumItem_2
filterByBoolMask_6 = List.FilterByBoolMask(list=perimeterCurves_3, mask=eq_4)
startPoint_4 = Curve.StartPoint(curve=filterByBoolMask_6.in)
Z_9 = Point.Z(point=startPoint_4)
setParameterByName_11 = Element.SetParameterByName(element=byPoint_2, parameterName=code_block_19, value=Z_9)
code_block_20 = CodeBlock { "top_H2"; }
endPoint_4 = Curve.EndPoint(curve=filterByBoolMask_6.in)
Z_10 = Point.Z(point=endPoint_4)
setParameterByName_12 = Element.SetParameterByName(element=byPoint_2, parameterName=code_block_20, value=Z_10)
